# Grasshopper definition 00_Introduction.gh (Grasshopper 0.9.76)

number_slider = Slider(6.607, range=0..40)
yz = YZPlane(Origin=Point(0, 0, 0))
series = Series(Start=0, Step=5, Count=10)
pt = Point(Point(5.481704909, 0.1015013194, 0))
cir = Circle(Plane=yz, Radius=series)
vec = VectorXYZ(XComponent=Slider(0, range=0..50), YComponent=Slider(0, range=0..40), ZComponent=Slider(16.657, range=0..40))  # -> Vector, Length
panel = Panel(series)
move = Move(Geometry=cir, Motion=vec.Vector)  # -> Geometry, Transform
