# Grasshopper definition 01_Drawing Exercise 1.gh (Grasshopper 0.9.76)

number_slider = Slider(335, range=0..400)
series = Series(Start=0, Step=Slider(2, range=0..10), Count=number_slider)
series_2 = Series(Start=0, Step=1, Count=number_slider)
series_3 = Series(Start=Slider(8.13, range=0..100), Step=Slider(2.536, range=0..100), Count=number_slider)
pt = ConstructPoint(XCoordinate=series, YCoordinate=series_2, ZCoordinate=0)
cir = Circle(Plane=pt, Radius=series_3)
series_4 = Series(Start=Slider(0, range=0..100), Step=Slider(0.099, range=0..6.283), Count=number_slider)
pt_2 = Point(Point(-11.63260259, 117.2477484, 0))
rotate = Rotate(Geometry=cir, Angle=series_4, Plane=pt_2)  # -> Geometry, Transform
panel = Panel(series)
panel_2 = Panel(series_2)
divide = DivideCurve(Curve=rotate.Geometry, Count=Slider(7, range=0..10), Kinks=False)  # -> Points, Tangents, Parameters
panel_3 = Panel(pt)
pline = PolyLine(Vertices=divide.Points, Closed=Toggle(True))
dash = DashPattern(Curve=pline, Pattern=Slider(4.538, range=0..10))  # -> Dashes, Gaps
