# Grasshopper definition Bezier and Extend.gh (Grasshopper 0.9.76)

number_slider = Slider(100, range=0..100)
crv = Curve(<curve referenced from the Rhino model>)
crv_2 = Curve(<curve referenced from the Rhino model>)
divide = DivideCurve(Curve=crv, Count=number_slider, Kinks=False)  # -> Points, Tangents, Parameters
divide_2 = DivideCurve(Curve=crv_2, Count=number_slider, Kinks=False)  # -> Points, Tangents, Parameters
Z = UnitZ(Factor=1)
Z_2 = UnitZ(Factor=1)
vrot = Rotate(Vector=divide_2.Tangents, Axis=Z, Angle="pi/2")
vrot_2 = Rotate(Vector=divide.Tangents, Axis=Z_2, Angle="pi/2")
amp = Amplitude(Vector=vrot, Amplitude=Slider(17, range=0..100))
amp_2 = Amplitude(Vector=vrot_2, Amplitude=Slider(100, range=0..100))
series = Series(Start=0, Step=Slider(0.9, range=0..10), Count=number_slider)
neg = Negative(Value=amp_2)
bzspan = BezierSpan(StartPoint=divide_2.Points, StartTangent=amp, EndPoint=divide.Points, EndTangent=neg)  # -> Curve, Length, Domain
ext = ExtendCurve(Curve=bzspan.Curve, Type=2, Start=series, End=series)
dash = DashPattern(Curve=ext, Pattern=Slider(1, range=0..10))  # -> Dashes, Gaps
