# Grasshopper definition Box Subtract-2 (exploded).gh (Grasshopper 0.9.76)
# plug-ins: Human

number_slider = Slider(24, range=0..100)
number_slider_2 = Slider(0.4, range=0..1)
box = CenterBox(Base=PlaneXY(0, 0, 0), X=1, Y=1, Z=1)
pop3d = Populate3D(Region=box, Count=number_slider, Seed=number_slider)
box_2 = CenterBox(Base=pop3d, X=number_slider_2, Y=number_slider_2, Z=number_slider_2)
swatch = White(SwatchColor=RGB(255, 255, 255))
sdiff = SolidDifference(BrepsA=box, BrepsB=box_2)
preview = CustomPreview(Geometry=sdiff, Shader=swatch)
debrep = DeconstructBrep(Brep=sdiff)  # -> Faces, Edges, Vertices
debrep_2 = DeconstructBrep(Brep=debrep.Faces)  # -> Faces, Edges, Vertices
srfcen = SurfaceCenter(S=debrep.Faces)  # -> P, N, F
edges = BrepEdges(Brep=sdiff)  # -> Naked, Interior, NonManifold
swatch_2 = Black(SwatchColor=RGB(0, 0, 0))
amp = Amplitude(Vector=srfcen.N, Amplitude=Slider(3.4, range=0..10))
move = Move(Geometry=debrep.Faces, Motion=amp)  # -> Geometry, Transform
previewlw = CustomPreviewLineweights(Geometry=edges.Interior, Shader=swatch_2, Thickness=Slider(5, range=0..10), Absolute=False)
debrep_3 = DeconstructBrep(Brep=move.Geometry)  # -> Faces, Edges, Vertices
ln = Line(StartPoint=debrep_2.Vertices, EndPoint=debrep_3.Vertices)
dash = DashPattern(Curve=ln, Pattern=Slider(0.047, range=0..0.1))  # -> Dashes, Gaps

# ==== cluster SurfaceCenter: Get surf at 0.5,0.5
S = ClusterInput()
pt = Point("0.5,0.5")
evalsrf = EvaluateSurface(Surface=reparameterize(S), Point=pt)  # -> Point, Normal, Frame
P = ClusterOutput(evalsrf.Point)
F = ClusterOutput(evalsrf.Frame)
N = ClusterOutput(evalsrf.Normal)
