# Grasshopper definition Box Subtract.gh (Grasshopper 0.9.76)
# plug-ins: Human

number_slider = Slider(17, range=0..100)
number_slider_2 = Slider(0.4, range=0..1)
box = CenterBox(Base=PlaneXY(0, 0, 0), X=1, Y=1, Z=1)
pop3d = Populate3D(Region=box, Count=number_slider, Seed=number_slider)
box_2 = CenterBox(Base=pop3d, X=number_slider_2, Y=number_slider_2, Z=number_slider_2)
edges = BrepEdges(Brep=box_2)  # -> Naked, Interior, NonManifold
sdiff = SolidDifference(BrepsA=box, BrepsB=box_2)
pt = Point(Point(0.4985818871, 0.4896269028, 1))
shear = Shear(Geometry=sdiff, Base=PlaneXY(0, 0, 0), Grip=Point(0, 0, 1), Target=pt)  # -> Geometry, Transform
shear_2 = Shear(Geometry=edges.Interior, Base=PlaneXY(0, 0, 0), Grip=Point(0, 0, 1), Target=pt)  # -> Geometry, Transform
swatch = White(SwatchColor=RGB(201, 201, 201))
edges_2 = BrepEdges(Brep=shear.Geometry)  # -> Naked, Interior, NonManifold
dash = DashPattern(Curve=shear_2.Geometry, Pattern=Slider(0.1, range=0..0.1))  # -> Dashes, Gaps
preview = CustomPreview(Geometry=shear.Geometry, Shader=swatch)
swatch_2 = Black(SwatchColor=RGB(0, 0, 0))
previewlw = CustomPreviewLineweights(Geometry=edges_2.Interior, Shader=swatch_2, Thickness=Slider(3, range=0..10), Absolute=False)
