# Grasshopper definition Distance Attractor and Graph Mapper.gh (Grasshopper 0.9.76)

# ---- group: g_
# General
# User-Defined
data = Data(0)

# ---- group: 1_
data_2 = Data(0)

# ---- group: gi_
# Component Category Key
# Inputs
# Gh Input
# Operations
data_3 = Data(0)

# ---- group: v_
# Visualization
data_4 = Data(0)

# ---- group: ri_
# Rh Input
data_5 = Data(0)

# ---- group: 2_
data_6 = Data(0)

# ---- group: ei_
# Ext Input
# Output
data_7 = Data(0)

# ---- group: o_
# Output
data_8 = Data(0)

# ---- group: 3_
data_9 = Data(0)

# ----
hexgrid = Hexagonal(Plane=PlaneXY(0, 0, 0), Size=1, ExtentX=Slider(40, range=0..100), ExtentY=Slider(26, range=0..100))  # -> Cells, Points
number_slider = Slider(1, range=0..10)
pt = Point(<point referenced from the Rhino model>)
pt_2 = Point(hexgrid.Points)
pdecon = Deconstruct(Point=pt_2)  # -> XComponent, YComponent, ZComponent
dist = Distance(PointA=pt, PointB=pt_2)
multiplication = Multiplication(A=dist, B=Slider(0.03, range=0..1))
graph = GraphMapper(
    multiplication,
    x0=0,
    x1=1,
    y0=0,
    y1=1,
    container_name="Sine",
    Equation_px=[0, 0.1753257066],
    Equation_py=[0.3282318115, 0.988637507])
cir = Circle(Plane=pt_2, Radius=graph)
mesh = Mesh(cir)

# ----
# Grasshopper Version
# Rev
# File Name
# File Path
# Created By
# Date Updated
# Date Created
# Description
panel = Panel(" ")

# ----
# Template
# Script
auto_color_grps = BooleanToggle(True)
run_template_script = BooleanToggle(True)
# Copyright WOODS BAGOT
# Note
# CONTRACTOR MUST VERIFY ALL DATA BEFORE PREPARING SHOP DRAWINGS OR COMMENCING WORK
strip_definition = Button()
doc_properties = CSharpScript(Dsc=panel, Run=run_template_script, W=strip_definition)  # -> out, V, N, R, ghP, A, Dc, Dm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; inputs Dsc: String, Run: Boolean, W: Boolean
# ---------- doc_properties: C# ----------
    if(Run && !W){
      clearing = false;
      //Get GH Version
      _V = Grasshopper.Versioning.Version.ToString();
      V = _V;
      //Get GH Document Name
      _N = GrasshopperDocument.DisplayName;
      N = _N;
      //Get Revision Count
      _R = GrasshopperDocument.Properties.Revisions.Count.ToString();
      R = _R;
      //Get GH document Path
      _ghP = GrasshopperDocument.FilePath;
      ghP = _ghP;
      //Get author name
      _A = GrasshopperDocument.Author.Name + " " + GrasshopperDocument.Author.Email;
      A = _A;
      //Verify that the file exists before calling any methods on it - so as to avoid an error on initial open
      if(GrasshopperDocument.FilePath != null && File.Exists(GrasshopperDocument.FilePath)){
        //Get info about file
        System.IO.FileInfo fi = new FileInfo(GrasshopperDocument.FilePath);
        //Get date created
        _Dc = fi.CreationTime.ToString();
        Dc = _Dc;
        //Get date modified
        _Dm = fi.LastWriteTime.ToString();
        Dm = _Dm;
      }
      //two-way description loop:
      bool NoDescription = String.IsNullOrEmpty(Dsc);
      if(NoDescription){
        if(!String.IsNullOrEmpty(GrasshopperDocument.Properties.Description)){
          Grasshopper.Kernel.Special.GH_Panel descPanel = Component.Params.Input[0].Sources.OfType<Grasshopper.Kernel.Special.GH_Panel>().First();
          descPanel.UserText = GrasshopperDocument.Properties.Description;
          descPanel.ExpireSolution(true);
        }

      } else {
        if(Dsc != GrasshopperDocument.Properties.Description){
          GrasshopperDocument.Properties.Description = Dsc;
        }
      }
      //Get Rhino document path, if any
      _rhP = RhinoDocument.Path;
      rhP = _rhP;
      //Get external libraries used in the document:
      _L = String.Join("\n", GetLibrariesFormatted());
      L = _L;

      if(W){
        writeToFile();
      } else {
        Print("Set W to True to write values to file");
      }


      //Add events to trigger component refresh
      GrasshopperDocument.FilePathChanged -= FileChangeHandler;
      GrasshopperDocument.ObjectsAdded -= ObjectEventHandler;
      GrasshopperDocument.ObjectsDeleted -= ObjectEventHandler;
      GrasshopperDocument.FilePathChanged += FileChangeHandler;
      GrasshopperDocument.ObjectsAdded += ObjectEventHandler;
      GrasshopperDocument.ObjectsDeleted += ObjectEventHandler;
    } else {
      clearing = true;
      //Add events to trigger component refresh
      GrasshopperDocument.FilePathChanged -= FileChangeHandler;
      GrasshopperDocument.ObjectsAdded -= ObjectEventHandler;
      GrasshopperDocument.ObjectsDeleted -= ObjectEventHandler;
      if(W){
        DialogResult result = MessageBox.Show("This button clears all Woods Bagot proprietary scripts from your definition for the purpose of sharing it with consultants and collaborators. This cannot be undone! Are you sure you want to proceed?", "Strip Document", MessageBoxButtons.YesNo);
        if(result == DialogResult.Yes){
          GrasshopperDocument.ScheduleSolution(10, stripItGood);
        }
      }
    }
# ---------- doc_properties: C# additional code ----------
  string _V = "";
  string _N = "";
  string _R = "";
  string _ghP = "";
  string _A = "";
  string _Dc = "";
  string _Dm = "";
  string _L = "";
  string _rhP = "";

  DateTime lastChecked = DateTime.Now;
  bool clearing;
  //Handler for file save
  void FileChangeHandler(object sender, EventArgs e){

    if(clearing) return;
  
    GrasshopperDocument.ScheduleSolution(5, x => Component.ExpireSolution(false));

  }
  void ObjectEventHandler(object sender, Grasshopper.Kernel.GH_DocObjectEventArgs e){

    if(clearing) return;

    if((DateTime.Now - lastChecked).TotalSeconds > 5){
    
      if(e.Objects.Where(o => o is IGH_ActiveObject).Count() > 0){
        Component.ExpireSolution(true);
      }
      lastChecked = DateTime.Now;
    }

  }

  void writeToFile(){

  }


  List<IGH_DocumentObject> GetObjectsRecursive(IList<IGH_DocumentObject> objects){
    List<IGH_DocumentObject> results = new List<IGH_DocumentObject>();

    results.AddRange(objects);
    var clusters = objects.Where(o => o is Grasshopper.Kernel.Special.GH_Cluster);

    foreach(Grasshopper.Kernel.Special.GH_Cluster cluster in clusters){
      var doc = cluster.Document("");
      if(doc != null){
        results.AddRange(GetObjectsRecursive(doc.Objects));
      }
    }


    return results;
  }


  List<string> GetLibrariesFormatted(){
    List<string> librariesFormatted = new List<string>();

    var server = Grasshopper.Instances.ComponentServer;

    var objects = GetObjectsRecursive(GrasshopperDocument.Objects);



    var AllLibraries = objects.Select(o => server.FindAssemblyByObject(o)).Distinct();

    var AddOnLibraries = AllLibraries.Where(l => !l.IsCoreLibrary).ToList();

    //Uncomment below in order to include Core libraries as well:
    // var CoreLibraries = AllLibraries.Where(l => l.IsCoreLibrary).ToList();
    // librariesFormatted.Add("Core Libraries:");
    // CoreLibraries.ForEach(l => librariesFormatted.Add(String.Format("{0} {1}", l.Name, l.Version)));
    //  librariesFormatted.Add("Add-on Libraries:");
    AddOnLibraries.ForEach(l => librariesFormatted.Add(String.Format("{0} {1}", l.Name, l.Version)));


    return librariesFormatted;

  }

  Grasshopper.Kernel.Special.GH_Group findGroup(GH_Document doc, string[] keywords){
    var grps = doc.Objects.OfType<Grasshopper.Kernel.Special.GH_Group>();
    foreach(var grp in grps){
      var scribblesInGroup = grp.Objects().OfType<Grasshopper.Kernel.Special.GH_Scribble>();
      if(scribblesInGroup.Count() > 0){
        foreach(var scribble in scribblesInGroup){
          int matches = 0;
          foreach(string keyword in keywords){
            if(scribble.Text.Contains(keyword)) matches++;
          }
          if(matches == keywords.Length){

            return grp;
          }
        }
      }
    }
    return null;
  }

  void stripItGood(GH_Document doc){
    // var panelsGroup = findGroup(doc, new string[]{"General Document Information"});
    var panelScribbleDict = findScribbleByPanel(doc);
    fixPanelsInGroupNew(panelScribbleDict);
    // fixPanelsInGroup(panelsGroup);
    DelGroupContents(doc, findGroup(doc, new string[]{"Template","Script"}));

    DeTelepathize(doc);




  }


  void fixPanelsInGroupNew(Dictionary<string,Grasshopper.Kernel.Special.GH_Panel> panelScribbleDict){

    Dictionary<string,string> labelsAndVariables = new Dictionary<string,string>();
    labelsAndVariables.Add("Grasshopper Version", _V);
    labelsAndVariables.Add("File Name", _N);
    labelsAndVariables.Add("Rev", _R);
    labelsAndVariables.Add("File Path", _ghP);
    labelsAndVariables.Add("Created By", _A);
    labelsAndVariables.Add("Date Created", _Dc);
    labelsAndVariables.Add("Date Updated", _Dm);
    labelsAndVariables.Add("Libraries", _L);
    labelsAndVariables.Add("Associated Rhino File Path", _rhP);

    foreach(string key in labelsAndVariables.Keys){
      try{
        if(key == "Libraries"){
          panelScribbleDict[key].UserText = labelsAndVariables[key].Replace("Telepathy", "").Replace("\n\n", "\n");
        } else {
          panelScribbleDict[key].UserText = labelsAndVariables[key];
        }
      } catch {

      }
    }


  }

  void fixPanelsInGroup(Grasshopper.Kernel.Special.GH_Group grp){
    var panels = grp.ObjectsRecursive().OfType<Grasshopper.Kernel.Special.GH_Panel>();

    foreach(Grasshopper.Kernel.Special.GH_Panel pnl in panels){

      var currText = pnl.VolatileData.AllData(true).First();
      if(pnl.SourceCount > 0){

        pnl.UserText = currText.ToString();
      }

    }
  }


  void DelGroupContents(GH_Document doc, Grasshopper.Kernel.Special.GH_Group grp){
    List<IGH_DocumentObject> dos = new List<IGH_DocumentObject>();
    grp.ObjectsRecursive().ToList().ForEach(g => dos.Add(g));
    doc.RemoveObjects(dos, false);
  }

  void DeTelepathize(GH_Document doc){
    List<IGH_ActiveObject> deleteQueue = new List<IGH_ActiveObject>();
    foreach(IGH_Param ao in doc.ActiveObjects().Where(p => p is IGH_Param).Cast<IGH_Param>()){
      if(ao.GetType().ToString().Contains("Telepathy.Param_Remote")){
        Grasshopper.Kernel.Parameters.Param_GenericObject dataParam = new  Grasshopper.Kernel.Parameters.Param_GenericObject();
        doc.AddObject(dataParam, false, doc.ObjectCount + 1);
        dataParam.Attributes.Pivot = ao.Attributes.Pivot;
        dataParam.NickName = ao.NickName;
        dataParam.WireDisplay = ao.WireDisplay;
        Grasshopper.Kernel.GH_UpgradeUtil.MigrateSources(ao, dataParam);
        Grasshopper.Kernel.GH_UpgradeUtil.MigrateRecipients(ao, dataParam);
        deleteQueue.Add(ao);
      }
    }

    doc.RemoveObjects(deleteQueue, false);
  }


  Dictionary<string,Grasshopper.Kernel.Special.GH_Panel> findScribbleByPanel(GH_Document doc){
    Dictionary<string,Grasshopper.Kernel.Special.GH_Panel> dict = new Dictionary<string,Grasshopper.Kernel.Special.GH_Panel>();
    var scribbles = doc.Objects.OfType<Grasshopper.Kernel.Special.GH_Scribble>().Where(s => s.Attributes.Pivot.X < 0);
    var panels = doc.Objects.OfType<Grasshopper.Kernel.Special.GH_Panel>();
    foreach(Grasshopper.Kernel.Special.GH_Scribble scribble in scribbles){
      Grasshopper.Kernel.Special.GH_Panel closestPanel = null;
      double minDist = Double.MaxValue;
      foreach(Grasshopper.Kernel.Special.GH_Panel p in panels){
        double dist = pfDist(p.Attributes.Pivot, scribble.Attributes.Pivot);
        if(closestPanel == null || dist < minDist){
          minDist = dist;
          closestPanel = p;
        }
      }
      if(dict.ContainsKey(scribble.Text)){
        if(pfDist(scribble.Attributes.Pivot, dict[scribble.Text].Attributes.Pivot) < minDist){
          dict[scribble.Text] = closestPanel;
        }
      } else {
        dict.Add(scribble.Text, closestPanel);
      }
    }
    return dict;
  }

  double pfDist(PointF frm, PointF to){

    return Math.Pow((frm.X - to.X), 2) + Math.Pow((frm.Y - to.Y), 2);
  }
# ---------- end doc_properties ----------
grpclr = CSharpScript(run=auto_color_grps)  # -> A; inputs run: Boolean
# ---------- grpclr: C# ----------
    GrasshopperDocument.ObjectsAdded -= ObjectsAdded;
    GrasshopperDocument.ObjectsDeleted -= ObjectsRemoved;
    if(run)
    {

      if(firstRun){
//        using (StreamWriter f = File.AppendText(@"C:\My Documents\Desktop\UndoLog.txt"))
//        {
//          f.WriteLine("FirstRun");
//
//        }
        var groups = GrasshopperDocument.Objects.OfType<Grasshopper.Kernel.Special.GH_Group>().ToList();
        groups.ForEach(g => attachEvent(g));

        groups.ForEach(g => colorGroup(g));
        firstRun = false;
      }

      GrasshopperDocument.ObjectsAdded += ObjectsAdded;
      GrasshopperDocument.ObjectsDeleted += ObjectsRemoved;
    } else {
      var groups = GrasshopperDocument.Objects.OfType<Grasshopper.Kernel.Special.GH_Group>().ToList();
      groups.ForEach(g => detachEvent(g));
      firstRun = true;

    }
# ---------- grpclr: C# additional code ----------
  bool firstRun = true;
  void ObjectsAdded(object sender, GH_DocObjectEventArgs e){
//    using (StreamWriter f = File.AppendText(@"C:\My Documents\Desktop\UndoLog.txt"))
//    {
//      f.WriteLine("ObjectsAdded");
//
//    }
    var groups = e.Objects.OfType<Grasshopper.Kernel.Special.GH_Group>();
    if(groups.Count() == 0) return;

    foreach(Grasshopper.Kernel.Special.GH_Group grp in groups){
//      using (StreamWriter f = File.AppendText(@"C:\My Documents\Desktop\UndoLog.txt"))
//      {
//        f.WriteLine("Adding event to group");
//      }
      attachEvent(grp);

    }
  }

  void attachEvent(Grasshopper.Kernel.Special.GH_Group grp){
    grp.ObjectChanged += GroupAttributesChanged;
  }

  void detachEvent(Grasshopper.Kernel.Special.GH_Group grp){
    grp.ObjectChanged -= GroupAttributesChanged;
  }

  void ObjectsRemoved(object sender, GH_DocObjectEventArgs e){
//    using (StreamWriter f = File.AppendText(@"C:\My Documents\Desktop\UndoLog.txt"))
//    {
//      f.WriteLine("ObjectsRemoved");
//
//    }
    var groups = e.Objects.OfType<Grasshopper.Kernel.Special.GH_Group>();
    if(groups.Count() == 0) return;

    foreach(Grasshopper.Kernel.Special.GH_Group grp in groups){

      detachEvent(grp);
    }
  }

  void GroupAttributesChanged(object sender, EventArgs e){
//    using (StreamWriter f = File.AppendText(@"C:\My Documents\Desktop\UndoLog.txt"))
//    {
//      f.WriteLine("GroupAttributesChanging");
//
//
//    }
    colorGroup(sender as Grasshopper.Kernel.Special.GH_Group);
  }


  void colorGroup(Grasshopper.Kernel.Special.GH_Group grp){
    var groups = GrasshopperDocument.Objects.OfType<Grasshopper.Kernel.Special.GH_Group>();

    var keyGroups = groups.Where(g => g.NickName.Reverse().ToArray().FirstOrDefault() == '_');
    var otherGroups = groups.Except(keyGroups);

    if(keyGroups.Contains(grp)) return;

    var keyDictionary = keyGroups.ToDictionary(g => g.NickName, g => g.Colour);

    var splits = grp.NickName.Split('_');
     if(splits.Length == 1) return;
    var prefix = splits[0];
    prefix += '_';
    if(keyDictionary.ContainsKey(prefix)){
      grp.Colour = keyDictionary[prefix];
      grp.NickName = grp.NickName.Replace(prefix, "");

    }
  }
# ---------- end grpclr ----------

# ----
# General Document Information
panel_2 = Panel(doc_properties.V)
panel_3 = Panel(doc_properties.N)
panel_4 = Panel(doc_properties.ghP)
panel_5 = Panel(doc_properties.A)
panel_6 = Panel(doc_properties.Dc)
panel_7 = Panel(doc_properties.Dm)
panel_8 = Panel(doc_properties.R)

# ----
# Document Dependencies
# Associated Rhino File Path
# Libraries
panel_9 = Panel(doc_properties.rhP)
panel_10 = Panel(doc_properties.L)
