# Grasshopper definition Day 3.gh (Grasshopper 0.9.76)
# plug-ins: Human

number_slider = Slider(50, range=0..100)  # disabled
number_slider_2 = Slider(11.47, range=0..100)  # disabled
pt = ConstructPoint(XCoordinate=0, YCoordinate=0, ZCoordinate=0)  # disabled
X = UnitX(Factor=1)  # disabled
number_slider_3 = Slider(0.7, range=0..1)  # disabled
range = Range(Domain=Domain(0, 1), Steps=number_slider)  # disabled
panel = Panel(range)  # disabled
line = LineSDL(Start=pt, Direction=X, Length=number_slider_2)  # disabled
number_slider_4 = Slider(9.87, range=0..100)  # disabled
eval = EvaluateCurve(Curve=reparameterize(line), Parameter=panel)  # -> Point, Tangent, Angle; disabled
pt_2 = Point(<point referenced from the Rhino model>)  # disabled
Y = UnitY(Factor=1)  # disabled
line_2 = LineSDL(Start=eval.Point, Direction=Y, Length=number_slider_4)  # disabled
number_slider_5 = Slider(6.42, range=0..100)  # disabled
number_slider_6 = Slider(1, range=0..1)  # disabled
crv_cp = CurveClosestPoint(Point=pt_2, Curve=line_2)  # -> Point, Parameter, Distance; disabled
bnd = Bounds(Numbers=crv_cp.Distance)  # disabled
dom = ConstructDomain(DomainStart=number_slider_6, DomainEnd=number_slider_5)  # disabled
remap = RemapNumbers(Value=crv_cp.Distance, Source=bnd, Target=dom)  # -> Mapped, Clipped; disabled
remap_2 = RemapNumbers(Value=crv_cp.Distance, Source=bnd, Target=Domain(0, 1))  # -> Mapped, Clipped; disabled
swatch = ColourSwatch(SwatchColor=RGB(255, 255, 255))  # disabled
number_slider_7 = Slider(0.33, range=0..1)  # disabled
jitter = Jitter(List=remap_2.Mapped, Jitter=number_slider_7, Seed=2)  # -> Values, Indices; disabled
gradient = Gradient(
    LowerLimit=0,
    UpperLimit=1,
    Parameter=jitter.Values,
    stops=[0: RGB(243, 57, 0), 0.1: RGB(236, 27, 60), 0.2: RGB(210, 0, 118), 0.3: RGB(103, 0, 120), 0.4: RGB(39, 72, 161), 0.5: RGB(1, 192, 229), 0.6: RGB(18, 178, 90), 0.7: RGB(79, 186, 8), 0.8: RGB(220, 237, 32), 0.9: RGB(247, 159, 20), 1: RGB(243, 57, 0)])  # disabled
previewlw = CustomPreviewLineweights(Geometry=line_2, Shader=gradient, Thickness=remap.Mapped, Absolute=False)  # disabled

crv = Curve([<curve referenced from the Rhino model> x3])

number_slider_8 = Slider(25, range=0..360)  # disabled
panel_2 = Panel("Curve")  # disabled
panel_3 = Panel("Pipeline Test")  # disabled
number_slider_9 = Slider(156, range=0..1000)  # disabled
dpipeline = DynamicGeometryPipeline(
    LayerFilter=panel_3,
    TypeFilter=panel_2,
    NameFilter="*",
    enableFullPath=False,
    GroupByLayer=False,
    GroupByType=False,
    IncludeHidden=True,
    IncludeLocked=True)  # disabled
crv_2 = Curve(reparameterize(dpipeline))  # disabled
panel_4 = Panel(dpipeline)  # disabled
divide = DivideCurve(Curve=crv_2, Count=number_slider_9, Kinks=False)  # -> Points, Tangents, Parameters; disabled
Z = UnitZ(Factor=1)  # disabled
vrot = Rotate(Vector=divide.Tangents, Axis=Z, Angle=degrees(number_slider_8))  # disabled
graph = GraphMapper(
    divide.Parameters,
    x0=0,
    x1=1,
    y0=0,
    y1=1,
    container_name="Bezier",
    cpx=[0, 0.2852172852, 0.7999997139, 1],
    cpy=[0, 0.8976820707, 0.9023189545, 0])  # disabled
panel_5 = Panel(graph)  # disabled
amp = Amplitude(Vector=vrot, Amplitude=panel_5)  # disabled
neg = Negative(Value=amp)  # disabled
move = Move(Geometry=divide.Points, Motion=amp)  # -> Geometry, Transform; disabled
move_2 = Move(Geometry=divide.Points, Motion=neg)  # -> Geometry, Transform; disabled
intcrv = Interpolate(Vertices=move.Geometry, Degree=3, Periodic=False, KnotStyle=1)  # -> Curve, Length, Domain; disabled
intcrv_2 = Interpolate(Vertices=move_2.Geometry, Degree=3, Periodic=False, KnotStyle=1)  # -> Curve, Length, Domain; disabled
loft = Loft(
    Curves=[intcrv.Curve, intcrv_2.Curve],
    Options={Adjust=False, Closed=False, LoftEnds=0, LoftSimp=0, LoftType=0, Rebuild=10, Refit=0.01})  # disabled
swatch_2 = ColourSwatch(SwatchColor=RGB(250, 10, 10))  # disabled
preview = CustomPreview(Geometry=loft, Shader=swatch_2)  # disabled

crv_3 = Curve([<curve referenced from the Rhino model> x7])

# ---- group: Interpolation
range_2 = Range(Domain=Domain(0, 1), Steps=Slider(20, range=0..100))
loft_2 = Loft(Curves=crv, Options={Adjust=False, Closed=False, LoftEnds=0, LoftSimp=0, LoftType=0, Rebuild=10, Refit=0.01})
swatch_3 = Black(SwatchColor=RGB(0, 0, 0))
pt_3 = ConstructPoint(XCoordinate=range_2, YCoordinate=range_2, ZCoordinate=0)
iso = IsoCurve(Surface=reparameterize(loft_2), UVPoint=pt_3)  # -> UIsocurve, VIsocurve
previewlw_2 = CustomPreviewLineweights(Geometry=crv, Shader=swatch_3, Thickness=Slider(4, range=0..10), Absolute=False)
crv_4 = Curve(iso.VIsocurve)
swatch_4 = Black(SwatchColor=RGB(173, 173, 173))
previewlw_3 = CustomPreviewLineweights(Geometry=crv_4, Shader=swatch_4, Thickness=Slider(1, range=0..10), Absolute=False)

# ---- group: Lineweights for base lines
swatch_5 = Black(SwatchColor=RGB(0, 0, 0))
previewlw_4 = CustomPreviewLineweights(Geometry=crv_3, Shader=swatch_5, Thickness=Slider(3, range=0..10), Absolute=False)

# ----
number_slider_10 = Slider(50, range=0..100)  # disabled
number_slider_11 = Slider(11.47, range=0..100)  # disabled
pt_4 = ConstructPoint(XCoordinate=0, YCoordinate=0, ZCoordinate=0)  # disabled
X_2 = UnitX(Factor=1)  # disabled
number_slider_12 = Slider(0.7, range=0..1)  # disabled
range_3 = Range(Domain=Domain(0, 1), Steps=number_slider_10)  # disabled
panel_6 = Panel(range_3)  # disabled
line_3 = LineSDL(Start=pt_4, Direction=X_2, Length=number_slider_11)  # disabled
number_slider_13 = Slider(9.87, range=0..100)  # disabled
eval_2 = EvaluateCurve(Curve=reparameterize(line_3), Parameter=panel_6)  # -> Point, Tangent, Angle; disabled
Y_2 = UnitY(Factor=1)  # disabled
line_4 = LineSDL(Start=eval_2.Point, Direction=Y_2, Length=number_slider_13)  # disabled
pt_5 = Point(<point referenced from the Rhino model>)  # disabled
number_slider_14 = Slider(15, range=0..360)  # disabled
number_slider_15 = Slider(95, range=0..1000)  # disabled
crv_5 = Curve(reparameterize(line_4))  # disabled
divide_2 = DivideCurve(Curve=crv_5, Count=number_slider_15, Kinks=False)  # -> Points, Tangents, Parameters; disabled
dist = Distance(PointA=pt_5, PointB=divide_2.Points)  # disabled
Z_2 = UnitZ(Factor=1)  # disabled
bnd_2 = Bounds(Numbers=dist)  # disabled
vrot_2 = Rotate(Vector=divide_2.Tangents, Axis=Z_2, Angle=degrees(number_slider_14))  # disabled
remap_3 = RemapNumbers(Value=dist, Source=bnd_2, Target=Domain(0, 1))  # -> Mapped, Clipped; disabled
graph_2 = GraphMapper(
    remap_3.Mapped,
    x0=0,
    x1=1,
    y0=0,
    y1=1,
    container_name="Bezier",
    cpx=[0, 0.3733334839, 0.7999997139, 1],
    cpy=[0, 0.5958836079, 0.9023189545, 0])  # disabled
panel_7 = Panel(graph_2)  # disabled
amp_2 = Amplitude(Vector=vrot_2, Amplitude=panel_7)  # disabled
neg_2 = Negative(Value=amp_2)  # disabled
move_3 = Move(Geometry=divide_2.Points, Motion=amp_2)  # -> Geometry, Transform; disabled
move_4 = Move(Geometry=divide_2.Points, Motion=neg_2)  # -> Geometry, Transform; disabled
intcrv_3 = Interpolate(Vertices=move_3.Geometry, Degree=3, Periodic=False, KnotStyle=1)  # -> Curve, Length, Domain; disabled
intcrv_4 = Interpolate(Vertices=move_4.Geometry, Degree=3, Periodic=False, KnotStyle=1)  # -> Curve, Length, Domain; disabled
loft_3 = Loft(
    Curves=[intcrv_3.Curve, intcrv_4.Curve],
    Options={Adjust=False, Closed=False, LoftEnds=0, LoftSimp=0, LoftType=0, Rebuild=10, Refit=0.01})  # disabled
swatch_6 = ColourSwatch(SwatchColor=RGB(250, 10, 10))  # disabled
preview_2 = CustomPreview(Geometry=loft_3, Shader=swatch_6)  # disabled

# ---- group: Tangent Lines
divlength = DivideLength(Curve=crv_3, Length=Slider(0.9, range=0..1))  # -> Points, Tangents, Parameters
line_5 = LineSDL(Start=divlength.Points, Direction=divlength.Tangents, Length=Slider(21, range=0..100))
swatch_7 = Grey(SwatchColor=RGB(196, 196, 196))
preview_3 = CustomPreview(Geometry=line_5, Shader=swatch_7)

# ----
crv_6 = Curve(<curve referenced from the Rhino model>)
number_slider_16 = Slider(32, range=0..100)
crv_7 = Curve(<curve referenced from the Rhino model>)
number_slider_17 = Slider(100, range=0..100)
divide_3 = DivideCurve(Curve=crv_6, Count=number_slider_16, Kinks=False)  # -> Points, Tangents, Parameters
divide_4 = DivideCurve(Curve=crv_7, Count=number_slider_16, Kinks=False)  # -> Points, Tangents, Parameters
Z_3 = UnitZ(Factor=1)
vrot_3 = Rotate(Vector=divide_3.Tangents, Axis=Z_3, Angle=degrees(number_slider_17))
vrot_4 = Rotate(Vector=divide_4.Tangents, Axis=Z_3, Angle=degrees(number_slider_17))
number_slider_18 = Slider(9, range=0..100)
multiplication = Multiplication(A=vrot_3, B=number_slider_18)
multiplication_2 = Multiplication(A=vrot_4, B=number_slider_18)
bzspan = BezierSpan(StartPoint=divide_3.Points, StartTangent=multiplication, EndPoint=divide_4.Points, EndTangent=multiplication_2)  # -> Curve, Length, Domain
range_4 = Range(Domain=Slider(30, range=0..100), Steps=number_slider_16)
ext = ExtendCurve(Curve=bzspan.Curve, Type=1, Start=range_4, End=range_4)

swatch_8 = Red(SwatchColor=RGB(255, 0, 0))

# ---- group: Annotation for arcs
explode = Explode(Curve=crv_3, Recursive=True)  # -> Segments, Vertices
arc = CircularArc(explode.Segments)
darc = DeconstructArc(Arc=arc)  # -> BasePlane, Radius, Angle
cir = Circle(Plane=darc.BasePlane, Radius=darc.Radius)
dash = DashPattern(Curve=cir, Pattern=Slider(0.221, range=0..1))  # -> Dashes, Gaps
eval_3 = EvaluateCurve(Curve=cir, Parameter=Slider(0, range=0..100))  # -> Point, Tangent, Angle
ln = Line(StartPoint=darc.BasePlane, EndPoint=eval_3.Point)
linedim = LineDimension(Line=ln, Text="{0:0.00}", Size=Slider(0.454, range=0..1))
preview_4 = CustomPreview(Geometry=dash.Dashes, Shader=swatch_8)

# ---- group: Take Perpendiculars and extend
divlength_2 = DivideLength(Curve=reparameterize(crv_4), Length=Slider(0.9, range=0..1))  # -> Points, Tangents, Parameters
Z_4 = UnitZ(Factor=1)
number_slider_19 = Slider(427, range=0..1000)
vrot_5 = Rotate(Vector=divlength_2.Tangents, Axis=Z_4, Angle="pi/2")
line_6 = LineSDL(Start=divlength_2.Points, Direction=vrot_5, Length=number_slider_19)
neg_3 = Negative(Value=number_slider_19)
gradient_2 = Gradient(LowerLimit=0, UpperLimit=1, Parameter=divlength_2.Parameters, stops=[0: RGB(255, 109, 31), 1: RGB(0, 0, 0)])
division = Division(A=neg_3, B="2")
amp_3 = Amplitude(Vector=vrot_5, Amplitude=division)
move_5 = Move(Geometry=line_6, Motion=amp_3)  # -> Geometry, Transform
preview_5 = CustomPreview(Geometry=move_5.Geometry, Shader=gradient_2)

# ----
number_slider_20 = Slider(1.1, range=0..10)
cir_2 = Circle(Plane=PlaneXY(0, 0, 0), Radius=Slider(4.7, range=-0.01..10))
mesh = Mesh(cir_2)

# ---- group: Direct Manipulation Curve
crv_8 = Curve(<curve referenced from the Rhino model>)

# ----
X_3 = UnitX(Factor=1)
number_slider_21 = Slider(3, range=0..5)
contour = Contour(Shape=mesh, Point=Point(0, 0, 0), Direction=X_3, Distance=Slider(0.13, range=-0.01..10))
number_slider_22 = Slider(0.13, range=-0.01..10)
number_slider_23 = Slider(0.85, range=0..5)
number_slider_24 = Slider(0.75, range=0..1)
slice_and_slide = SliceAndSlide(crv=cir_2, num=number_slider_24, D=number_slider_23, R=number_slider_21)
slice_and_slide_2 = SliceAndSlide(crv=contour, num=number_slider_24, D=number_slider_23, R=number_slider_21)
Z_5 = UnitZ(Factor=Slider(10, range=-0.01..10))
previewlw_5 = CustomPreviewLineweights(
    Geometry=slice_and_slide_2,
    Shader=ColourSwatch(SwatchColor=RGB(255, 0, 0)),
    Thickness=Slider(3.5, range=-0.01..10),
    Absolute=False)
previewlw_6 = CustomPreviewLineweights(
    Geometry=slice_and_slide,
    Shader=ColourSwatch(SwatchColor=RGB(255, 255, 255)),
    Thickness=Slider(5, range=-0.01..10),
    Absolute=False)
# Interpolation
range_5 = Range(Domain=Domain(0, 1), Steps=Slider(62, range=0..100))
pt_6 = ConstructPoint(XCoordinate=range_5, YCoordinate=range_5, ZCoordinate=0)
# Take Perpendiculars and extend
number_slider_25 = Slider(1, range=0..10)
grid_slicer = GridSlicer(U=10, V=10)
swatch_9 = Black(SwatchColor=RGBA(173, 173, 173, 160))
number_slider_26 = Slider(3.745, range=0..1000)
Z_6 = UnitZ(Factor=1)
Z_7 = UnitZ(Factor=Slider(8.07, range=-0.01..10))
# Tangent Lines
number_slider_27 = Slider(0.2, range=0..1)
neg_4 = Negative(Value=number_slider_26)
number_slider_28 = Slider(1.361, range=0..100)
division_2 = Division(A=neg_4, B="2")
neg_5 = Negative(Value=number_slider_28)
swatch_10 = Grey(SwatchColor=RGB(255, 226, 5))
Z_8 = UnitZ(Factor="-250")

number_slider_29 = Slider(36, range=0..110)
number_slider_30 = Slider(21, range=0..100)
box = CenterBox(Base=PlaneXY(0, 0, 0), X=number_slider_20, Y=number_slider_20, Z=number_slider_20)
number_slider_31 = Slider(0.328, range=0..1)
pop3d = Populate3D(Region=box, Count=number_slider_29, Seed=number_slider_29)
box_2 = CenterBox(Base=pop3d, X=number_slider_31, Y=number_slider_31, Z=number_slider_31)
sdiff = SolidDifference(BrepsA=box, BrepsB=box_2)
pt_7 = ConstructPoint(XCoordinate=Slider(2, range=1..15), YCoordinate=Slider(2, range=1..15), ZCoordinate=Slider(5, range=1..15))
shear = Shear(Geometry=sdiff, Base=PlaneXY(0, 0, 0), Grip=Point(0, 0, 1), Target=pt_7)  # -> Geometry, Transform

move_6 = Move(Geometry=shear.Geometry, Motion=Z_5)  # -> Geometry, Transform

preview_6 = CustomPreview(Geometry=move_6.Geometry, Shader=ColourSwatch(SwatchColor=RGBA(255, 238, 0, 150)))

# ---- group: Curve Creation & Array
number_slider_32 = Slider(12, range=2..20)
series = Series(Start=0, Step=Slider(0.7, range=0.5..30), Count=number_slider_32)
Y_3 = UnitY(Factor=series)

# ----
vec = VectorXYZ(XComponent=series, YComponent=series, ZComponent=0)  # -> Vector, Length

# ---- group: Curve Creation & Array (continued)
move_7 = Move(Geometry=crv_8, Motion=vec.Vector)  # -> Geometry, Transform

# ---- group: Scale & Manipulation of Array
range_6 = Range(Domain=Domain(0, 1), Steps=expr("x-1", number_slider_32))
graph_3 = GraphMapper(range_6, x0=0, x1=1, y0=0, y1=1, container_name="Gaussian", factor=0.4866669178, mean=0.681448698, sdev=0.2040573657)
graph_4 = GraphMapper(
    range_6,
    x0=0,
    x1=1,
    y0=0,
    y1=1,
    container_name="Sine",
    Equation_px=[0, 0.3643922806],
    Equation_py=[0.1497395635, 0.8502144217])
panel_8 = Panel(graph_4)
curvepoint = PointOnCurve(move_7.Geometry, parameter=0.5)
remap_4 = RemapNumbers(Value=graph_3, Source=Domain(0, 1), Target=Slider(3, range=0.25..3))  # -> Mapped, Clipped
panel_9 = Panel(remap_4.Mapped)
scale_nu = ScaleNU(Geometry=move_7.Geometry, Plane=curvepoint, ScaleX=graph_4, ScaleY=1, ScaleZ=panel_9)  # -> Geometry, Transform

# ---- group: xy axis rotation
pdecon = Deconstruct(Point=curvepoint)  # -> XComponent, YComponent, ZComponent
pt_8 = ConstructPoint(XCoordinate=pdecon.XComponent, YCoordinate=pdecon.YComponent, ZCoordinate=0)
pline = PolyLine(Vertices=pt_8, Closed=False)
rotax = RotateAxis(Geometry=scale_nu.Geometry, Angle=Slider(-0.13, range=-1..1), Axis=pline)  # -> Geometry, Transform

# ----
loft_4 = Loft(Curves=rotax.Geometry, Options={Adjust=False, Closed=False, LoftEnds=0, LoftSimp=0, LoftType=0, Rebuild=10, Refit=0.01})

# ---- group: Final Geometry
loft_5 = Loft(Curves=rotax.Geometry, Options={Adjust=False, Closed=False, LoftEnds=0, LoftSimp=0, LoftType=0, Rebuild=10, Refit=0.01})
loft_6 = Loft(Options={Adjust=False, Closed=False, LoftEnds=0, LoftSimp=0, LoftType=0, Rebuild=10, Refit=0.01})  # disabled

# ----
iso_2 = IsoCurve(Surface=reparameterize(loft_4), UVPoint=pt_6)  # -> UIsocurve, VIsocurve
sdivide = DivideSurface(Surface=loft_5, UCount=Slider(17, range=0..100), VCount=Slider(54, range=0..100))  # -> Points, Normals, Parameters
crv_9 = Curve(iso_2.VIsocurve)
iso_3 = IsoCurve(Surface=loft_5, UVPoint=sdivide.Parameters)  # -> UIsocurve, VIsocurve
contour_2 = Contour(Shape=loft_5, Point=Point(0, 0, 0), Direction=Vector(0, 0, 1), Distance=Slider(0.034, range=-0.01..1))
previewlw_7 = CustomPreviewLineweights(Geometry=crv_9, Shader=swatch_9, Thickness=number_slider_25, Absolute=False)
crv_10 = Curve(iso_3.UIsocurve)
crv_11 = Curve(iso_3.VIsocurve)
divlength_3 = DivideLength(Curve=reparameterize(crv_9), Length=Slider(0.19, range=0..1))  # -> Points, Tangents, Parameters
vrot_6 = Rotate(Vector=divlength_3.Tangents, Axis=Z_6, Angle="pi/2")
move_8 = Move(Geometry=contour_2, Motion=Z_7)  # -> Geometry, Transform
dash_2 = DashPattern(Curve=move_8.Geometry, Pattern=Slider(0.05, range=-0.01..10))  # -> Dashes, Gaps
line_7 = LineSDL(Start=divlength_3.Points, Direction=vrot_6, Length=number_slider_26)
gradient_3 = Gradient(LowerLimit=0, UpperLimit=1, Parameter=divlength_3.Parameters, stops=[0: RGBA(255, 255, 255, 87), 1: RGBA(0, 0, 0, 91)])
amp_4 = Amplitude(Vector=vrot_6, Amplitude=division_2)
project = Project(Geometry=dash_2.Dashes, Plane=PlaneXY(0, 0, 0))  # -> Geometry, Transform
divlength_4 = DivideLength(Curve=rotax.Geometry, Length=number_slider_27)  # -> Points, Tangents, Parameters
divlength_5 = DivideLength(Curve=rotax.Geometry, Length=number_slider_27)  # -> Points, Tangents, Parameters
previewlw_8 = CustomPreviewLineweights(
    Geometry=project.Geometry,
    Shader=ColourSwatch(SwatchColor=RGB(0, 13, 255)),
    Thickness=Slider(3, range=1..10),
    Absolute=False)
move_9 = Move(Geometry=line_7, Motion=amp_4)  # -> Geometry, Transform
line_8 = LineSDL(Start=divlength_4.Points, Direction=divlength_4.Tangents, Length=number_slider_28)
line_9 = LineSDL(Start=divlength_5.Points, Direction=divlength_5.Tangents, Length=neg_5)
move_10 = Move(Geometry=move_9.Geometry, Motion=Z_8)  # -> Geometry, Transform
previewlw_9 = CustomPreviewLineweights(Geometry=[line_8, line_9], Shader=swatch_10, Thickness=Slider(1, range=0..1), Absolute=False)
previewlw_10 = CustomPreviewLineweights(Geometry=move_10.Geometry, Shader=gradient_3, Thickness=Slider(2, range=1..5), Absolute=False)

# ==== cluster GridSlicer
crv = ClusterInput()
U = ClusterInput()
V = ClusterInput()
crv_2 = Curve(flatten(crv))
bbox = BoundingBox(Content=crv_2, Plane=PlaneXY(0, 0, 0), UnionBox=True)  # -> Box, Box_2
srf = Srf(bbox.Box)
divide = DivideDomain²(Domain=srf, UCount=U, VCount=V)
box = EvaluateBox(Box=bbox.Box, UParameter=0.5, VParameter=0.5, WParameter=0.5)  # -> Plane, Point, Include
xy = XYPlane(Origin=Point(0, 0, 0))
subsrf = Isotrim(Surface=srf, Domain=divide)  # -> graft(Surface)
scale = Scale(Geometry=crv_2, Center=box.Point, Factor="0.9999")  # -> Geometry, Transform
pcen = PolygonCenter(Polyline=flatten(subsrf))  # -> CenterV, CenterE, CenterA
trim = TrimWithRegion(Curve=scale.Geometry, Region=subsrf, Plane=xy)  # -> Inside, Outside
pshift = ShiftPaths(Data=trim.Inside, Offset=-1)
jitter = Jitter(List=pcen.CenterV, Jitter=1, Seed=2)  # -> Values, Indices
vec2pt = Vector2Pt(PointA=pcen.CenterV, PointB=jitter.Values, Unitize=False)  # -> Vector, Length
group = Group(Objects=pshift)  # -> flatten(Group)
move = Move(Geometry=group, Motion=vec2pt.Vector)  # -> Geometry, Transform
ungroup = Ungroup(Group=flatten(move.Geometry))  # -> flatten(Objects)
O = ClusterOutput(ungroup)

# ==== cluster SliceAndSlide
num = ClusterInput()
crv = ClusterInput()
Z = UnitZ(Factor=1)
num_2 = Number(num)
Y = UnitY(Factor=1)
crv_2 = Curve(flatten(crv))
vrot = Rotate(Vector=Y, Axis=Z, Angle=num_2)
bbox = BoundingBox(Content=flatten(crv_2), Plane=PlaneXY(0, 0, 0), UnionBox=True)  # -> Box, Box_2
D = ClusterInput()
project = Project(Geometry=bbox.Box, Plane=PlaneXY(0, 0, 0))  # -> Geometry, Transform
xprod = CrossProduct(VectorA=vrot, VectorB=Z, Unitize=False)  # -> Vector, Length
bbox_2 = BoundingBox(Content=project.Geometry, Plane=PlaneXY(0, 0, 0), UnionBox=True)  # -> Box, Box_2
srf = Srf(bbox_2.Box)
contour = Contour(Shape=srf, Point=Point(0, 0, 0), Direction=vrot, Distance=D)
srfsplit = SurfaceSplit(Surface=srf, Curves=flatten(contour))  # -> graft(Fragments)
lng = ListLength(List=flatten(srfsplit))
R = ClusterInput()
project_2 = Project(Curve=crv_2, Brep=srfsplit, Direction=Vector(0, 0, 1))
random = Random(Range=R, Number=lng, Seed=2)
pshift = ShiftPaths(Data=project_2, Offset=-1)
amp = Amplitude(Vector=xprod.Vector, Amplitude=random)
move = Move(Geometry=pshift, Motion=graft(amp))  # -> flatten(Geometry), Transform
G = ClusterOutput(move.Geometry)
