# Grasshopper definition Experimentation3.gh (Grasshopper 0.9.76)
# plug-ins: Human

number_slider = Slider(1.1, range=0..10)
number_slider_2 = Slider(21, range=0..100)
number_slider_3 = Slider(36, range=0..110)
box = CenterBox(Base=PlaneXY(0, 0, 0), X=number_slider, Y=number_slider, Z=number_slider)
cir = Circle(Plane=PlaneXY(0, 0, 0), Radius=Slider(4.7, range=-0.01..10))
number_slider_4 = Slider(12, range=2..20)
crv = Curve(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)
number_slider_5 = Slider(0.328, range=0..1)
range = Range(Domain=Domain(0, 1), Steps=expr("x-1", number_slider_4))
mesh = Mesh(cir)
series = Series(Start=0, Step=Slider(0.7, range=0.5..30), Count=number_slider_4)
pop3d = Populate3D(Region=box, Count=number_slider_3, Seed=number_slider_3)
graph = GraphMapper(range, x0=0, x1=1, y0=0, y1=1, container_name="Gaussian", factor=0.4866669178, mean=0.681448698, sdev=0.2040573657)
graph_2 = GraphMapper(
    range,
    x0=0,
    x1=1,
    y0=0,
    y1=1,
    container_name="Sine",
    Equation_px=[0, 0.3643922806],
    Equation_py=[0.1497395635, 0.8502144217])
X = UnitX(Factor=1)
Y = UnitY(Factor=series)
vec = VectorXYZ(XComponent=series, YComponent=series, ZComponent=0)  # -> Vector, Length
box_2 = CenterBox(Base=pop3d, X=number_slider_5, Y=number_slider_5, Z=number_slider_5)
move = Move(Geometry=crv, Motion=vec.Vector)  # -> Geometry, Transform
sdiff = SolidDifference(BrepsA=box, BrepsB=box_2)
number_slider_6 = Slider(3, range=0..5)
contour = Contour(Shape=mesh, Point=Point(0, 0, 0), Direction=X, Distance=Slider(0.13, range=-0.01..10))
number_slider_7 = Slider(0.13, range=-0.01..10)
number_slider_8 = Slider(0.85, range=0..5)
curvepoint = PointOnCurve(move.Geometry, parameter=0.5)
remap = RemapNumbers(Value=graph, Source=Domain(0, 1), Target=Slider(3, range=0.25..3))  # -> Mapped, Clipped
number_slider_9 = Slider(0.75, range=0..1)
panel = Panel(remap.Mapped)
scale_nu = ScaleNU(Geometry=move.Geometry, Plane=curvepoint, ScaleX=graph_2, ScaleY=1, ScaleZ=panel)  # -> Geometry, Transform
slice_and_slide = SliceAndSlide(crv=cir, num=number_slider_9, D=number_slider_8, R=number_slider_6)
slice_and_slide_2 = SliceAndSlide(crv=contour, num=number_slider_9, D=number_slider_8, R=number_slider_6)
pt = ConstructPoint(XCoordinate=Slider(2, range=1..15), YCoordinate=Slider(2, range=1..15), ZCoordinate=Slider(5, range=1..15))
shear = Shear(Geometry=sdiff, Base=PlaneXY(0, 0, 0), Grip=Point(0, 0, 1), Target=pt)  # -> Geometry, Transform
Z = UnitZ(Factor=Slider(10, range=-0.01..10))
previewlw = CustomPreviewLineweights(
    Geometry=slice_and_slide_2,
    Shader=ColourSwatch(SwatchColor=RGB(255, 0, 0)),
    Thickness=Slider(3.5, range=-0.01..10),
    Absolute=False)
pdecon = Deconstruct(Point=curvepoint)  # -> XComponent, YComponent, ZComponent
move_2 = Move(Geometry=shear.Geometry, Motion=Z)  # -> Geometry, Transform
preview = CustomPreview(Geometry=move_2.Geometry, Shader=ColourSwatch(SwatchColor=RGB(255, 238, 0)))
pt_2 = ConstructPoint(XCoordinate=pdecon.XComponent, YCoordinate=pdecon.YComponent, ZCoordinate=0)
contour_2 = Contour(Shape=move_2.Geometry, Point=Point(0, 0, 0), Direction=Vector(0, 0, 1), Distance=Slider(0.25, range=-0.01..10))
pline = PolyLine(Vertices=pt_2, Closed=False)
previewlw_2 = CustomPreviewLineweights(
    Geometry=slice_and_slide,
    Shader=ColourSwatch(SwatchColor=RGB(255, 255, 255)),
    Thickness=Slider(5, range=-0.01..10),
    Absolute=False)
rotax = RotateAxis(Geometry=scale_nu.Geometry, Angle=Slider(-0.13, range=-1..1), Axis=pline)  # -> Geometry, Transform
previewlw_3 = CustomPreviewLineweights(Geometry=contour_2, Shader=ColourSwatch(SwatchColor=RGB(255, 0, 0)), Thickness=Slider(3, range=0..10), Absolute=False)
range_2 = Range(Domain=Domain(0, 1), Steps=Slider(62, range=0..100))
loft = Loft(Curves=rotax.Geometry, Options={Adjust=False, Closed=False, LoftEnds=0, LoftSimp=0, LoftType=0, Rebuild=10, Refit=0.01})
loft_2 = Loft(Curves=rotax.Geometry, Options={Adjust=False, Closed=False, LoftEnds=0, LoftSimp=0, LoftType=0, Rebuild=10, Refit=0.01})
pt_3 = ConstructPoint(XCoordinate=range_2, YCoordinate=range_2, ZCoordinate=0)
iso = IsoCurve(Surface=reparameterize(loft), UVPoint=pt_3)  # -> UIsocurve, VIsocurve
sdivide = DivideSurface(Surface=loft_2, UCount=Slider(17, range=0..100), VCount=Slider(54, range=0..100))  # -> Points, Normals, Parameters
crv_2 = Curve(iso.VIsocurve)
grid_slicer = GridSlicer(U=10, V=10)
iso_2 = IsoCurve(Surface=loft_2, UVPoint=sdivide.Parameters)  # -> UIsocurve, VIsocurve
swatch = Black(SwatchColor=RGBA(173, 173, 173, 160))
contour_3 = Contour(Shape=loft_2, Point=Point(0, 0, 0), Direction=Vector(0, 0, 1), Distance=Slider(0.034, range=-0.01..1))
previewlw_4 = CustomPreviewLineweights(Geometry=crv_2, Shader=swatch, Thickness=Slider(1, range=0..10), Absolute=False)
crv_3 = Curve(iso_2.UIsocurve)
crv_4 = Curve(iso_2.VIsocurve)
divlength = DivideLength(Curve=reparameterize(crv_2), Length=Slider(0.19, range=0..1))  # -> Points, Tangents, Parameters
number_slider_10 = Slider(3.745, range=0..1000)
Z_2 = UnitZ(Factor=1)
Z_3 = UnitZ(Factor=Slider(8.07, range=-0.01..10))
number_slider_11 = Slider(0.2, range=0..1)
vrot = Rotate(Vector=divlength.Tangents, Axis=Z_2, Angle="pi/2")
move_3 = Move(Geometry=contour_3, Motion=Z_3)  # -> Geometry, Transform
dash = DashPattern(Curve=move_3.Geometry, Pattern=Slider(0.05, range=-0.01..10))  # -> Dashes, Gaps
line = LineSDL(Start=divlength.Points, Direction=vrot, Length=number_slider_10)
neg = Negative(Value=number_slider_10)
gradient = Gradient(LowerLimit=0, UpperLimit=1, Parameter=divlength.Parameters, stops=[0: RGBA(255, 255, 255, 87), 1: RGBA(0, 0, 0, 91)])
number_slider_12 = Slider(1.361, range=0..100)
division = Division(A=neg, B="2")
amp = Amplitude(Vector=vrot, Amplitude=division)
project = Project(Geometry=dash.Dashes, Plane=PlaneXY(0, 0, 0))  # -> Geometry, Transform
divlength_2 = DivideLength(Curve=rotax.Geometry, Length=number_slider_11)  # -> Points, Tangents, Parameters
divlength_3 = DivideLength(Curve=rotax.Geometry, Length=number_slider_11)  # -> Points, Tangents, Parameters
previewlw_5 = CustomPreviewLineweights(
    Geometry=project.Geometry,
    Shader=ColourSwatch(SwatchColor=RGB(0, 13, 255)),
    Thickness=Slider(3, range=1..10),
    Absolute=False)
neg_2 = Negative(Value=number_slider_12)
move_4 = Move(Geometry=line, Motion=amp)  # -> Geometry, Transform
line_2 = LineSDL(Start=divlength_2.Points, Direction=divlength_2.Tangents, Length=number_slider_12)
line_3 = LineSDL(Start=divlength_3.Points, Direction=divlength_3.Tangents, Length=neg_2)
swatch_2 = Grey(SwatchColor=RGB(255, 226, 5))
Z_4 = UnitZ(Factor="-250")
move_5 = Move(Geometry=move_4.Geometry, Motion=Z_4)  # -> Geometry, Transform
previewlw_6 = CustomPreviewLineweights(Geometry=[line_2, line_3], Shader=swatch_2, Thickness=Slider(1, range=0..1), Absolute=False)
previewlw_7 = CustomPreviewLineweights(Geometry=move_5.Geometry, Shader=gradient, Thickness=Slider(2, range=1..5), Absolute=False)

# ==== cluster GridSlicer
crv = ClusterInput()
U = ClusterInput()
V = ClusterInput()
crv_2 = Curve(flatten(crv))
bbox = BoundingBox(Content=crv_2, Plane=PlaneXY(0, 0, 0), UnionBox=True)  # -> Box, Box_2
srf = Srf(bbox.Box)
divide = DivideDomain²(Domain=srf, UCount=U, VCount=V)
box = EvaluateBox(Box=bbox.Box, UParameter=0.5, VParameter=0.5, WParameter=0.5)  # -> Plane, Point, Include
xy = XYPlane(Origin=Point(0, 0, 0))
subsrf = Isotrim(Surface=srf, Domain=divide)  # -> graft(Surface)
scale = Scale(Geometry=crv_2, Center=box.Point, Factor="0.9999")  # -> Geometry, Transform
pcen = PolygonCenter(Polyline=flatten(subsrf))  # -> CenterV, CenterE, CenterA
trim = TrimWithRegion(Curve=scale.Geometry, Region=subsrf, Plane=xy)  # -> Inside, Outside
pshift = ShiftPaths(Data=trim.Inside, Offset=-1)
jitter = Jitter(List=pcen.CenterV, Jitter=1, Seed=2)  # -> Values, Indices
vec2pt = Vector2Pt(PointA=pcen.CenterV, PointB=jitter.Values, Unitize=False)  # -> Vector, Length
group = Group(Objects=pshift)  # -> flatten(Group)
move = Move(Geometry=group, Motion=vec2pt.Vector)  # -> Geometry, Transform
ungroup = Ungroup(Group=flatten(move.Geometry))  # -> flatten(Objects)
O = ClusterOutput(ungroup)

# ==== cluster SliceAndSlide
num = ClusterInput()
crv = ClusterInput()
Z = UnitZ(Factor=1)
num_2 = Number(num)
Y = UnitY(Factor=1)
crv_2 = Curve(flatten(crv))
vrot = Rotate(Vector=Y, Axis=Z, Angle=num_2)
bbox = BoundingBox(Content=flatten(crv_2), Plane=PlaneXY(0, 0, 0), UnionBox=True)  # -> Box, Box_2
D = ClusterInput()
project = Project(Geometry=bbox.Box, Plane=PlaneXY(0, 0, 0))  # -> Geometry, Transform
xprod = CrossProduct(VectorA=vrot, VectorB=Z, Unitize=False)  # -> Vector, Length
bbox_2 = BoundingBox(Content=project.Geometry, Plane=PlaneXY(0, 0, 0), UnionBox=True)  # -> Box, Box_2
srf = Srf(bbox_2.Box)
contour = Contour(Shape=srf, Point=Point(0, 0, 0), Direction=vrot, Distance=D)
srfsplit = SurfaceSplit(Surface=srf, Curves=flatten(contour))  # -> graft(Fragments)
lng = ListLength(List=flatten(srfsplit))
R = ClusterInput()
project_2 = Project(Curve=crv_2, Brep=srfsplit, Direction=Vector(0, 0, 1))
random = Random(Range=R, Number=lng, Seed=2)
pshift = ShiftPaths(Data=project_2, Offset=-1)
amp = Amplitude(Vector=xprod.Vector, Amplitude=random)
move = Move(Geometry=pshift, Motion=graft(amp))  # -> flatten(Geometry), Transform
G = ClusterOutput(move.Geometry)
