# Grasshopper definition Final.gh (Grasshopper 1.0.7)
# plug-ins: Bifocals, LunchBox, Human

curve = Curve([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])
range = Range(Domain=Domain(0, 1), Steps=Slider(83, range=0..100))
construct_point = ConstructPoint(XCoordinate=range, YCoordinate=range, ZCoordinate=0)
loft = Loft(Curves=curve, Options={Adjust=False, Closed=False, LoftEnds=0, LoftSimp=0, LoftType=0, Rebuild=10, Refit=0.01})
loft_2 = Loft(Curves=curve, Options={Adjust=False, Closed=False, LoftEnds=0, LoftSimp=0, LoftType=0, Rebuild=10, Refit=0.01})
number_slider = Slider(100, range=0..100)
contour = Contour(Shape=loft, Point=Point(0, 0, 0), Direction=Vector(0, 0, 1), Distance=Slider(0.72, range=0..1))
iso_curve = IsoCurve(Surface=reparameterize(loft), UVPoint=construct_point)  # -> UIsocurve, VIsocurve
iso_curve_2 = IsoCurve(Surface=reparameterize(loft_2), UVPoint=construct_point)  # -> UIsocurve, VIsocurve
divide_length = DivideLength(Curve=reparameterize(iso_curve_2.VIsocurve), Length=Slider(0.9, range=0..1))  # -> Points, Tangents, Parameters
divide_length_2 = DivideLength(Curve=curve, Length=Slider(0.9, range=0..1))  # -> Points, Tangents, Parameters
hexagon_cells = HexagonCells(Surface=loft, UDivisions=number_slider, VDivisions=number_slider, TParameter=0.25)  # -> HexagonCells, Centers
curve_2 = Curve(iso_curve.UIsocurve)
curve_3 = Curve(iso_curve.VIsocurve)
dash_pattern = DashPattern(Curve=[curve_2, curve_3], Pattern=Slider(0.45, range=0..1))  # -> Dashes, Gaps
line_sdl = LineSDL(Start=divide_length_2.Points, Direction=divide_length_2.Tangents, Length=Slider(42, range=0..100))
construct_domain = ConstructDomain(DomainStart=Slider(-39.98, range=-50..50), DomainEnd=Slider(26.16, range=-50..50))
unit_z = UnitZ(Factor=1)
number_slider_2 = Slider(0, range=0..100)
random = Random(Range=construct_domain, Number=Slider(709, range=0..1000), Seed=Slider(91, range=0..100))
number_slider_3 = Slider(45, range=0..100)
random_2 = Random(Range=Domain(0, 1), Number=Slider(313, range=0..3100), Seed=Slider(49, range=0..100))
random_3 = Random(Range=Domain(0, 1), Number=Slider(67, range=0..100), Seed=Slider(49, range=0..100))
rotate = Rotate(Vector=divide_length_2.Tangents, Axis=unit_z, Angle="pi/2")
extend_curve = ExtendCurve(Curve=line_sdl, Type=0, Start=Slider(0, range=0..100), End=random)
gradient = Gradient(
    LowerLimit=0,
    UpperLimit=1,
    Parameter=random_2,
    stops=[0: RGB(0, 98, 0), 0.25: RGB(81, 175, 17), 0.5: RGB(159, 198, 146), 0.75: RGB(170, 235, 41), 1: RGB(221, 255, 53)])
negative = Negative(Value=number_slider_3)
gradient_2 = Gradient(
    LowerLimit=0,
    UpperLimit=1,
    Parameter=random_3,
    stops=[0: RGB(0, 98, 0), 0.25: RGB(81, 175, 17), 0.5: RGB(159, 198, 146), 0.75: RGB(170, 235, 41), 1: RGB(221, 255, 53)])
line_sdl_2 = LineSDL(Start=divide_length_2.Points, Direction=rotate, Length=number_slider_3)
division = Division(A=negative, B="2")
amplitude = Amplitude(Vector=rotate, Amplitude=division)
dash_pattern_2 = DashPattern(Curve=contour, Pattern=Slider(0.5, range=0..1))  # -> Dashes, Gaps
move = Move(Geometry=line_sdl_2, Motion=amplitude)  # -> Geometry, Transform
number_slider_4 = Slider(4, range=0..10)
construct_domain_2 = ConstructDomain(DomainStart=Slider(-21.54, range=-50..50), DomainEnd=Slider(9.94, range=-50..50))
random_4 = Random(Range=construct_domain_2, Number=Slider(709, range=0..1000), Seed=Slider(91, range=0..100))
extend_curve_2 = ExtendCurve(Curve=move.Geometry, Type=0, Start=Slider(0, range=0..100), End=random_4)
custom_preview = CustomPreview(Geometry=line_sdl, Material=ColourSwatch(SwatchColor=RGB(176, 176, 176)))
custom_preview_lineweights = CustomPreviewLineweights(
    Geometry=hexagon_cells.HexagonCells,
    Shader=ColourSwatch(SwatchColor=RGB(194, 194, 194)),
    Thickness=Slider(2, range=0..10),
    Absolute=False)
custom_preview_lineweights_2 = CustomPreviewLineweights(Geometry=dash_pattern_2.Dashes, Shader=gradient_2, Thickness=Slider(4, range=0..10), Absolute=False)
custom_preview_lineweights_3 = CustomPreviewLineweights(
    Geometry=dash_pattern.Dashes,
    Shader=ColourSwatch(SwatchColor=RGB(117, 117, 117)),
    Thickness=Slider(3, range=0..10),
    Absolute=False)
custom_preview_lineweights_4 = CustomPreviewLineweights(Geometry=extend_curve_2, Shader=gradient, Thickness=Slider(3, range=0..10), Absolute=False)
custom_preview_lineweights_5 = CustomPreviewLineweights(Geometry=curve, Shader=ColourSwatch(SwatchColor=RGB(0, 0, 0)), Thickness=Slider(9, range=0..10), Absolute=False)
line_dimension = LineDimension(Line=extend_curve, Text="{0:0.00}", Size=1)
