# Grasshopper definition Operations.gh (Grasshopper 0.9.76)

# Curve Operations
grid_slicer = GridSlicer(U=10, V=10)
slice_and_slide = SliceAndSlide(num=0.7853981634, R=Domain(0, 1))
wiggle = Wiggle()

# ==== cluster GridSlicer
crv = ClusterInput()
U = ClusterInput()
V = ClusterInput()
crv_2 = Curve(flatten(crv))
bbox = BoundingBox(Content=crv_2, Plane=PlaneXY(0, 0, 0), UnionBox=True)  # -> Box, Box_2
srf = Srf(bbox.Box)
divide = DivideDomain²(Domain=srf, UCount=U, VCount=V)
box = EvaluateBox(Box=bbox.Box, UParameter=0.5, VParameter=0.5, WParameter=0.5)  # -> Plane, Point, Include
xy = XYPlane(Origin=Point(0, 0, 0))
subsrf = Isotrim(Surface=srf, Domain=divide)  # -> graft(Surface)
scale = Scale(Geometry=crv_2, Center=box.Point, Factor="0.9999")  # -> Geometry, Transform
pcen = PolygonCenter(Polyline=flatten(subsrf))  # -> CenterV, CenterE, CenterA
trim = TrimWithRegion(Curve=scale.Geometry, Region=subsrf, Plane=xy)  # -> Inside, Outside
pshift = ShiftPaths(Data=trim.Inside, Offset=-1)
jitter = Jitter(List=pcen.CenterV, Jitter=1, Seed=2)  # -> Values, Indices
vec2pt = Vector2Pt(PointA=pcen.CenterV, PointB=jitter.Values, Unitize=False)  # -> Vector, Length
group = Group(Objects=pshift)  # -> flatten(Group)
move = Move(Geometry=group, Motion=vec2pt.Vector)  # -> Geometry, Transform
ungroup = Ungroup(Group=flatten(move.Geometry))  # -> flatten(Objects)
O = ClusterOutput(ungroup)

# ==== cluster SliceAndSlide
num = ClusterInput()
crv = ClusterInput()
Z = UnitZ(Factor=1)
num_2 = Number(num)
Y = UnitY(Factor=1)
crv_2 = Curve(flatten(crv))
vrot = Rotate(Vector=Y, Axis=Z, Angle=num_2)
bbox = BoundingBox(Content=flatten(crv_2), Plane=PlaneXY(0, 0, 0), UnionBox=True)  # -> Box, Box_2
D = ClusterInput()
project = Project(Geometry=bbox.Box, Plane=PlaneXY(0, 0, 0))  # -> Geometry, Transform
xprod = CrossProduct(VectorA=vrot, VectorB=Z, Unitize=False)  # -> Vector, Length
bbox_2 = BoundingBox(Content=project.Geometry, Plane=PlaneXY(0, 0, 0), UnionBox=True)  # -> Box, Box_2
srf = Srf(bbox_2.Box)
contour = Contour(Shape=srf, Point=Point(0, 0, 0), Direction=vrot, Distance=D)
srfsplit = SurfaceSplit(Surface=srf, Curves=flatten(contour))  # -> graft(Fragments)
lng = ListLength(List=flatten(srfsplit))
R = ClusterInput()
project_2 = Project(Curve=crv_2, Brep=srfsplit, Direction=Vector(0, 0, 1))
random = Random(Range=R, Number=lng, Seed=2)
pshift = ShiftPaths(Data=project_2, Offset=-1)
amp = Amplitude(Vector=xprod.Vector, Amplitude=random)
move = Move(Geometry=pshift, Motion=graft(amp))  # -> flatten(Geometry), Transform
G = ClusterOutput(move.Geometry)

# ==== cluster Wiggle
crv = ClusterInput()
crv_2 = Curve(flatten(crv))
wiggle_density = ClusterInput()
wiggle_amplitude = ClusterInput()
len = Length(Curve=crv_2)
lng = ListLength(List=crv_2)
wiggle_density_2 = Number(wiggle_density)
wiggle_amplitude_2 = Number(wiggle_amplitude)
division = Division(A=len, B=wiggle_density_2)
random = Random(Range="343", Number=lng, Seed=2)
popgeo = PopulateGeometry(Geometry=crv_2, Count=division, Seed=random)
crv_cp = CurveClosestPoint(Point=popgeo, Curve=graft(crv_2))  # -> Point, Parameter, Distance
Z = UnitZ(Factor=1)
sort = SortList(Keys=crv_cp.Parameter)  # -> Keys, ValuesA
domcen = CenteredDomain(num=wiggle_amplitude_2)
eval = EvaluateCurve(Curve=graft(crv_2), Parameter=sort.Keys)  # -> Point, Tangent, Angle
xprod = CrossProduct(VectorA=eval.Tangent, VectorB=Z, Unitize=invert(False))  # -> Vector, Length
lng_2 = ListLength(List=flatten(xprod.Vector))
random_2 = Random(Range=domcen, Number=lng_2, Seed="343")
unflatten = UnflattenTree(Tree=random_2, Guide=xprod.Vector)
multiplication = Multiplication(A=xprod.Vector, B=unflatten)
move = Move(Geometry=eval.Point, Motion=multiplication)  # -> Geometry, Transform
nurbs = NurbsCurve(Vertices=move.Geometry, Degree=3, Periodic=False)  # -> Curve, Length, Domain
crv_3 = Curve(flatten(nurbs.Curve))
crv_4 = ClusterOutput(crv_3)

# ==== cluster CenteredDomain: Creates a symmetrical domain about 0 with a length of X
num = ClusterInput()
num_2 = Number(num)
division = Division(A=num_2, B="2")
division_2 = Division(A=num_2, B="-2")
dom = Domain(DomainStart=division_2, DomainEnd=division)
I = ClusterOutput(dom)
