# Grasshopper definition Randomness and Color.gh (Grasshopper 0.9.76)

number_slider = Slider(486, range=0..1000)
random = Random(Range=Slider(65.2, range=0..100), Number=number_slider, Seed=Slider(10, range=0..10))
random_2 = Random(Range=Slider(80.7, range=0..100), Number=number_slider, Seed=Slider(5, range=0..10))
random_3 = Random(Range=Slider(65.2, range=0..100), Number=number_slider, Seed=Slider(6, range=0..10))
random_4 = Random(Range=Domain(0, 1), Number=number_slider, Seed=Slider(7, range=0..10))
random_5 = Random(Range=Slider(41.2, range=0..100), Number=number_slider, Seed=Slider(2, range=0..10))
pt = ConstructPoint(XCoordinate=random, YCoordinate=random_3, ZCoordinate=0)
number_slider_2 = Slider(26.95, range=0..100)
gradient = Gradient(
    LowerLimit=0,
    UpperLimit=1,
    Parameter=random_4,
    stops=[0: RGB(243, 57, 0), 0.161: RGB(236, 27, 60), 0.338: RGB(210, 0, 118), 0.715: RGB(220, 237, 32), 1: RGB(247, 159, 20)])
rectangle = Rectangle(Plane=pt, XSize=Slider(3.44, range=0..100), YSize=random_5, Radius=0)  # -> Rectangle, Length
panel = Panel(gradient)
mesh = Mesh(rectangle.Rectangle)
pcen = PolygonCenter(Polyline=rectangle.Rectangle)  # -> CenterV, CenterE, CenterA
panel_2 = Panel(random)
rotate = Rotate(Geometry=mesh, Angle=random_2, Plane=pcen.CenterV)  # -> Geometry, Transform
swatch = ColourSwatch(SwatchColor=RGBA(37, 90, 110, 50))
preview = CustomPreview(Geometry=rotate.Geometry, Shader=gradient)
