# Grasshopper definition Review - lines, color, graph mapper, lineweight.gh (Grasshopper 0.9.76)
# plug-ins: Human

X = UnitX(Factor=1)
pt = Point(Point(0, 0, 0))
line = LineSDL(Start=pt, Direction=X, Length=Slider(40, range=0..100))
range = Range(Domain=Domain(0, 1), Steps=Slider(200, range=0..1000))
graph = GraphMapper(range, x0=0, x1=1, y0=0, y1=1, container_name="Bezier", cpx=[0, 0.25, 0.9202898741, 1], cpy=[0, 0.25, 0, 1])
eval = EvaluateCurve(Curve=line, Parameter=graph)  # -> Point, Tangent, Angle
Y = UnitY(Factor=1)
line_2 = LineSDL(Start=eval.Point, Direction=Y, Length=Slider(40, range=0..100))
pt_2 = Point(<point referenced from the Rhino model>)
crv_cp = CurveClosestPoint(Point=pt_2, Curve=line_2)  # -> Point, Parameter, Distance
dom = ConstructDomain(DomainStart=Slider(1, range=0..10), DomainEnd=Slider(7, range=0..10))
bnd = Bounds(Numbers=crv_cp.Distance)
remap = RemapNumbers(Value=crv_cp.Distance, Source=bnd, Target=dom)  # -> Mapped, Clipped
remap_2 = RemapNumbers(Value=crv_cp.Distance, Source=bnd, Target=Domain(0, 1))  # -> Mapped, Clipped
gradient = Gradient(
    LowerLimit=0,
    UpperLimit=1,
    Parameter=remap_2.Mapped,
    stops=[0: RGB(135, 148, 98), 0.263: RGB(224, 206, 144), 0.473: RGB(255, 168, 87), 0.735: RGB(242, 88, 33), 1: RGB(224, 79, 79)])
jitter = Jitter(List=remap.Mapped, Jitter=Slider(0.162, range=0..1), Seed=2)  # -> Values, Indices
previewlw = CustomPreviewLineweights(Geometry=line_2, Shader=gradient, Thickness=jitter.Values, Absolute=False)
