# Grasshopper definition Sol Lewitt 2.gh (Grasshopper 0.9.76)

number_slider = Slider(22, range=0..100)
number_slider_2 = Slider(13, range=0..100)
neg = Negative(Value=number_slider)
neg_2 = Negative(Value=number_slider_2)
number_slider_3 = Slider(1, range=0..1)
dom = ConstructDomain(DomainStart=neg, DomainEnd=number_slider)
dom_2 = ConstructDomain(DomainStart=neg_2, DomainEnd=number_slider_2)
xz = XZPlane(Origin=Point(0, 0, 0))
rectangle = Rectangle(Plane=PlaneXY(0, 0, 0), XSize=dom_2, YSize=dom, Radius=0)  # -> Rectangle, Length
pt = ConstructPoint(XCoordinate=0, YCoordinate=number_slider_3, ZCoordinate=0)
pt_2 = ConstructPoint(XCoordinate=Slider(0.382, range=0..1), YCoordinate=number_slider_3, ZCoordinate=0)
shear = Shear(Geometry=rectangle.Rectangle, Base=xz, Grip=pt, Target=pt_2)  # -> Geometry, Transform
cir = Circle(Plane=PlaneXY(0, 0, 0), Radius=Slider(50, range=0..100))
X = UnitX(Factor=1)
mesh = Mesh(cir)
Y = UnitY(Factor=1)
mesh_2 = Mesh(shear.Geometry)
contour = Contour(Shape=mesh, Point=Point(0, 0, 0), Direction=X, Distance=Slider(1, range=0..1))
Z = UnitZ(Factor=1)
contour_2 = Contour(Shape=mesh_2, Point=Point(0, 0, 0), Direction=Y, Distance=Slider(1, range=0..1))
move = Move(Geometry=mesh_2, Motion=Z)  # -> Geometry, Transform
move_2 = Move(Geometry=contour_2, Motion=Z)  # -> Geometry, Transform
preview = CustomPreview(Geometry=move.Geometry, Shader=ColourSwatch(SwatchColor=RGB(255, 255, 255)))
