# Grasshopper definition Variable-width lines.gh (Grasshopper 0.9.76)
# plug-ins: Human

dpipeline = DynamicGeometryPipeline(
    LayerFilter="Default",
    TypeFilter="Curve",
    NameFilter="*",
    enableFullPath=False,
    GroupByLayer=False,
    GroupByType=False,
    IncludeHidden=True,
    IncludeLocked=True)
crv = Curve(reparameterize(dpipeline))
divide = DivideCurve(Curve=crv, Count=Slider(100, range=0..100), Kinks=False)  # -> Points, Tangents, Parameters
Z = UnitZ(Factor=1)
graph = GraphMapper(
    divide.Parameters,
    x0=0,
    x1=1,
    y0=0,
    y1=1,
    container_name="Sine",
    Equation_px=[0, 0.5211592913],
    Equation_py=[0, 0.94058007])
vrot = Rotate(Vector=divide.Tangents, Axis=Z, Angle="pi/2")
amp = Amplitude(Vector=vrot, Amplitude=graph)
neg = Negative(Value=amp)
move = Move(Geometry=divide.Points, Motion=amp)  # -> Geometry, Transform
move_2 = Move(Geometry=divide.Points, Motion=neg)  # -> Geometry, Transform
intcrv = Interpolate(Vertices=move.Geometry, Degree=3, Periodic=False, KnotStyle=1)  # -> Curve, Length, Domain
intcrv_2 = Interpolate(Vertices=move_2.Geometry, Degree=3, Periodic=False, KnotStyle=1)  # -> Curve, Length, Domain
merge = Merge(Data1=intcrv.Curve, Data2=intcrv_2.Curve)
loft = Loft(Curves=merge, Options={Adjust=False, Closed=False, LoftEnds=0, LoftSimp=0, LoftType=0, Rebuild=10, Refit=0.01})
swatch = Black(SwatchColor=RGB(0, 0, 0))
preview = CustomPreview(Geometry=loft, Shader=swatch)
