# Grasshopper definition Young-Ayata_imitation.gh (Grasshopper 0.9.76)
# plug-ins: Human

crv = Curve([<curve referenced from the Rhino model> x3])
crv_2 = Curve([<curve referenced from the Rhino model> x7])

# ---- group: Interpolation
range = Range(Domain=Domain(0, 1), Steps=Slider(20, range=0..100))
loft = Loft(Curves=crv, Options={Adjust=False, Closed=False, LoftEnds=0, LoftSimp=0, LoftType=0, Rebuild=10, Refit=0.01})
swatch = Black(SwatchColor=RGB(0, 0, 0))
pt = ConstructPoint(XCoordinate=range, YCoordinate=range, ZCoordinate=0)
iso = IsoCurve(Surface=reparameterize(loft), UVPoint=pt)  # -> UIsocurve, VIsocurve
previewlw = CustomPreviewLineweights(Geometry=crv, Shader=swatch, Thickness=Slider(4, range=0..10), Absolute=False)
crv_3 = Curve(iso.VIsocurve)
swatch_2 = Black(SwatchColor=RGB(173, 173, 173))
previewlw_2 = CustomPreviewLineweights(Geometry=crv_3, Shader=swatch_2, Thickness=Slider(1, range=0..10), Absolute=False)

# ---- group: Lineweights for base lines
swatch_3 = Black(SwatchColor=RGB(0, 0, 0))
previewlw_3 = CustomPreviewLineweights(Geometry=crv_2, Shader=swatch_3, Thickness=Slider(3, range=0..10), Absolute=False)

# ---- group: Tangent Lines
divlength = DivideLength(Curve=crv_2, Length=Slider(0.9, range=0..1))  # -> Points, Tangents, Parameters
line = LineSDL(Start=divlength.Points, Direction=divlength.Tangents, Length=Slider(21, range=0..100))
swatch_4 = Grey(SwatchColor=RGB(196, 196, 196))
preview = CustomPreview(Geometry=line, Shader=swatch_4)

# ----
swatch_5 = Red(SwatchColor=RGB(255, 0, 0))

# ---- group: Annotation for arcs
explode = Explode(Curve=crv_2, Recursive=True)  # -> Segments, Vertices
arc = CircularArc(explode.Segments)
darc = DeconstructArc(Arc=arc)  # -> BasePlane, Radius, Angle
cir = Circle(Plane=darc.BasePlane, Radius=darc.Radius)
dash = DashPattern(Curve=cir, Pattern=Slider(0.221, range=0..1))  # -> Dashes, Gaps
eval = EvaluateCurve(Curve=cir, Parameter=Slider(0, range=0..100))  # -> Point, Tangent, Angle
ln = Line(StartPoint=darc.BasePlane, EndPoint=eval.Point)
linedim = LineDimension(Line=ln, Text="{0:0.00}", Size=Slider(0.454, range=0..1))
preview_2 = CustomPreview(Geometry=dash.Dashes, Shader=swatch_5)

# ---- group: Take Perpendiculars and extend
divlength_2 = DivideLength(Curve=reparameterize(crv_3), Length=Slider(0.9, range=0..1))  # -> Points, Tangents, Parameters
Z = UnitZ(Factor=1)
number_slider = Slider(427, range=0..1000)
vrot = Rotate(Vector=divlength_2.Tangents, Axis=Z, Angle="pi/2")
line_2 = LineSDL(Start=divlength_2.Points, Direction=vrot, Length=number_slider)
neg = Negative(Value=number_slider)
gradient = Gradient(LowerLimit=0, UpperLimit=1, Parameter=divlength_2.Parameters, stops=[0: RGB(255, 109, 31), 1: RGB(0, 0, 0)])
division = Division(A=neg, B="2")
amp = Amplitude(Vector=vrot, Amplitude=division)
move = Move(Geometry=line_2, Motion=amp)  # -> Geometry, Transform
preview_3 = CustomPreview(Geometry=move.Geometry, Shader=gradient)
