# Grasshopper definition grid of variable width lines.gh (Grasshopper 0.9.76)

X = UnitX(Factor=1)
pt = Point(Point(0, 0, 0))
line = LineSDL(Start=pt, Direction=X, Length=Slider(40, range=0..100))
range = Range(Domain=Domain(0, 1), Steps=Slider(57, range=0..1000))
graph = GraphMapper(range, x0=0, x1=1, y0=0, y1=1, container_name="Bezier", cpx=[0, 0.25, 1, 1], cpy=[0, 0.25, 0.2898546457, 1])
eval = EvaluateCurve(Curve=line, Parameter=graph)  # -> Point, Tangent, Angle
Y = UnitY(Factor=1)
line_2 = LineSDL(Start=eval.Point, Direction=Y, Length=Slider(40, range=0..100))
divide = DivideCurve(Curve=line_2, Count=Slider(100, range=0..100), Kinks=False)  # -> Points, Tangents, Parameters
pt_2 = Point(<point referenced from the Rhino model>)
Z = UnitZ(Factor=1)
dist = Distance(PointA=pt_2, PointB=divide.Points)
vrot = Rotate(Vector=divide.Tangents, Axis=Z, Angle="pi/2")
bnd = Bounds(Numbers=dist)
dom = ConstructDomain(DomainStart=Slider(0.6, range=0..1), DomainEnd=Slider(0, range=0..1))
dom_2 = ConstructDomain(DomainStart=Slider(1, range=0..1), DomainEnd=Slider(32, range=0..100))
remap = RemapNumbers(Value=dist, Source=dom_2, Target=dom)  # -> Mapped, Clipped
amp = Amplitude(Vector=vrot, Amplitude=remap.Clipped)
neg = Negative(Value=amp)
move = Move(Geometry=divide.Points, Motion=neg)  # -> Geometry, Transform
move_2 = Move(Geometry=divide.Points, Motion=amp)  # -> Geometry, Transform
intcrv = Interpolate(Vertices=move_2.Geometry, Degree=3, Periodic=False, KnotStyle=1)  # -> Curve, Length, Domain
intcrv_2 = Interpolate(Vertices=move.Geometry, Degree=3, Periodic=False, KnotStyle=1)  # -> Curve, Length, Domain
merge = Merge(Data1=intcrv.Curve, Data2=intcrv_2.Curve)
loft = Loft(Curves=merge, Options={Adjust=False, Closed=False, LoftEnds=0, LoftSimp=0, LoftType=0, Rebuild=10, Refit=0.01})
swatch = Black(SwatchColor=RGB(0, 0, 0))
preview = CustomPreview(Geometry=loft, Shader=swatch)
