# Grasshopper definition multi offset and divide.gh (Grasshopper 0.9.76)

crv = Curve(<curve referenced from the Rhino model>)
number_slider = Slider(1.5, range=0..10)
panel = Panel(crv)
series = Series(Start=0, Step=1, Count=Slider(26, range=0..1000))
offset = Offset(Curve=crv, Distance=series, Plane=PlaneXY(0, 0, 0), Corners=1)
divide = DivideCurve(Curve=offset, Count=Slider(530, range=0..1000), Kinks=False)  # -> Points, Tangents, Parameters
cir = Circle(Plane=divide.Points, Radius=1)
