# Grasshopper definition CompStudioFinalScript.gh (Grasshopper 0.9.76)
# plug-ins: PTComponentLibrary, LunchBox

number_slider = Slider(0.25, range=0..1)
number_slider_2 = Slider(23, range=1..100)
number_slider_3 = Slider(0.25, range=0..1)
srf = Surface(<surface referenced from the Rhino model>)
srf_2 = Surface(srf)
popgeo = PopulateGeometry(Geometry=srf_2, Count=Slider(60, range=1..100), Seed=Slider(30, range=1..100))
bbox = BoundingBox(Content=srf_2, Plane=PlaneXY(0, 0, 0))  # -> Box, Box_2
voronoi³ = Voronoi3D(Points=popgeo, Box=bbox.Box)  # -> Cells, Boundary
bbx = BrepBrep(BrepA=srf_2, BrepB=voronoi³.Cells)  # -> Curves, Points
disc = Discontinuity(Curve=bbx.Curves, Level=1)  # -> Points, Parameters
pline = PolyLine(Vertices=disc.Points, Closed=Toggle(True))
avr = Average(Input=disc.Points)
number_slider_4 = Slider(15, range=1..15)
scale = Scale(Geometry=pline, Center=avr, Factor=Slider(0.95, range=0.12..0.95))  # -> Geometry, Transform
patch = PatchSurface(EdgeCurves=graft(scale.Geometry), U=number_slider_4, V=number_slider_4, Tolerance=0.001)
fillet = FilletDistance(Curve=scale.Geometry, Distance=Slider(7.5, range=0..10))
weave = Weave(Pattern=[0, 1], Stream0=pline, Stream1=fillet, NullGaps=False)
partition = PartitionList(List=weave, Size="2")
loft = Loft(Curves=partition, Options={Adjust=True, Closed=False, LoftEnds=0, LoftSimp=2, LoftType=3, Rebuild=10, Refit=0.01})

# ---- group: Cores
crv = Curve(<curve referenced from the Rhino model>)
crv_2 = Curve(<curve referenced from the Rhino model>)
Z = UnitZ(Factor=Slider(166, range=1..200))
extr = Extrude(Base=[crv_2, crv], Direction=Z)
cap = CapHoles(Brep=extr)

# ---- group: Direct Manipulation Curve
crv_3 = Curve(<curve referenced from the Rhino model>)

# ---- group: Array Curve Z Direction
number_slider_5 = Slider(12, range=2..30)
series = Series(Start=Slider(24, range=0.5..30), Step=Slider(12, range=0.5..30), Count=number_slider_5)
Z_2 = UnitZ(Factor=series)
move = Move(Geometry=crv_3, Motion=Z_2)  # -> Geometry, Transform

# ----
crv_4 = Curve([<curve referenced from the Rhino model> x2])

# ----
# GLAZING
crv_5 = Curve([<curve referenced from the Rhino model> x2])
loft_2 = Loft(Curves=crv_5, Options={Adjust=False, Closed=False, LoftEnds=0, LoftSimp=0, LoftType=0, Rebuild=10, Refit=0.01})
srf_3 = Surface(loft_2)
ptsrfdomnum = SurfaceDomainNumber(Surface=srf_3, UNumber=Slider(6, range=1..125), VNumber=Slider(16, range=1..125))
ptoffsetgrid = OffsetGrid(Grid=ptsrfdomnum, BRep=srf_3, Dis=".12")
pt3dcell = Cellulate3DGrid(Grid1=ptsrfdomnum, Grid2=ptoffsetgrid)  # -> Wires, Cells, Boxes

crv_6 = Curve([<curve referenced from the Rhino model> x2])

# ---- group: SHARED WORK SPACE
range = Range(Domain=Domain(0, 1), Steps=expr("x-1", number_slider_5))
neg = Negative(Value=range)
graph = GraphMapper(
    neg,
    x0=0,
    x1=1,
    y0=0,
    y1=1,
    A=0.2458840609,
    B=0.6384923458,
    container_name="Linear",
    Graph_x0=0,
    Graph_x1=1,
    Graph_y0=0.6384923458,
    Graph_y1=0.8843764067)
graph_2 = GraphMapper(
    range,
    x0=0,
    x1=1,
    y0=0,
    y1=1,
    A=-0.001647609425,
    B=0.08308376665,
    container_name="Linear",
    Graph_x0=0.004424349871,
    Graph_x1=1,
    Graph_y0=0.08307647705,
    Graph_y1=0.08143615723)
number_slider_6 = Slider(1.51, range=0.25..3)
neg_2 = Negative(Value=graph)
remap = RemapNumbers(Value=graph, Source=Domain(0, 1), Target=number_slider_6)  # -> Mapped, Clipped
curvepoint = PointOnCurve(move.Geometry, parameter=0.5)
remap_2 = RemapNumbers(Value=graph_2, Source=Domain(0, 1), Target=number_slider_6)  # -> Mapped, Clipped
scale_nu = ScaleNU(Geometry=move.Geometry, Plane=curvepoint, ScaleX=remap.Mapped, ScaleY=remap_2.Mapped, ScaleZ=1)  # -> Geometry, Transform
cull_i = CullIndex(List=scale_nu.Geometry, Indices=["11", "0"], Wrap=True)
loft_3 = Loft(Curves=cull_i, Options={Adjust=False, Closed=False, LoftEnds=0, LoftSimp=0, LoftType=0, Rebuild=10, Refit=0.01})

# ----
loft_4 = Loft(Curves=crv_4, Options={Adjust=False, Closed=False, LoftEnds=0, LoftSimp=0, LoftType=0, Rebuild=10, Refit=0.01})
loft_5 = Loft(Curves=crv_6, Options={Adjust=False, Closed=False, LoftEnds=0, LoftSimp=0, LoftType=0, Rebuild=10, Refit=0.01})
area = Area(Geometry=crv_3)  # -> Area, Centroid
boundary = BoundarySurfaces(Edges=crv_3)  # -> reparameterize(Surfaces)
srf_4 = Surface(loft_4)
srf_5 = Surface(loft_5)
md_slider = MDSlider(
    slider_value=Point(0.7899999619, 0.4840011597, 0.5),
    SliderMode=0,
    x_domain=Domain(0, 1),
    y_domain=Domain(0, 1),
    z_domain=Domain(0, 1))
# GLAZING
ptsrfdomnum_2 = SurfaceDomainNumber(Surface=srf_4, UNumber=Slider(6, range=1..125), VNumber=Slider(4, range=1..125))
# GLAZING
ptsrfdomnum_3 = SurfaceDomainNumber(Surface=srf_5, UNumber=Slider(6, range=1..125), VNumber=Slider(3, range=1..125))
evalsrf = EvaluateSurface(Surface=boundary, Point=md_slider)  # -> Point, Normal, Frame
scale_nu_2 = ScaleNU(
    Geometry=crv_3,
    Plane=area.Centroid,
    ScaleX=Slider(0.832, range=0.125..1),
    ScaleY=Slider(0.775, range=0.125..1),
    ScaleZ=1)  # -> Geometry, Transform
ptoffsetgrid_2 = OffsetGrid(Grid=ptsrfdomnum_2, BRep=srf_4, Dis=".12")
ptoffsetgrid_3 = OffsetGrid(Grid=ptsrfdomnum_3, BRep=srf_5, Dis=".12")
rectangle = Rectangle(Plane=PlaneXY(0, 0, 0), XSize=Domain(-1, 1), YSize=Domain(-2, 2), Radius=0)  # -> Rectangle, Length

debrep = DeconstructBrep(Brep=loft)  # -> Faces, Edges, Vertices
number_slider_7 = Slider(3, range=1..3)
sort_brep = SortDuplicateBreps(Breps=debrep.Faces)  # -> UniqueBreps, Indices
rebuildsrf = RebuildSurface(Surface=reparameterize(sort_brep.UniqueBreps), UDegree=number_slider_7, VDegree=number_slider_7, UNumber=10, VNumber=10)
offset = Offset(Surface=srf, Distance=Slider(10, range=0..100), Retrim=True)
md_slider_2 = MDSlider(slider_value=Point(0.5, 0.5, 0.5), SliderMode=0, x_domain=Domain(0, 1), y_domain=Domain(0, 1), z_domain=Domain(0, 1))
srf_6 = Surface(rebuildsrf)
flip = Flip(Surface=srf_6, Guide=offset)  # -> Surface, Result
evalsrf_2 = EvaluateSurface(Surface=flip.Surface, Point=md_slider_2)  # -> Point, Normal, Frame
amp = Amplitude(Vector=evalsrf_2.Normal, Amplitude=".5")
exoskeleton = Extrude(Base=flip.Surface, Direction=amp)

scale_nu_3 = ScaleNU(
    Geometry=crv_3,
    Plane=evalsrf.Point,
    ScaleX=Slider(0.272, range=0.125..1),
    ScaleY=Slider(0.288, range=0.125..1),
    ScaleZ=1)  # -> Geometry, Transform
Z_3 = UnitZ(Factor="24")
pt3dcell_2 = Cellulate3DGrid(Grid1=ptsrfdomnum_2, Grid2=ptoffsetgrid_2)  # -> Wires, Cells, Boxes
pt3dcell_3 = Cellulate3DGrid(Grid1=ptsrfdomnum_3, Grid2=ptoffsetgrid_3)  # -> Wires, Cells, Boxes
md_slider_3 = MDSlider(slider_value=Point(0.5, 0.5, 0.5), SliderMode=0, x_domain=Domain(0, 1), y_domain=Domain(0, 1), z_domain=Domain(0, 1))
md_slider_4 = MDSlider(slider_value=Point(0.5, 0.5, 0.5), SliderMode=0, x_domain=Domain(0, 1), y_domain=Domain(0, 1), z_domain=Domain(0, 1))
neg_3 = Negative(Value=Slider(0.5, range=0.5..1.5))
number_slider_8 = Slider(0.125, range=0..1)  # disabled
Z_4 = UnitZ(Factor=neg_3)

# ---- group: FREIGHT ELEVATOR
Y = UnitY(Factor=Slider(12, range=1..25))
rev = Reverse(Vector=Y)
extr_2 = Extrude(Base=srf_5, Direction=rev)

# ----
first_floor_perimeter = Extrude(Base=scale_nu_2.Geometry, Direction=Z_3)
debrep_2 = DeconstructBrep(Brep=first_floor_perimeter)  # -> Faces, Edges, Vertices
item = ListItem(List=debrep_2.Faces, Index=Slider(3, range=0..3), Wrap=True)
item_2 = ListItem(List=debrep_2.Faces, Index=Slider(2, range=0..3), Wrap=True)
item_3 = ListItem(List=debrep_2.Faces, Index=Slider(1, range=0..3), Wrap=True)
item_4 = ListItem(List=debrep_2.Faces, Index=Slider(0, range=0..3), Wrap=True)
ptsrfdomnum_4 = SurfaceDomainNumber(Surface=[item_3, item], UNumber=Slider(3, range=1..10), VNumber=Slider(5, range=1..10))
ptsrfdomnum_5 = SurfaceDomainNumber(Surface=[item_4, item_2], UNumber=Slider(3, range=1..10), VNumber=Slider(10, range=1..10))
number_slider_9 = Slider(0.125, range=0..1)
ptoffsetgrid_4 = OffsetGrid(Grid=ptsrfdomnum_5, BRep=[item_4, item_2], Dis=number_slider_9)
ptoffsetgrid_5 = OffsetGrid(Grid=ptsrfdomnum_4, BRep=[item_3, item], Dis=number_slider_9)
pt3dcell_4 = Cellulate3DGrid(Grid1=ptsrfdomnum_4, Grid2=ptoffsetgrid_5)  # -> Wires, Cells, Boxes
pt3dcell_5 = Cellulate3DGrid(Grid1=ptsrfdomnum_5, Grid2=ptoffsetgrid_4)  # -> Wires, Cells, Boxes

_4 = Segments(4)
neg_4 = Negative(Value=Slider(0.125, range=0..1))
_0_25_pi = Angle(0.7853981634)
Z_5 = UnitZ(Factor=Slider(22, range=0..100))
md_slider_5 = MDSlider(slider_value=Point(0.5, 0.5, 0.5), SliderMode=0, x_domain=Domain(0, 1), y_domain=Domain(0, 1), z_domain=Domain(0, 1))
flip_2 = Flip(Surface=patch, Guide=offset)  # -> Surface, Result
srf_7 = Surface(reparameterize(<surface referenced from the Rhino model>))
srf_8 = Surface(reparameterize(flip_2.Surface))
debrep_3 = DeconstructBrep(Brep=srf_7)  # -> Faces, Edges, Vertices
hex = HexagonalStructure(Surface=srf_7, UDivisions=Slider(7, range=0..91), VDivisions=Slider(20, range=0..91), AdjustShape=0.3, Type=False)  # -> StructureLines, StructureNodes
evalsrf_3 = EvaluateSurface(Surface=srf_8, Point=md_slider_5)  # -> Point, Normal, Frame

# ----
# Membrane Tension Rods & Cables
number_slider_10 = Slider(1.5, range=0.125..10)
amp_2 = Amplitude(Vector=evalsrf_3.Normal, Amplitude=number_slider_10)
rev_2 = Reverse(Vector=amp_2)
move_2 = Move(Geometry=srf_8, Motion=rev_2)  # -> Geometry, Transform
voronoi_points = Point(disc.Points)
area_2 = Area(Geometry=move_2.Geometry)  # -> Area, Centroid
area_3 = Area(Geometry=srf_8)  # -> Area, Centroid
tension_rods = Line(StartPoint=area_2.Centroid, EndPoint=area_3.Centroid)
tension_cables = Line(StartPoint=voronoi_points, EndPoint=area_2.Centroid)
pipe = Pipe(Curve=tension_rods, Radius=Slider(0.2, range=0..1), Caps=2)
pipe_2 = Pipe(Curve=tension_cables, Radius=Slider(0.05, range=0..1), Caps=2)

panel = Panel(debrep_3.Edges)
pframes = PerpFrames(Curve=[hex.StructureLines, debrep_3.Edges], Count=Slider(2, range=0..10), Align=True)  # -> Frames, Parameters
_4_2 = Segments(4)
polygon = Polygon(Plane=pframes.Frames, Radius=Slider(0.25, range=0..1), Segments=_4_2, FilletRadius=0)  # -> Polygon, Length
_0_25_pi_2 = Angle(0.7853981634)
rotate = Rotate(Geometry=polygon.Polygon, Angle=_0_25_pi_2, Plane=pframes.Frames)  # -> Geometry, Transform
loft_6 = Loft(Curves=rotate.Geometry, Options={Adjust=False, Closed=False, LoftEnds=0, LoftSimp=0, LoftType=0, Rebuild=10, Refit=0.01})

# ---- group: Scale & Manipulation of Array
range_2 = Range(Domain=Domain(0, 1), Steps=expr("x-1", number_slider_5))
graph_3 = GraphMapper(
    range_2,
    x0=0,
    x1=1,
    y0=0,
    y1=1,
    A=0.00625038147,
    B=0.6921863556,
    container_name="Linear",
    Graph_x0=0,
    Graph_x1=1,
    Graph_y0=0.6921863556,
    Graph_y1=0.6984367371)
number_slider_11 = Slider(1.51, range=0.25..3)
curvepoint_2 = PointOnCurve(move.Geometry, parameter=0.5)
remap_3 = RemapNumbers(Value=graph_3, Source=Domain(0, 1), Target=number_slider_11)  # -> Mapped, Clipped

# ----
neg_5 = Negative(Value=range_2)

crv_7 = Curve([<curve referenced from the Rhino model> x2])
number_slider_12 = Slider(26, range=1..100)  # disabled
number_slider_13 = Slider(15, range=1..100)  # disabled
loft_7 = Loft(Curves=crv_7, Options={Adjust=False, Closed=False, LoftEnds=0, LoftSimp=0, LoftType=0, Rebuild=10, Refit=0.01})
crv_8 = Curve([<curve referenced from the Rhino model> x2])  # disabled
loft_8 = Loft(Curves=crv_8, Options={Adjust=False, Closed=False, LoftEnds=0, LoftSimp=0, LoftType=0, Rebuild=10, Refit=0.01})  # disabled
number_slider_14 = Slider(100, range=1..100)
number_slider_15 = Slider(24, range=1..100)
number_slider_16 = Slider(18, range=1..100)
spacetruss_2 = SpaceTrussStructure2(SurfaceA=loft_7, SurfaceB=loft_8, UDivisions=number_slider_13, VDivisions=number_slider_12)  # -> LinesA, LinesB, Web, Nodes; disabled

srf_9 = Surface(reparameterize(loft_7))
offset_2 = Offset(Surface=loft_7, Distance="-.25", Retrim=True)
quadrand = RandomQuadPanels(Surface=loft_7, UDivisions=number_slider_16, VDivisions=number_slider_14, RandomSeed=number_slider_15)

quadrand_2 = RandomQuadPanels(Surface=offset_2, UDivisions=number_slider_16, VDivisions=number_slider_14, RandomSeed=number_slider_15)

evalsrf_4 = EvaluateSurface(Surface=quadrand_2, Point=md_slider_3)  # -> Point, Normal, Frame
pipe_3 = Pipe(Curve=[spacetruss_2.LinesA, spacetruss_2.LinesB, spacetruss_2.Web], Radius=number_slider_8, Caps=2)  # disabled
debrep_4 = DeconstructBrep(Brep=quadrand)  # -> Faces, Edges, Vertices
amp_3 = Amplitude(Vector=evalsrf_4.Normal, Amplitude=1)
extr_3 = Extrude(Base=quadrand_2, Direction=amp_3)
crv_9 = Curve(graft(debrep_4.Edges))
# MAKESHIFT MULLIONS
pframes_2 = PerpFrames(Curve=crv_9, Count=Slider(2, range=0..10), Align=True)  # -> Frames, Parameters
polygon_2 = Polygon(Plane=pframes_2.Frames, Radius=Slider(0.25, range=0..1), Segments=_4, FilletRadius=0)  # -> Polygon, Length
rotate_2 = Rotate(Geometry=polygon_2.Polygon, Angle=_0_25_pi, Plane=pframes_2.Frames)  # -> Geometry, Transform
loft_9 = Loft(
    Curves=rotate_2.Geometry,
    Options={Adjust=False, Closed=False, LoftEnds=0, LoftSimp=0, LoftType=0, Rebuild=10, Refit=0.01})

crv_10 = Curve(<curve referenced from the Rhino model>)
brep = Brep(<brep referenced from the Rhino model>)
series_2 = Series(Start=0, Step=Slider(6, range=1..12), Count=Slider(22, range=1..50))
Z_6 = UnitZ(Factor=series_2)
Y_2 = UnitY(Factor=1)
X = UnitX(Factor=1)
move_3 = Move(Geometry=crv_10, Motion=Z_6)  # -> Geometry, Transform
project = Project(Curve=move_3.Geometry, Brep=brep, Direction=[X, Y_2])
debrep_5 = DeconstructBrep(Brep=brep)  # -> Faces, Edges, Vertices
md_slider_6 = MDSlider(slider_value=Point(0.5, 0.5, 0.5), SliderMode=0, x_domain=Domain(0, 1), y_domain=Domain(0, 1), z_domain=Domain(0, 1))  # disabled
crv_11 = Curve(debrep_5.Edges)
cull_i_2 = CullIndex(List=debrep_5.Faces, Indices=[Slider(5, range=1..5), Slider(1, range=1..5), Slider(4, range=1..5)], Wrap=True)
# FIN
evalsrf_5 = EvaluateSurface(Surface=reparameterize(cull_i_2), Point=md_slider_6)  # -> Point, Normal, Frame; disabled
ptsrfdomnum_6 = SurfaceDomainNumber(Surface=cull_i_2, UNumber=Slider(24, range=1..60), VNumber=Slider(1, range=1..10))
amp_4 = Amplitude(Vector=evalsrf_5.Normal, Amplitude=Slider(0.125, range=0.125..1))  # disabled
pt = Point(graft(ptsrfdomnum_6))
ptoffsetgrid_6 = OffsetGrid(Grid=ptsrfdomnum_6, BRep=cull_i_2, Dis=Slider(0.075, range=0.025..1))
move_4 = Move(Geometry=cull_i_2, Motion=amp_4)  # -> Geometry, Transform; disabled
ptcell = Cellulate(Grid=ptsrfdomnum_6)  # -> Wires, Cells, Meshes
pline_2 = PolyLine(Vertices=ptcell.Cells, Closed=True)  # -> flatten(Polyline)
panel_2 = Panel(pline_2)
explode = Explode(Curve=pline_2, Recursive=True)  # -> Segments, Vertices
perimeter_bars = ListItem(List=explode.Segments, Index=Slider(1, range=1..300), Wrap=True)
pframes_3 = PerpFrames(Curve=[perimeter_bars, crv_11], Count=Slider(2, range=0..10), Align=True)  # -> Frames, Parameters
_4_3 = Segments(4)
polygon_3 = Polygon(Plane=pframes_3.Frames, Radius=Slider(0.125, range=0..1), Segments=_4_3, FilletRadius=0)  # -> Polygon, Length
_0_25_pi_3 = Angle(0.7853981634)
rotate_3 = Rotate(Geometry=polygon_3.Polygon, Angle=_0_25_pi_3, Plane=pframes_3.Frames)  # -> Geometry, Transform
fin_structure = Loft(
    Curves=rotate_3.Geometry,
    Options={Adjust=False, Closed=False, LoftEnds=0, LoftSimp=0, LoftType=0, Rebuild=10, Refit=0.01})

item_5 = ListItem(List=debrep_5.Faces, Index=[Slider(5, range=1..5), Slider(1, range=1..5)], Wrap=True)
evalsrf_6 = EvaluateSurface(Surface=reparameterize(item_5), Point=md_slider_4)  # -> Point, Normal, Frame
amp_5 = Amplitude(Vector=evalsrf_6.Normal, Amplitude=Slider(0.125, range=0.125..1))
rev_3 = Reverse(Vector=amp_5)
extr_4 = Extrude(Base=item_5, Direction=rev_3)
ptoffsetgrid_7 = OffsetGrid(Grid=ptoffsetgrid_6, BRep=cull_i_2, Dis=Slider(0.125, range=0.125..1))
crv_12 = Curve(pline_2)

fin_panels = Cellulate3DGrid(Grid1=ptoffsetgrid_6, Grid2=ptoffsetgrid_7)  # -> Wires, Cells, Boxes

final_structure_bake = Geometry(fin_structure)
final_panel_bake = Geometry([fin_panels.Boxes, extr_4])

# ---- group: Scale & Manipulation of Array (continued)
graph_4 = GraphMapper(
    neg_5,
    x0=0,
    x1=1,
    y0=0,
    y1=1,
    A=0.2458840609,
    B=0.6384923458,
    container_name="Linear",
    Graph_x0=0,
    Graph_x1=1,
    Graph_y0=0.6384923458,
    Graph_y1=0.8843764067)

# ----
neg_6 = Negative(Value=graph_4)
remap_4 = RemapNumbers(Value=graph_4, Source=Domain(0, 1), Target=number_slider_11)  # -> Mapped, Clipped

# ---- group: Scale & Manipulation of Array (continued)
scale_nu_4 = ScaleNU(Geometry=move.Geometry, Plane=curvepoint_2, ScaleX=remap_4.Mapped, ScaleY=1, ScaleZ=1)  # -> Geometry, Transform

# ----
crv_13 = Curve(scale_nu_4.Geometry)
boundary_2 = BoundarySurfaces(Edges=crv_13)

# ---- group: skin
loft_10 = Loft(
    Curves=scale_nu_4.Geometry,
    Options={Adjust=False, Closed=False, LoftEnds=0, LoftSimp=0, LoftType=3, Rebuild=10, Refit=0.01})

# ----
floor_plates = Extrude(Base=boundary_2, Direction=Z_4)
debrep_6 = DeconstructBrep(Brep=loft_10)  # -> Faces, Edges, Vertices
base_skin_skin = CullPattern(List=debrep_6.Faces, CullPattern=[False, True, True, True])
item_6 = ListItem(List=debrep_6.Faces, Index=Slider(1, range=1..4), Wrap=True)
item_7 = ListItem(List=debrep_6.Faces, Index=Slider(2, range=1..4), Wrap=True)

ptsrfdomnum_7 = SurfaceDomainNumber(Surface=item_6, UNumber=Slider(9, range=1..125), VNumber=Slider(5, range=1..125))
neg_7 = Negative(Value=Slider(1, range=0..1))
ptoffsetgrid_8 = OffsetGrid(Grid=ptsrfdomnum_7, BRep=item_7, Dis=neg_7)
street_side_glazing = Cellulate3DGrid(Grid1=ptsrfdomnum_7, Grid2=ptoffsetgrid_8)  # -> Wires, Cells, Boxes

ptsrfdomnum_8 = SurfaceDomainNumber(Surface=item_7, UNumber=Slider(9, range=1..125), VNumber=Slider(17, range=1..125))
neg_8 = Negative(Value=Slider(0.125, range=0..1))
ptoffsetgrid_9 = OffsetGrid(Grid=ptsrfdomnum_8, BRep=item_7, Dis=neg_8)
street_side_glazing_2 = Cellulate3DGrid(Grid1=ptsrfdomnum_8, Grid2=ptoffsetgrid_9)  # -> Wires, Cells, Boxes

item_8 = ListItem(List=debrep_6.Faces, Index=Slider(3, range=1..4), Wrap=True)
ptsrfdomnum_9 = SurfaceDomainNumber(Surface=item_8, UNumber=Slider(9, range=1..125), VNumber=Slider(6, range=1..125))
move_5 = Move(Geometry=item_7, Motion=Z_5)  # -> Geometry, Transform
scale_nu_5 = ScaleNU(Geometry=move_5.Geometry, Plane=PlaneXY(0, 0, 0), ScaleX=1, ScaleY=1, ScaleZ=Slider(0.821, range=0.125..1))  # -> Geometry, Transform
ptoffsetgrid_10 = OffsetGrid(Grid=ptsrfdomnum_9, BRep=item_7, Dis=neg_4)

number_slider_17 = Slider(3, range=1..5)  # disabled
neg_9 = Negative(Value=number_slider_17)  # disabled
offset_3 = Offset(Surface=item_7, Distance=neg_9, Retrim=True)  # disabled
debrep_7 = DeconstructBrep(Brep=offset_3)  # -> Faces, Edges, Vertices; disabled
number_slider_18 = Slider(2, range=0..3)  # disabled
number_slider_19 = Slider(0, range=0..3)  # disabled
item_9 = ListItem(List=debrep_7.Edges, Index=number_slider_18, Wrap=True)  # disabled
number_slider_20 = Slider(5.84, range=1..10)  # disabled
item_10 = ListItem(List=debrep_7.Edges, Index=number_slider_19, Wrap=True)  # disabled
X_2 = UnitX(Factor=number_slider_20)  # disabled
move_6 = Move(Geometry=item_9, Motion=X_2)  # -> Geometry, Transform; disabled
flip_3 = FlipCurve(Curve=move_6.Geometry)  # -> Curve, Flag; disabled
loft_11 = Loft(
    Curves=[flip_3.Curve, item_10],
    Options={Adjust=False, Closed=False, LoftEnds=0, LoftSimp=0, LoftType=0, Rebuild=10, Refit=0.01})  # disabled

street_side_glazing_3 = Cellulate3DGrid(Grid1=ptsrfdomnum_9, Grid2=ptoffsetgrid_10)  # -> Wires, Cells, Boxes
divide = DivideDomain²(Domain=scale_nu_5.Geometry, UCount=Slider(1, range=1..15), VCount=Slider(9, range=1..15))
subsrf = Isotrim(Surface=scale_nu_5.Geometry, Domain=divide)
debrep_8 = DeconstructBrep(Brep=subsrf)  # -> Faces, Edges, Vertices

item_11 = ListItem(List=debrep_8.Edges, Index=Slider(3, range=0..9), Wrap=True)
series_3 = Series(Start=0, Step=Slider(12, range=0..100), Count=Slider(10, range=0..10))
Z_7 = UnitZ(Factor=series_3)
X_3 = UnitX(Factor=Slider(6, range=0..9))
extr_5 = Extrude(Base=item_11, Direction=X_3)
move_7 = Move(Geometry=extr_5, Motion=Z_7)  # -> Geometry, Transform
neg_10 = Negative(Value=Slider(0.5, range=0.5..3.5))
Z_8 = UnitZ(Factor=neg_10)
balconies = Extrude(Base=move_7.Geometry, Direction=Z_8)

item_12 = ListItem(List=debrep_8.Edges, Index=Slider(2, range=0..9), Wrap=True)
X_4 = UnitX(Factor=Slider(6, range=0..9))
skin_structural_offsets = Extrude(Base=item_12, Direction=X_4)
number_slider_21 = Slider(0.25, range=0.25..3.5)
neg_11 = Negative(Value=number_slider_21)
Y_3 = UnitY(Factor=number_slider_21)
Y_4 = UnitY(Factor=neg_11)
structural_extrusions = Extrude(Base=skin_structural_offsets, Direction=[Y_3, Y_4])
