# Grasshopper definition ImageSampler.gh (Grasshopper 1.0.7)

srf = Surface(<surface referenced from the Rhino model>)
divide = DivideDomain²(Domain=srf, UCount=Slider(100, range=1..100), VCount=Slider(100, range=1..100))
subsrf = Isotrim(Surface=srf, Domain=divide)
srf_2 = Surface(reparameterize(srf))
md_slider = MDSlider(SliderMode=0, slider_value=Point(0.5, 0.5, 0.5), x_domain=Domain(0, 1), y_domain=Domain(0, 1), z_domain=Domain(0, 1))
evalsrf = EvaluateSurface(Surface=reparameterize(subsrf), Point=md_slider)  # -> Point, Normal, UDirection, VDirection, Frame
srf_cp = SurfaceClosestPoint(Point=evalsrf.Point, Surface=srf_2)  # -> Point, UVPoint, Distance
image = ImageSampler(srf_cp.UVPoint, Filter="Value", Interpolate=True, Umax=1, Umin=0, Vmax=1, Vmin=0, Wrap=1)
image_2 = ImageSampler(srf_cp.UVPoint, Filter="Value", Interpolate=True, Umax=1, Umin=0, Vmax=1, Vmin=0, Wrap=1)
evalsrf_2 = EvaluateSurface(Surface=reparameterize(srf_2), Point=srf_cp.UVPoint)  # -> Point, Normal, UDirection, VDirection, Frame
panel = Panel(image)
_1 = A(1)
circle = CircleCNR(Center=evalsrf_2.Point, Normal=evalsrf_2.Normal, Radius=Slider(1, range=0..1))
subtraction = Subtraction(A=_1, B=panel)
panel_2 = Panel(subtraction)
max = Maximum(A=panel_2, B=Slider(0.294, range=0.0001..1))
panel_3 = Panel(max)
division = Division(A=panel_3, B=Slider(12, range=0..100))
scale = Scale(Geometry=circle, Center=evalsrf_2.Point, Factor=division)  # -> Geometry, Transform
larger = LargerThan(FirstNumber=subtraction, SecondNumber=Slider(0.344, range=0..1))  # -> LargerThan, OrEqualTo
smaller = SmallerThan(FirstNumber=subtraction, SecondNumber=Slider(0.131, range=0..1))  # -> SmallerThan, OrEqualTo
panel_4 = Panel(smaller.OrEqualTo)
panel_5 = Panel(larger.OrEqualTo)
cull = CullPattern(List=flatten(scale.Geometry), CullPattern=flatten(larger.OrEqualTo))
