# Grasshopper definition 2D PT with Surface Controls.gh (Grasshopper 0.9.76)
# plug-ins: PTComponentLibrary

# ---- group: Making the Curve / Point Array
number_slider = Slider(9, range=2..20)
pt = ConstructPoint(XCoordinate=0, YCoordinate=0, ZCoordinate=0)
series = Series(Start=0, Step=Slider(6, range=0.5..20), Count=number_slider)
X = UnitX(Factor=series)
move = Move(Geometry=pt, Motion=X)  # -> Geometry, Transform

# ---- group: Making the Curve / Controlling the Point Z
range = Range(Domain=Domain(0, 1), Steps=expr("x-1", number_slider))
graph = GraphMapper(
    range,
    x0=0,
    x1=1,
    y0=0,
    y1=1,
    container_name="Sine",
    Equation_px=[0.2780801654, 0.5098553896],
    Equation_py=[0.5878618956, 0.2779129744])
panel = Panel(graph)
remap = RemapNumbers(Value=panel, Source=Domain(0, 1), Target=Slider(8.89, range=1..10))  # -> Mapped, Clipped
panel_2 = Panel(remap.Mapped)

# ---- group: Making the Curve
pdecon = Deconstruct(Point=move.Geometry)  # -> XComponent, YComponent, ZComponent
pt_2 = ConstructPoint(XCoordinate=pdecon.XComponent, YCoordinate=pdecon.YComponent, ZCoordinate=panel_2)
nurbs = NurbsCurve(Vertices=pt_2, Degree=3, Periodic=False)  # -> Curve, Length, Domain

# ----
# Rhino Curve
crv = Curve(nurbs.Curve)

# ---- group: Array Curves
number_slider_2 = Slider(12, range=2..20)
series_2 = Series(Start=0, Step=Slider(12.4, range=5..30), Count=number_slider_2)
Z = UnitZ(Factor=series_2)
Y = UnitY(Factor=series_2)
move_2 = Move(Geometry=crv, Motion=Z)  # -> Geometry, Transform

# ---- group: NU Scale Controls
range_2 = Range(Domain=Domain(0, 1), Steps=expr("x-1", number_slider_2))
graph_2 = GraphMapper(
    range_2,
    x0=0,
    x1=1,
    y0=0,
    y1=1,
    amplitude=0.08333289623,
    container_name="Perlin",
    decay=0.4275362492,
    frequency=0.09963768721,
    x_offset=0.6811603308,
    y_offset=0.6630430222)
graph_3 = GraphMapper(
    range_2,
    x0=0,
    x1=1,
    y0=0,
    y1=1,
    container_name="Parabola",
    Ox=0.2463768125,
    Oy=0.6014492512,
    Px=0.8260869384,
    Py=0.8188405633)
remap_2 = RemapNumbers(Value=graph_3, Source=Domain(0, 1), Target=Slider(0.95, range=0.25..10))  # -> Mapped, Clipped
panel_3 = Panel(remap_2.Mapped)
panel_4 = Panel(graph_2)
curvepoint = PointOnCurve(move_2.Geometry, parameter=0.15)
scale_nu = ScaleNU(Geometry=move_2.Geometry, Plane=curvepoint, ScaleX=panel_4, ScaleY=panel_3, ScaleZ=1)  # -> Geometry, Transform

# ----
Y_2 = UnitY(Factor=1)

# ---- group: Rotation Controls
graph_4 = GraphMapper(
    range_2,
    x0=0,
    x1=1,
    y0=0,
    y1=1,
    container_name="Parabola",
    Ox=0.4782652855,
    Oy=0.1413016915,
    Px=0.9076086879,
    Py=0.6462862492)
remap_3 = RemapNumbers(Value=graph_4, Source=Domain(0, 1), Target=Slider(0.37, range=-1..1))  # -> Mapped, Clipped
panel_5 = Panel(remap_3.Mapped)
md_slider = MDSlider(slider_value=Point(0.5, 0.5, 0.5), SliderMode=0, x_domain=Domain(0, 1), y_domain=Domain(0, 1), z_domain=Domain(0, 1))
extr = Extrude(Base=scale_nu.Geometry, Direction=Y_2)
evalsrf = EvaluateSurface(Surface=reparameterize(extr), Point=md_slider)  # -> Point, Normal, Frame
rotate = Rotate(Geometry=scale_nu.Geometry, Angle=remap_3.Mapped, Plane=evalsrf.Point)  # -> Geometry, Transform
loft = Loft(Curves=rotate.Geometry, Options={Adjust=False, Closed=False, LoftEnds=0, LoftSimp=0, LoftType=0, Rebuild=10, Refit=0.01})

# ---- group: Rotation Controls / Axis Rotation Option
pdecon_2 = Deconstruct(Point=curvepoint)  # -> XComponent, YComponent, ZComponent
pt_3 = ConstructPoint(XCoordinate=pdecon_2.XComponent, YCoordinate=0, ZCoordinate=pdecon_2.ZComponent)
pline = PolyLine(Vertices=pt_3, Closed=False)
rotax = RotateAxis(Geometry=scale_nu.Geometry, Angle=remap_3.Mapped, Axis=pline)  # -> Geometry, Transform

# ----
S = Surface(loft)
ptsrfdomnum = SurfaceDomainNumber(Surface=S, UNumber=Slider(24, range=0..100), VNumber=Slider(9, range=0..100))
ptplanar = PlanarGrid(
    BasePoint=Point(0, 0, 0),
    IDir=Vector(1, 0, 0),
    JDir=Vector(0, 1, 0),
    IDistance=Slider(1.27, range=0..10),
    JDistance=Slider(1.15, range=0..10),
    INumber=Slider(56, range=0..100),
    JNumber=Slider(62, range=0..100))
ptsubgrid = SubGrid()
ptwrap = WrapGrids(Steps=1)
pttodiamond = ConvertToDiamond(Grid=ptsrfdomnum)
ptcell = Cellulate(Grid=ptplanar)  # -> Wires, Cells, Meshes
ptcenter = CenterGrid(Grid=ptplanar)
ptborders = GenerateBorders(Grid=ptsrfdomnum, PanelShape=Slider(2, range=0..3), Surface=S)
ptfaces = GenerateFaces(Grid=ptsrfdomnum, PanelShape=Slider(0, range=0..3), Surface=S)
ptflatfaces = GenerateFlatFaces(Grid=ptsrfdomnum, Method=Slider(3, range=0..3), Base=S)  # -> Faces, Deviation
offsets = OffsetOnSrf(Distance=1)
series_3 = Series(Start=3, Step=1, Count=10)
ptrandatts = RandomAttraction(Grid=ptsrfdomnum, Magnitude=Slider(0.22, range=0..1))  # -> Grid, Weights
polygon = Polygon(Plane=PlaneXY(0, 0, 0), Radius=3, Segments=Slider(8, range=3..8), FilletRadius=0)  # -> Polygon, Length
polygon_2 = Polygon(Plane=PlaneXY(0, 0, 0), Radius=3, Segments=4, FilletRadius=0)  # -> Polygon, Length
cir = Circle(Plane=PlaneXY(0, 0, 0), Radius=Slider(0.67, range=0..1))
range_3 = Range(Domain=Domain(-1, 1), Steps=Slider(1000, range=100..1000))
crv_2 = Curve(<curve referenced from the Rhino model>)
crv_3 = Curve(<curve referenced from the Rhino model>)
crv_4 = Curve(<curve referenced from the Rhino model>)
rotate_2 = Rotate(Geometry=polygon.Polygon, Angle=range_3, Plane=PlaneXY(0, 0, 0))  # -> Geometry, Transform
merge = Merge(Data1=polygon_2.Polygon, Data2=polygon.Polygon)  # -> graft(Result)
ptmorph2dmean = Morph2DMean(
    Grid=ptsrfdomnum,
    Weights=ptrandatts.Weights,
    PatternCurvesS=polygon.Polygon,
    PatternCurvesE=polygon_2.Polygon,
    Shift_i=1,
    Shift_j=1)
ptmorph2dmap = Morph2DMap(Grid=ptsrfdomnum, PatternCurves=rotate_2.Geometry, Flatten=Toggle(True), Repeat=Toggle(True))
ptmorph2dlist = Morph2DList(Grid=ptsrfdomnum, Weights=ptrandatts.Weights, PatternCurves=merge, Shift_i=1, Shift_j=1)
ptmorph2d = Morph2D(Grid=ptsrfdomnum, PatternCurves=merge, Shift_i=Slider(1, range=1..3), Shift_j=Slider(1, range=1..3))  # disabled
