# Grasshopper definition 2D PT.gh (Grasshopper 0.9.76)
# plug-ins: PTComponentLibrary

S = Surface(<surface referenced from the Rhino model>)
ptsrfdomnum = SurfaceDomainNumber(Surface=S, UNumber=Slider(16, range=0..100), VNumber=Slider(18, range=0..100))
ptplanar = PlanarGrid(
    BasePoint=Point(0, 0, 0),
    IDir=Vector(1, 0, 0),
    JDir=Vector(0, 1, 0),
    IDistance=Slider(10, range=0..10),
    JDistance=Slider(7.9, range=0..10),
    INumber=Slider(8, range=0..100),
    JNumber=Slider(7, range=0..100))
ptborders = GenerateBorders(Grid=ptsrfdomnum, PanelShape=Slider(2, range=0..3), Surface=S)
ptfaces = GenerateFaces(Grid=ptsrfdomnum, PanelShape=Slider(0, range=0..3), Surface=S)
ptflatfaces = GenerateFlatFaces(Grid=ptsrfdomnum, Method=Slider(0, range=0..3), Base=S)  # -> Faces, Deviation
pttodiamond = ConvertToDiamond(Grid=ptplanar)
ptcell = Cellulate(Grid=ptplanar)  # -> Wires, Cells, Meshes
ptcenter = CenterGrid(Grid=ptplanar)
ptsubgrid = SubGrid()
ptwrap = WrapGrids(Steps=1)
ptrandatts = RandomAttraction(Grid=ptsrfdomnum, Magnitude=Slider(0.488, range=0..1))  # -> Grid, Weights
ptweight = WeightAttraction(Magnitude=1)
series = Series(Start=3, Step=1, Count=10)
polygon = Polygon(Plane=PlaneXY(0, 0, 0), Radius=3, Segments=6, FilletRadius=0)  # -> Polygon, Length
cir = Circle(Plane=PlaneXY(0, 0, 0), Radius=Slider(1, range=0..1))
crv = Curve(<curve referenced from the Rhino model>)
ptmorph2d = Morph2D(Grid=ptrandatts.Grid, PatternCurves=crv, Shift_i=Slider(1, range=1..3), Shift_j=Slider(1, range=1..3))
ptmorph2dlist = Morph2DList(Shift_i=1, Shift_j=1)
ptmorph2dmean = Morph2DMean(Shift_i=1, Shift_j=1)
ptmorph2dmap = Morph2DMap()
offsets = OffsetOnSrf(Distance=1)
