# Grasshopper definition Class 10.gh (Grasshopper 0.9.76)
# plug-ins: PTComponentLibrary

# ---- group: Base Surface
srf = Surface(<surface referenced from the Rhino model>)

# ---- group: Surface Grid
ptsrfdomnum = SurfaceDomainNumber(Surface=srf, UNumber=Slider(24, range=10..50), VNumber=Slider(33, range=10..50))

# ---- group: Vector Creation
md_slider = MDSlider(
    slider_value=Point(0.1119999886, 0.6359996796, 0.5),
    SliderMode=0,
    x_domain=Domain(0, 1),
    y_domain=Domain(0, 1),
    z_domain=Domain(0, 1))
crv = Curve(<curve referenced from the Rhino model>)
curvepoint = PointOnCurve(crv, parameter=0.743)
evalsrf = EvaluateSurface(Surface=reparameterize(srf), Point=md_slider)  # -> Point, Normal, Frame
vec2pt = Vector2Pt(PointA=curvepoint, PointB=evalsrf.Point, Unitize=False)  # -> Vector, Length
vdis = VectorDisplay(Anchor=curvepoint, Vector=vec2pt.Vector)
devec = DeconstructVector(Vector=vec2pt.Vector)  # -> XComponent, YComponent, ZComponent
neg = Negative(Value=devec.ZComponent)
vec = VectorXYZ(XComponent=devec.XComponent, YComponent=devec.YComponent, ZComponent=neg)  # -> Vector, Length

# ---- group: Direction Attraction
ptdiratts = DirectionAttraction(Grid=ptsrfdomnum, Magnitude=Slider(2, range=0..2), Dir=vec2pt.Vector)  # -> Grid, Weights

# ----
dom = ConstructDomain(DomainStart=Slider(0.1, range=0.1..3), DomainEnd=Slider(9, range=0.1..9))
remap = RemapNumbers(Value=ptdiratts.Weights, Source=Domain(0, 1), Target=dom)  # -> Mapped, Clipped
amp = Amplitude(Vector=vec.Vector, Amplitude=remap.Mapped)

# ---- group: Border Extraction
ptcell = Cellulate(Grid=ptdiratts.Grid)  # -> Wires, Cells, Meshes
item = ListItem(List=ptcell.Wires, Index=Slider(1, range=0..3), Wrap=True)

# ----
lng = ListLength(List=flatten(item))
split = SplitList(List=flatten(amp), Index=lng)  # -> ListA, ListB

# ---- group: Final Louver Geometry
extr = Extrude(Base=flatten(item), Direction=expr("-x", split.ListA))
