# Grasshopper definition Class 10_2.gh (Grasshopper 0.9.76)

# ---- group: Base Surface
srf = Surface(<surface referenced from the Rhino model>)

# ---- group: Surface Division
divide = DivideDomain²(Domain=srf, UCount=Slider(18, range=1..50), VCount=Slider(12, range=1..50))
subsrf = Isotrim(Surface=srf, Domain=divide)  # -> reparameterize(Surface)
md_slider = MDSlider(
    slider_value=Point(0.6119995117, 0.4200000763, 0.5),
    SliderMode=0,
    x_domain=Domain(0, 1),
    y_domain=Domain(0, 1),
    z_domain=Domain(0, 1))
evalsrf = EvaluateSurface(Surface=subsrf, Point=md_slider)  # -> Point, Normal, Frame

# ---- group: Pseudo Sun Path Creation
pt = ConstructPoint(XCoordinate=Slider(378, range=0..1000), YCoordinate=0, ZCoordinate=0)
arc = Arc(Plane=pt, Radius=Slider(478, range=0..1000), Angle=Domain(0, 3.141592654))  # -> Arc, Length
yz = YZPlane(Origin=Point(0, 0, 0))
rotate = Rotate(Geometry=arc.Arc, Angle=degrees(Slider(120, range=90..180)), Plane=yz)  # -> Geometry, Transform
rotate_2 = Rotate(Geometry=rotate.Geometry, Angle=degrees(Slider(18, range=-90..90)), Plane=pt)  # -> Geometry, Transform
curvepoint = PointOnCurve(rotate_2.Geometry, parameter=0.594)
sph = Sphere(Base=curvepoint, Radius=Slider(28, range=1..100))
preview = CustomPreview(Geometry=sph, Shader=ColourSwatch(SwatchColor=RGB(255, 204, 0)))

# ----
vec2pt = Vector2Pt(PointA=curvepoint, PointB=evalsrf.Point, Unitize=False)  # -> Vector, Length
vdis = VectorDisplay(Anchor=curvepoint, Vector=vec2pt.Vector)

division = Division(A=vec2pt.Length, B=Slider(28, range=0..200))
_10º = PowerOf10(Value=Slider(7.02, range=0..10))
eval = Evaluate(F="x^3", x=vec2pt.Length)
division_2 = Division(A=eval, B=_10º)

# ---- group: Final Geometry
box = CenterBox(Base=evalsrf.Frame, X=Slider(2, range=1..50), Y=Slider(18, range=1..50), Z=reverse(division_2))
