# Grasshopper definition Class 4 (1-19-16).gh (Grasshopper 0.9.76)

# ---- group: Point Array
number_slider = Slider(20, range=2..20)
series = Series(Start=0, Step=Slider(1.1, range=0.5..20), Count=number_slider)
pt = ConstructPoint(XCoordinate=0, YCoordinate=0, ZCoordinate=0)
X = UnitX(Factor=series)
move = Move(Geometry=pt, Motion=X)  # -> Geometry, Transform

# ---- group: Copy Array Along Sine Curve
range = Range(Domain=Domain(0, 1), Steps=expr("x-1", number_slider))
graph = GraphMapper(range, x0=0, x1=1, y0=0, y1=1, container_name="Sine", Equation_px=[0, 0.1458554417], Equation_py=[0, 1])
panel = Panel(graph)
pdecon = Deconstruct(Point=move.Geometry)  # -> XComponent, YComponent, ZComponent
remap = RemapNumbers(Value=panel, Source=Domain(0, 1), Target=Slider(8.8, range=1..10))  # -> Mapped, Clipped
panel_2 = Panel(remap.Mapped)
pt_2 = ConstructPoint(XCoordinate=pdecon.XComponent, YCoordinate=pdecon.YComponent, ZCoordinate=panel_2)

# ---- group: Direct Manipulation Curve
crv = Curve(<curve referenced from the Rhino model>)

# ---- group: Curve Creation & Array
nurbs = NurbsCurve(Vertices=pt_2, Degree=3, Periodic=False)  # -> Curve, Length, Domain
number_slider_2 = Slider(20, range=2..20)
series_2 = Series(Start=0, Step=Slider(2.5, range=0.5..30), Count=number_slider_2)
Y = UnitY(Factor=series_2)
move_2 = Move(Geometry=[crv, nurbs.Curve], Motion=Y)  # -> Geometry, Transform

# ---- group: Scale & Manipulation of Array
range_2 = Range(Domain=Domain(0, 1), Steps=expr("x-1", number_slider_2))
graph_2 = GraphMapper(
    range_2,
    x0=0,
    x1=1,
    y0=0,
    y1=1,
    container_name="Sine",
    Equation_px=[0, 0.2362317145],
    Equation_py=[0.500579834, 0.7278261185])
graph_3 = GraphMapper(range_2, x0=0, x1=1, y0=0, y1=1, container_name="Gaussian", factor=0.4866669178, mean=0.681448698, sdev=0.2040573657)
panel_3 = Panel(graph_2)
curvepoint = PointOnCurve(move_2.Geometry, parameter=0.5)
remap_2 = RemapNumbers(Value=graph_3, Source=Domain(0, 1), Target=Slider(3, range=0.25..3))  # -> Mapped, Clipped
panel_4 = Panel(remap_2.Mapped)
scale_nu = ScaleNU(Geometry=move_2.Geometry, Plane=curvepoint, ScaleX=graph_2, ScaleY=1, ScaleZ=panel_4)  # -> Geometry, Transform

# ---- group: Surface Position Normal Rotation
graph_4 = GraphMapper(range_2, x0=0, x1=1, y0=0, y1=1, container_name="Sine", Equation_px=[0, 0.07089100778], Equation_py=[0, 0.9779393077])
Z = UnitZ(Factor=1)
md_slider = MDSlider(slider_value=Point(0.5, 0.5, 0.5), SliderMode=0, x_domain=Domain(0, 1), y_domain=Domain(0, 1), z_domain=Domain(0, 1))
extr = Extrude(Base=scale_nu.Geometry, Direction=Z)
evalsrf = EvaluateSurface(Surface=reparameterize(extr), Point=md_slider)  # -> Point, Normal, Frame
remap_3 = RemapNumbers(Value=graph_4, Source=Domain(0, 1), Target=Slider(-0.3, range=-1..1))  # -> Mapped, Clipped
rotate = Rotate(Geometry=scale_nu.Geometry, Angle=remap_3.Mapped, Plane=evalsrf.Frame)  # -> Geometry, Transform
panel_5 = Panel(remap_3.Mapped)

# ---- group: xy axis rotation
pdecon_2 = Deconstruct(Point=curvepoint)  # -> XComponent, YComponent, ZComponent
pt_3 = ConstructPoint(XCoordinate=pdecon_2.XComponent, YCoordinate=pdecon_2.YComponent, ZCoordinate=0)
pline = PolyLine(Vertices=pt_3, Closed=False)
rotax = RotateAxis(Geometry=scale_nu.Geometry, Angle=Slider(0.62, range=-1..1), Axis=pline)  # -> Geometry, Transform

# ---- group: Final Geometry
loft = Loft(Curves=rotate.Geometry, Options={Adjust=False, Closed=False, LoftEnds=0, LoftSimp=0, LoftType=0, Rebuild=10, Refit=0.01})
loft_2 = Loft(Curves=rotax.Geometry, Options={Adjust=False, Closed=False, LoftEnds=0, LoftSimp=0, LoftType=0, Rebuild=10, Refit=0.01})
