# Grasshopper definition Class 5 (Surface Pattern Cut).gh (Grasshopper 0.9.76)

# ---- group: Point Array
number_slider = Slider(1.1, range=0.5..20)  # disabled
number_slider_2 = Slider(20, range=2..20)  # disabled
series = Series(Start=0, Step=number_slider, Count=number_slider_2)  # disabled
pt = ConstructPoint(XCoordinate=0, YCoordinate=0, ZCoordinate=0)  # disabled
X = UnitX(Factor=series)  # disabled
move = Move(Geometry=pt, Motion=X)  # -> Geometry, Transform; disabled

# ---- group: Copy Array Along Sine Curve
range = Range(Domain=Domain(0, 1), Steps=expr("x-1", number_slider_2))  # disabled
graph = GraphMapper(range, x0=0, x1=1, y0=0, y1=1, container_name="Sine", Equation_px=[0, 0.1458554417], Equation_py=[0, 1])  # disabled
panel = Panel(graph)  # disabled
pdecon = Deconstruct(Point=move.Geometry)  # -> XComponent, YComponent, ZComponent; disabled
number_slider_3 = Slider(8.8, range=1..10)  # disabled
remap = RemapNumbers(Value=panel, Source=Domain(0, 1), Target=number_slider_3)  # -> Mapped, Clipped; disabled
panel_2 = Panel(remap.Mapped)  # disabled
pt_2 = ConstructPoint(XCoordinate=pdecon.XComponent, YCoordinate=pdecon.YComponent, ZCoordinate=panel_2)  # disabled

# ---- group: Direct Manipulation Curve
crv = Curve(<curve referenced from the Rhino model>)

# ---- group: Curve Creation & Array
nurbs = NurbsCurve(Vertices=pt_2, Degree=3, Periodic=False)  # -> Curve, Length, Domain
number_slider_4 = Slider(20, range=2..20)
series_2 = Series(Start=0, Step=Slider(30, range=0.5..30), Count=number_slider_4)
Y = UnitY(Factor=series_2)
move_2 = Move(Geometry=[crv, nurbs.Curve], Motion=Y)  # -> Geometry, Transform

# ---- group: Scale & Manipulation of Array
range_2 = Range(Domain=Domain(0, 1), Steps=expr("x-1", number_slider_4))
graph_2 = GraphMapper(
    range_2,
    x0=0,
    x1=1,
    y0=0,
    y1=1,
    container_name="Sine",
    Equation_px=[0.1703774333, 0.7417399287],
    Equation_py=[0.4625505209, 0.7816228271])
graph_3 = GraphMapper(range_2, x0=0, x1=1, y0=0, y1=1, container_name="Sine", Equation_px=[0, 0.4625872076], Equation_py=[0, 0.4563549757])
panel_3 = Panel(graph_2)
curvepoint = PointOnCurve(move_2.Geometry, parameter=0.5)
remap_2 = RemapNumbers(Value=graph_3, Source=Domain(0, 1), Target=Slider(5.34, range=0.25..20))  # -> Mapped, Clipped
panel_4 = Panel(remap_2.Mapped)
scale_nu = ScaleNU(Geometry=move_2.Geometry, Plane=curvepoint, ScaleX=graph_2, ScaleY=1, ScaleZ=panel_4)  # -> Geometry, Transform

# ---- group: Surface Position Normal Rotation
graph_4 = GraphMapper(range_2, x0=0, x1=1, y0=0, y1=1, container_name="Sine", Equation_px=[0, 0.08594811708], Equation_py=[0, 0.2243480086])
Z = UnitZ(Factor=1)
md_slider = MDSlider(slider_value=Point(0.5, 0.5, 0.5), SliderMode=0, x_domain=Domain(0, 1), y_domain=Domain(0, 1), z_domain=Domain(0, 1))
extr = Extrude(Base=scale_nu.Geometry, Direction=Z)
evalsrf = EvaluateSurface(Surface=reparameterize(extr), Point=md_slider)  # -> Point, Normal, Frame
remap_3 = RemapNumbers(Value=graph_4, Source=Domain(0, 1), Target=Slider(0.6, range=-1..1))  # -> Mapped, Clipped
rotate = Rotate(Geometry=scale_nu.Geometry, Angle=remap_3.Mapped, Plane=evalsrf.Frame)  # -> Geometry, Transform
panel_5 = Panel(remap_3.Mapped)

# ----
number_slider_5 = Slider(0.62, range=-1..1)  # disabled

# ---- group: xy axis rotation
pdecon_2 = Deconstruct(Point=curvepoint)  # -> XComponent, YComponent, ZComponent; disabled
pt_3 = ConstructPoint(XCoordinate=pdecon_2.XComponent, YCoordinate=pdecon_2.YComponent, ZCoordinate=0)  # disabled
pline = PolyLine(Vertices=pt_3, Closed=False)  # disabled
rotax = RotateAxis(Geometry=scale_nu.Geometry, Angle=number_slider_5, Axis=pline)  # -> Geometry, Transform; disabled

# ---- group: Final Geometry
loft = Loft(Curves=rotate.Geometry, Options={Adjust=False, Closed=False, LoftEnds=0, LoftSimp=0, LoftType=0, Rebuild=10, Refit=0.01})
loft_2 = Loft(Curves=rotax.Geometry, Options={Adjust=False, Closed=False, LoftEnds=0, LoftSimp=0, LoftType=0, Rebuild=10, Refit=0.01})  # disabled

# ---- group: Image Sampler_Surface Pattern
srf = Surface(loft)
divide = DivideDomain²(Domain=srf, UCount=Slider(100, range=1..100), VCount=Slider(100, range=1..100))
subsrf = Isotrim(Surface=srf, Domain=divide)
srf_2 = Surface(reparameterize(srf))
md_slider_2 = MDSlider(slider_value=Point(0.5, 0.5, 0.5), SliderMode=0, x_domain=Domain(0, 1), y_domain=Domain(0, 1), z_domain=Domain(0, 1))
evalsrf_2 = EvaluateSurface(Surface=reparameterize(subsrf), Point=md_slider_2)  # -> Point, Normal, Frame
srf_cp = SurfaceClosestPoint(Point=evalsrf_2.Point, Surface=srf_2)  # -> Point, UVPoint, Distance
image = ImageSampler(
    srf_cp.UVPoint,
    FilePath="C:\Users\nplace20\Desktop\bone-spongy-greyscale-abstract-background-41296946.jpg",
    Filter="Value",
    Interpolate=True,
    Umax=1,
    Umin=0,
    Vmax=1,
    Vmin=0,
    Wrap=1)
image_2 = ImageSampler(
    srf_cp.UVPoint,
    FilePath="C:\Users\Public\Pictures\Sample Pictures\Koala.jpg",
    Filter="Value",
    Interpolate=True,
    Umax=1,
    Umin=0,
    Vmax=1,
    Vmin=0,
    Wrap=1)
evalsrf_3 = EvaluateSurface(Surface=srf_2, Point=srf_cp.UVPoint)  # -> Point, Normal, Frame
panel_6 = Panel(image)
_1 = A(1)
circle = CircleCNR(Center=evalsrf_3.Point, Normal=evalsrf_3.Normal, Radius=Slider(1, range=0..1))
subtraction = Subtraction(A=_1, B=panel_6)
panel_7 = Panel(subtraction)
max = Maximum(A=panel_7, B=Slider(0.294, range=0.0001..1))
panel_8 = Panel(max)
scale = Scale(Geometry=circle, Center=evalsrf_3.Point, Factor=panel_8)  # -> Geometry, Transform
larger = LargerThan(FirstNumber=subtraction, SecondNumber=Slider(0.344, range=0..1))  # -> LargerThan, OrEqualTo
smaller = SmallerThan(FirstNumber=subtraction, SecondNumber=Slider(0.131, range=0..1))  # -> SmallerThan, OrEqualTo
panel_9 = Panel(smaller.OrEqualTo)
panel_10 = Panel(larger.OrEqualTo)
cull = CullPattern(List=flatten(scale.Geometry), CullPattern=flatten(larger.OrEqualTo))

# ----
srfsplit = SurfaceSplit(Surface=loft, Curves=cull)  # disabled
