# Grasshopper definition Class 5 (Tower_Refined).gh (Grasshopper 0.9.76)

# ---- group: Direct Manipulation Curve
crv = Curve(<curve referenced from the Rhino model>)

# ---- group: Array Curve Z Direction
number_slider = Slider(30, range=2..30)
series = Series(Start=0, Step=Slider(16.3, range=0.5..30), Count=number_slider)
Z = UnitZ(Factor=series)
move = Move(Geometry=crv, Motion=Z)  # -> Geometry, Transform

# ---- group: Scale & Manipulation of Array
range = Range(Domain=Domain(0, 1), Steps=expr("x-1", number_slider))
graph = GraphMapper(
    range,
    x0=0,
    x1=1,
    y0=0,
    y1=1,
    container_name="Sine",
    Equation_px=[0.3315359056, 0.1163480431],
    Equation_py=[0.7189565897, 0.4184345007])
graph_2 = GraphMapper(
    range,
    x0=0,
    x1=1,
    y0=0,
    y1=1,
    container_name="Sinc",
    Equation_X0=0.4734116793,
    Equation_X1=0.8580799699,
    Equation_Y0=0.4880742431,
    Equation_Y1=0.3859713078)
panel = Panel(graph)
curvepoint = PointOnCurve(move.Geometry, parameter=0.5)
remap = RemapNumbers(Value=graph_2, Source=Domain(0, 1), Target=Slider(1.71, range=0.25..3))  # -> Mapped, Clipped
panel_2 = Panel(remap.Mapped)
scale_nu = ScaleNU(Geometry=move.Geometry, Plane=curvepoint, ScaleX=graph, ScaleY=remap.Mapped, ScaleZ=1)  # -> Geometry, Transform

# ----
panel_3 = Panel(move.Geometry)
item = ListItem(List=move.Geometry, Index=0, Wrap=True)
Y = UnitY(Factor=1)
area = Area(Geometry=item)  # -> Area, Centroid
line = LineSDL(Start=area.Centroid, Direction=Vector(0, 0, 1), Length=Slider(100, range=1..100))

# ---- group: Surface Position Normal Rotation
graph_3 = GraphMapper(
    range,
    x0=0,
    x1=1,
    y0=0,
    y1=1,
    A=1.908128183,
    B=-0.4874189051,
    container_name="Linear",
    Graph_x0=0.2786069512,
    Graph_x1=0.454455018,
    Graph_y0=0.04419887066,
    Graph_y1=0.3797395229)
md_slider = MDSlider(
    slider_value=Point(0.5027999878, 0.4928007126, 0.5),
    SliderMode=0,
    x_domain=Domain(0, 1),
    y_domain=Domain(0, 1),
    z_domain=Domain(0, 1))
extr = Extrude(Base=scale_nu.Geometry, Direction=Y)
evalsrf = EvaluateSurface(Surface=reparameterize(extr), Point=md_slider)  # -> Point, Normal, Frame
remap_2 = RemapNumbers(Value=graph_3, Source=Domain(0, 1), Target=Slider(1, range=-1..1))  # -> Mapped, Clipped
rotate = Rotate(Geometry=scale_nu.Geometry, Angle=remap_2.Mapped, Plane=line)  # -> Geometry, Transform
panel_4 = Panel(remap_2.Mapped)

# ---- group: Final Geometry
loft = Loft(Curves=rotate.Geometry, Options={Adjust=False, Closed=False, LoftEnds=0, LoftSimp=0, LoftType=0, Rebuild=10, Refit=0.01})
