# Grasshopper definition Class 6_Texture(1-26-15).gh (Grasshopper 0.9.76)

pt = ConstructPoint(XCoordinate=Slider(30, range=-30..30), YCoordinate=0, ZCoordinate=Slider(30, range=-30..30))
pt_2 = ConstructPoint(XCoordinate=Slider(30, range=-30..30), YCoordinate=0, ZCoordinate=Slider(-21, range=-30..30))
pt_3 = ConstructPoint(XCoordinate=Slider(5.95, range=-30..30), YCoordinate=0, ZCoordinate=Slider(30, range=-30..30))
pt_4 = ConstructPoint(XCoordinate=Slider(-26.4, range=-30..30), YCoordinate=0, ZCoordinate=Slider(-30, range=-30..30))
merge = Merge(Data1=pt_3, Data2=pt, Data3=pt_2, Data4=pt_4)
nurbs = NurbsCurve(Vertices=merge, Degree=Slider(3, range=1..5), Periodic=Toggle(True))  # -> Curve, Length, Domain

range = Range(Domain=Domain(0, 1), Steps=expr("x-1", Slider(16, range=5..30)))
dom = ConstructDomain(DomainStart=0, DomainEnd=Slider(26, range=10..50))
graph = GraphMapper(range, x0=0, x1=1, y0=0, y1=1, container_name="Sine", Equation_px=[0, 0.5183541179], Equation_py=[0, 0.4745147228])
dom_2 = ConstructDomain(DomainStart=0, DomainEnd=Slider(100, range=10..100))
graph_2 = GraphMapper(
    range,
    x0=0,
    x1=1,
    y0=0,
    y1=1,
    container_name="Bezier",
    cpx=[0, 0.4428064227, 0.7293737531, 1],
    cpy=[0, 0.2772781253, 0.869387269, 1])
remap = RemapNumbers(Value=graph, Source=Domain(0, 1), Target=dom)  # -> Mapped, Clipped
remap_2 = RemapNumbers(Value=graph_2, Source=Domain(0, 1), Target=dom_2)  # -> Mapped, Clipped

dom_3 = ConstructDomain(DomainStart=0, DomainEnd=Slider(2.08, range=0.25..3))
graph_3 = GraphMapper(
    range,
    x0=0,
    x1=1,
    y0=0,
    y1=1,
    container_name="Bezier",
    cpx=[0, 0.6098523736, 0.6098523736, 1],
    cpy=[0.2533316016, 0.2395094037, 0.5808429718, 0.4554551244])
remap_3 = RemapNumbers(Value=graph_3, Source=Domain(0, 1), Target=dom_3)  # -> Mapped, Clipped

vec = VectorXYZ(XComponent=0, YComponent=remap_2.Mapped, ZComponent=remap.Mapped)  # -> Vector, Length
move = Move(Geometry=nurbs.Curve, Motion=vec.Vector)  # -> Geometry, Transform

# ---- group: Centroid
area = Area(Geometry=move.Geometry)  # -> Area, Centroid

# ----
scale = Scale(Geometry=move.Geometry, Center=area.Centroid, Factor=remap_3.Mapped)  # -> Geometry, Transform
md_slider = MDSlider(
    slider_value=Point(1, 0.7400016785, 0.5),
    SliderMode=0,
    x_domain=Domain(0, 1),
    y_domain=Domain(0, 1),
    z_domain=Domain(0, 1))
boundary = BoundarySurfaces(Edges=scale.Geometry)
evalsrf = EvaluateSurface(Surface=reparameterize(boundary), Point=md_slider)  # -> Point, Normal, Frame

graph_4 = GraphMapper(
    range,
    x0=0,
    x1=1,
    y0=0,
    y1=1,
    container_name="Bezier",
    cpx=[0, 0.5477604866, 0.4104477465, 1],
    cpy=[0.2533316016, 0.2386400104, 0.7891156673, 0.7317541838])
dom_4 = ConstructDomain(DomainStart=Slider(-1, range=-1..1), DomainEnd=Slider(1, range=-1..1))
remap_4 = RemapNumbers(Value=graph_4, Source=Domain(0, 1), Target=dom_4)  # -> Mapped, Clipped

rotate = Rotate(Geometry=scale.Geometry, Angle=remap_4.Mapped, Plane=evalsrf.Frame)  # -> Geometry, Transform
loft = Loft(Curves=rotate.Geometry, Options={Adjust=False, Closed=False, LoftEnds=0, LoftSimp=0, LoftType=0, Rebuild=10, Refit=0.01})

srf = Surface(reparameterize(loft))
flip = Flip(Surface=srf)  # -> Surface, Result

# ---- group: Surface Divisions
divide = DivideDomain²(Domain=srf, UCount=Slider(25, range=5..50), VCount=Slider(27, range=5..50))
panel = Panel(divide)

# ----
dedom2 = DeconstructDomain²(Domain=divide)  # -> UComponent, VComponent
graph_5 = GraphMapper(
    dedom2.VComponent,
    x0=0,
    x1=1,
    y0=0,
    y1=1,
    container_name="Bezier",
    cpx=[0, 0.8768717647, 0.4539140463, 1],
    cpy=[0, 0.126260519, 0.8200577497, 1])
graph_6 = GraphMapper(
    dedom2.UComponent,
    x0=0,
    x1=1,
    y0=0,
    y1=1,
    container_name="Bezier",
    cpx=[0, 0.2761761248, 0.8623790145, 1],
    cpy=[0, 0.7635940313, 0.340637207, 1])
dom² = ConstructDomain²(DomainU=graph_6, DomainV=graph_5)
panel_2 = Panel(dom²)

# ---- group: Height Randomization
lng = ListLength(List=divide)
random = Random(Range=Domain(0, 1), Number=lng, Seed=Slider(6, range=1..9))
panel_3 = Panel(random)

# ---- group: Feet to Inches
eval = Evaluate(F="(x/12)*y", x=random, y=Slider(12, range=1..12))

# ----
sbox = SurfaceBox(Surface=flip.Surface, Domain=dom², Height=eval)
sbox_2 = SurfaceBox(Surface=srf, Domain=dom², Height=eval)

join = BrepJoin(Breps=[sbox_2, sbox])  # -> Breps, Closed
larger = LargerThan(FirstNumber=random, SecondNumber=Slider(0.628, range=0..1))  # -> LargerThan, OrEqualTo

# ---- group: Final Geometry Lists for Baking
dispatch = Dispatch(List=join.Breps, DispatchPattern=larger.LargerThan)  # -> ListA, ListB

# ---- group: Color Preview
colour = ColourPicker(PickedColour=RGB(128, 128, 128))
colour_2 = ColourPicker(PickedColour=RGB(255, 0, 0))
preview = CustomPreview(Geometry=dispatch.ListA, Shader=colour)
preview_2 = CustomPreview(Geometry=dispatch.ListB, Shader=colour_2)
