# Grasshopper definition Class 7 (2D Paneling Tools).gh (Grasshopper 0.9.76)
# plug-ins: PTComponentLibrary

# ---- group: Making the Curve / Point Array
number_slider = Slider(9, range=2..20)
pt = ConstructPoint(XCoordinate=0, YCoordinate=0, ZCoordinate=0)
series = Series(Start=0, Step=Slider(6, range=0.5..20), Count=number_slider)
X = UnitX(Factor=series)
move = Move(Geometry=pt, Motion=X)  # -> Geometry, Transform

# ---- group: Making the Curve / Controlling the Point Z
range = Range(Domain=Domain(0, 1), Steps=expr("x-1", number_slider))
graph = GraphMapper(
    range,
    x0=0,
    x1=1,
    y0=0,
    y1=1,
    container_name="Sinc",
    Equation_X0=0.4895059466,
    Equation_X1=0.8200351596,
    Equation_Y0=0.6625098586,
    Equation_Y1=0.379470408)
panel = Panel(graph)
remap = RemapNumbers(Value=panel, Source=Domain(0, 1), Target=Slider(8.89, range=1..10))  # -> Mapped, Clipped
panel_2 = Panel(remap.Mapped)

# ---- group: Making the Curve
pdecon = Deconstruct(Point=move.Geometry)  # -> XComponent, YComponent, ZComponent
pt_2 = ConstructPoint(XCoordinate=pdecon.XComponent, YCoordinate=pdecon.YComponent, ZCoordinate=panel_2)
nurbs = NurbsCurve(Vertices=pt_2, Degree=3, Periodic=False)  # -> Curve, Length, Domain

# ----
crv = Curve(nurbs.Curve)

# ---- group: Array Curves
number_slider_2 = Slider(12, range=2..20)
series_2 = Series(Start=0, Step=Slider(12.4, range=5..30), Count=number_slider_2)
Z = UnitZ(Factor=series_2)
Y = UnitY(Factor=series_2)
move_2 = Move(Geometry=crv, Motion=Y)  # -> Geometry, Transform

# ---- group: NU Scale Controls
range_2 = Range(Domain=Domain(0, 1), Steps=expr("x-1", number_slider_2))
graph_2 = GraphMapper(
    range_2,
    x0=0,
    x1=1,
    y0=0,
    y1=1,
    amplitude=0.08368051052,
    container_name="Perlin",
    decay=0.4275362492,
    frequency=0.2244652212,
    x_offset=0.6811603308,
    y_offset=0.6630430222)
graph_3 = GraphMapper(
    range_2,
    x0=0,
    x1=1,
    y0=0,
    y1=1,
    container_name="Parabola",
    Ox=0.2463768125,
    Oy=0.6014492512,
    Px=0.8260869384,
    Py=0.8188405633)
remap_2 = RemapNumbers(Value=graph_3, Source=Domain(0, 1), Target=Slider(0.95, range=0.25..10))  # -> Mapped, Clipped
curvepoint = PointOnCurve(move_2.Geometry, parameter=0.5)
scale_nu = ScaleNU(Geometry=move_2.Geometry, Plane=curvepoint, ScaleX=graph_2, ScaleY=remap_2.Mapped, ScaleZ=1)  # -> Geometry, Transform

# ----
Y_2 = UnitY(Factor=1)

# ---- group: Rotation Controls
graph_4 = GraphMapper(
    range_2,
    x0=0,
    x1=1,
    y0=0,
    y1=1,
    container_name="Parabola",
    Ox=0.4782652855,
    Oy=0.1413016915,
    Px=0.9076086879,
    Py=0.6462862492)
remap_3 = RemapNumbers(Value=graph_4, Source=Domain(0, 1), Target=Slider(0.37, range=-1..1))  # -> Mapped, Clipped
extr = Extrude(Base=scale_nu.Geometry, Direction=Y_2)
md_slider = MDSlider(slider_value=Point(0.5, 0.5, 0.5), SliderMode=0, x_domain=Domain(0, 1), y_domain=Domain(0, 1), z_domain=Domain(0, 1))
evalsrf = EvaluateSurface(Surface=reparameterize(extr), Point=md_slider)  # -> Point, Normal, Frame
rotate = Rotate(Geometry=scale_nu.Geometry, Angle=remap_3.Mapped, Plane=evalsrf.Point)  # -> Geometry, Transform

# ---- group: Planar Grid
ptplanar = PlanarGrid(
    BasePoint=Point(0, 0, 0),
    IDir=Vector(1, 0, 0),
    JDir=Vector(0, 1, 0),
    IDistance=Slider(3.44, range=0..10),
    JDistance=Slider(4.3, range=0..10),
    INumber=Slider(24, range=0..100),
    JNumber=Slider(15, range=0..100))
ptcell = Cellulate(Grid=ptplanar)  # -> Wires, Cells, Meshes
ptcenter = CenterGrid(Grid=ptplanar)

# ---- group: SURFACE LOFT!!!
loft = Loft(Curves=rotate.Geometry, Options={Adjust=False, Closed=False, LoftEnds=0, LoftSimp=0, LoftType=0, Rebuild=10, Refit=0.01})

# ----
S = Surface(loft)

# ---- group: Surface Domain Division
ptsrfdomnum = SurfaceDomainNumber(Surface=S, UNumber=Slider(24, range=0..100), VNumber=Slider(9, range=0..100))

# ---- group: Panel Tool Generation
ptborders = GenerateBorders(Grid=ptsrfdomnum, PanelShape=Slider(2, range=0..3), Surface=S)
ptfaces = GenerateFaces(Grid=ptsrfdomnum, PanelShape=Slider(0, range=0..3), Surface=S)
ptflatfaces = GenerateFlatFaces(Grid=ptsrfdomnum, Method=Slider(3, range=0..3), Base=S)  # -> Faces, Deviation

# ----
custom_geometry = Curve(<curve referenced from the Rhino model>)

# ---- group: Panel Tool Morph 2D
polygon = Polygon(Plane=PlaneXY(0, 0, 0), Radius=3, Segments=3, FilletRadius=0)  # -> Polygon, Length
ptrandatts = RandomAttraction(Grid=ptsrfdomnum, Magnitude=Slider(0.414, range=0..1))  # -> Grid, Weights
polygon_2 = Polygon(Plane=PlaneXY(0, 0, 0), Radius=3, Segments=Slider(5, range=3..8), FilletRadius=0)  # -> Polygon, Length
cir = Circle(Plane=PlaneXY(0, 0, 0), Radius=Slider(0.74, range=0..1))
range_3 = Range(Domain=Domain(-1, 1), Steps=Slider(1000, range=100..1000))
rotate_2 = Rotate(Geometry=polygon_2.Polygon, Angle=range_3, Plane=PlaneXY(0, 0, 0))  # -> Geometry, Transform
merge = Merge(Data1=polygon.Polygon, Data2=polygon_2.Polygon)  # -> graft(Result)
ptmorph2dmean = Morph2DMean(
    Grid=ptsrfdomnum,
    Weights=ptrandatts.Weights,
    PatternCurvesS=polygon_2.Polygon,
    PatternCurvesE=polygon.Polygon,
    Shift_i=1,
    Shift_j=1)
ptmorph2dmap = Morph2DMap(Grid=ptsrfdomnum, PatternCurves=rotate_2.Geometry, Flatten=Toggle(True), Repeat=Toggle(True))
ptmorph2dlist = Morph2DList(Grid=ptsrfdomnum, Weights=ptrandatts.Weights, PatternCurves=merge, Shift_i=1, Shift_j=1)
ptmorph2d = Morph2D(Grid=ptsrfdomnum, PatternCurves=custom_geometry, Shift_i=Slider(1, range=1..3), Shift_j=Slider(1, range=1..3))
