# Grasshopper definition Class 8 (3D Morphing).gh (Grasshopper 0.9.76)
# plug-ins: PTComponentLibrary

# ---- group: Base Surface
srf = Surface(<surface referenced from the Rhino model>)

# ---- group: BASE SURFACE
srf_2 = Surface(<surface referenced from the Rhino model>)  # disabled

srf_3 = Surface(<surface referenced from the Rhino model>)  # disabled

# ----
number_slider = Slider(20, range=0.5..20)  # disabled

# ---- group: Grid Creation & Offset
number_slider_2 = Slider(8, range=5..50)  # disabled
number_slider_3 = Slider(20, range=5..50)  # disabled
ptsrfdomnum = SurfaceDomainNumber(Surface=srf_2, UNumber=number_slider_2, VNumber=number_slider_3)  # disabled
ptoffsetgrid = OffsetGrid(Grid=ptsrfdomnum, BRep=srf_2, Dis=number_slider)  # disabled

# ---- group: Surface Offset
md_slider = MDSlider(slider_value=Point(0.5, 0.5, 0.5), SliderMode=0, x_domain=Domain(0, 1), y_domain=Domain(0, 1), z_domain=Domain(0, 1))  # disabled
evalsrf = EvaluateSurface(Surface=srf_2, Point=md_slider)  # -> Point, Normal, Frame; disabled
amp = Amplitude(Vector=evalsrf.Normal, Amplitude=number_slider)  # disabled
move = Move(Geometry=srf_2, Motion=amp)  # -> Geometry, Transform; disabled

# ----
number_slider_4 = Slider(20, range=0.5..20)

# ---- group: Grid Creation, Randomization & Offset
ptsrfdomnum_2 = SurfaceDomainNumber(Surface=srf, UNumber=Slider(8, range=5..50), VNumber=Slider(20, range=5..50))
ptrandatts = RandomAttraction(Grid=ptsrfdomnum_2, Magnitude=Slider(0.8, range=0.1..1.5))  # -> Grid, Weights
ptoffsetgrid_2 = OffsetGrid(Grid=ptrandatts.Grid, BRep=srf, Dis=number_slider_4)

# ---- group: Surface Offset
md_slider_2 = MDSlider(slider_value=Point(0.5, 0.5, 0.5), SliderMode=0, x_domain=Domain(0, 1), y_domain=Domain(0, 1), z_domain=Domain(0, 1))
evalsrf_2 = EvaluateSurface(Surface=srf, Point=md_slider_2)  # -> Point, Normal, Frame
amp_2 = Amplitude(Vector=evalsrf_2.Normal, Amplitude=number_slider_4)
move_2 = Move(Geometry=srf, Motion=amp_2)  # -> Geometry, Transform

# ----
number_slider_5 = Slider(10, range=0.125..10)  # disabled

# ---- group: Surface Offset
md_slider_3 = MDSlider(slider_value=Point(0.5, 0.5, 0.5), SliderMode=0, x_domain=Domain(0, 1), y_domain=Domain(0, 1), z_domain=Domain(0, 1))  # disabled
evalsrf_3 = EvaluateSurface(Surface=srf_3, Point=md_slider_3)  # -> Point, Normal, Frame; disabled
amp_3 = Amplitude(Vector=evalsrf_3.Normal, Amplitude=number_slider_5)  # disabled
move_3 = Move(Geometry=srf_3, Motion=amp_3)  # -> Geometry, Transform; disabled

# ---- group: Grid Creation & Offest
number_slider_6 = Slider(29, range=1..50)  # disabled
number_slider_7 = Slider(31, range=1..50)  # disabled
ptsrfdomnum_3 = SurfaceDomainNumber(Surface=srf_3, UNumber=number_slider_6, VNumber=number_slider_7)  # disabled
ptoffsetgrid_3 = OffsetGrid(Grid=ptsrfdomnum_3, BRep=srf_3, Dis=number_slider_5)  # disabled

# ---- group: 3D MORPH LIST / Pattern Objects
number_slider_8 = Slider(1.3, range=0.3..1.3)  # disabled
number_slider_9 = Slider(20, range=3..20)  # disabled
range = Range(Domain=number_slider_8, Steps=number_slider_9)  # disabled
cyl = Cylinder(Base=PlaneXY(0, 0, 0), Radius=range, Length=1)  # disabled
brep = Brep(cyl)  # disabled

# ---- group: 3D MORPH LIST / Bounding Object
number_slider_10 = Slider(1, range=0.5..1)  # disabled
cyl_2 = Cylinder(Base=PlaneXY(0, 0, 0), Radius=number_slider_10, Length=1)  # disabled
bo = BoundingObjects(cyl_2)  # disabled

# ---- group: 3D MORPH LIST / Random Attraction
number_slider_11 = Slider(5, range=1..5)  # disabled
ptrandatts_2 = RandomAttraction(Grid=ptoffsetgrid_3, Magnitude=number_slider_11)  # -> Grid, Weights; disabled

# ---- group: 3D MORPH MAP
panel = Panel("2")  # disabled
lng = ListLength(List=flatten(ptsrfdomnum))  # disabled
dom = ConstructDomain(DomainStart=0, DomainEnd=panel)  # disabled
range_2 = Range(Domain=dom, Steps=expr("x-1", lng))  # disabled
mesh = Mesh(<mesh referenced from the Rhino model>)  # disabled
toggle = BooleanToggle(True)  # disabled
rotate = Rotate(Geometry=mesh, Angle=range_2, Plane=PlaneXY(0, 0, 0))  # -> Geometry, Transform; disabled
toggle_2 = BooleanToggle(True)  # disabled
ptmorph3dmap = Morph3DMap(Grid1=ptsrfdomnum, Grid2=ptoffsetgrid, PatternObjects=rotate.Geometry, Flatten=toggle_2, Repeat=toggle, Pull=False)  # disabled

# ---- group: 3D MORPH
mesh_2 = Mesh(<mesh referenced from the Rhino model>)  # disabled
number_slider_12 = Slider(1, range=0..10)  # disabled
number_slider_13 = Slider(1, range=0..10)  # disabled
toggle_3 = BooleanToggle(True)  # disabled
ptmorph3d = Morph3D(
    Grid1=ptsrfdomnum,
    Grid2=ptoffsetgrid,
    PatternObjects=mesh_2,
    Shift_i=number_slider_12,
    Shift_j=number_slider_13,
    Pull=toggle_3,
    Srf1=srf_2,
    Srf2=move.Geometry)  # disabled

# ---- group: RANDOMIZED GRID 3D MORPH / Pattern Objects
brep_2 = Brep(<brep referenced from the Rhino model>)
brep_3 = Brep(<brep referenced from the Rhino model>)
mesh_3 = MeshBrep(
    Brep=brep_2,
    Settings={GridMaxCount=0, GridMinCount=16, JaggedSeams=False, MaxEdgeLength=0, MinEdgeLength=0.0001, MinTolerance=0, Refine=True, RefineAngle=0, RelativeTolerance=0.65, SimplePlanes=True, Tolerance=0})
mesh_4 = MeshBrep(
    Brep=brep_3,
    Settings={GridMaxCount=0, GridMinCount=16, JaggedSeams=False, MaxEdgeLength=0, MinEdgeLength=0.0001, MinTolerance=0, Refine=True, RefineAngle=0, RelativeTolerance=0.65, SimplePlanes=True, Tolerance=0})
mesh_5 = Mesh(<mesh referenced from the Rhino model>)

# ---- group: 3D MORPH / Pattern Objects
brep_4 = Brep(<brep referenced from the Rhino model>)  # disabled
brep_5 = Brep(<brep referenced from the Rhino model>)  # disabled
mesh_6 = MeshBrep(
    Brep=brep_5,
    Settings={GridMaxCount=0, GridMinCount=16, JaggedSeams=False, MaxEdgeLength=0, MinEdgeLength=0.0001, MinTolerance=0, Refine=True, RefineAngle=0, RelativeTolerance=0.65, SimplePlanes=True, Tolerance=0})  # disabled
mesh_7 = MeshBrep(
    Brep=brep_4,
    Settings={GridMaxCount=0, GridMinCount=16, JaggedSeams=False, MaxEdgeLength=0, MinEdgeLength=0.0001, MinTolerance=0, Refine=True, RefineAngle=0, RelativeTolerance=0.65, SimplePlanes=True, Tolerance=0})  # disabled

# ---- group: 3D MORPH / Bounding Object
bbox = BoundingBox(Content=[mesh_6, mesh_7], Plane=PlaneXY(0, 0, 0), UnionBox=True)  # -> Box, Box_2; disabled

# ---- group: RANDOMIZED GRID 3D MORPH / Bounding Objects
bbox_2 = BoundingBox(Content=[mesh_3, mesh_4], Plane=PlaneXY(0, 0, 0), UnionBox=True)  # -> Box, Box_2

# ---- group: RANDOMIZED GRID 3D MORPH
ptmorph3d_2 = Morph3D(
    Grid1=ptsrfdomnum_2,
    Grid2=ptrandatts.Grid,
    PatternObjects=[mesh_3, mesh_4],
    BoundingObjects=bbox_2.Box,
    Shift_i=Slider(1, range=0..10),
    Shift_j=Slider(1, range=0..10),
    Pull=Toggle(True),
    Srf1=srf,
    Srf2=move_2.Geometry)

# ---- group: 3D MORPH LIST
toggle_4 = BooleanToggle(True)  # disabled
ptmorph3dlist = Morph3DList(
    Grid1=ptsrfdomnum_3,
    Grid2=ptoffsetgrid_3,
    Weights=ptrandatts_2.Weights,
    PatternObjects=graft(brep),
    BoundingObjects=bo,
    Shift_i=1,
    Shift_j=1,
    Pull=toggle_4,
    Srf1=srf_3,
    Srf2=move_3.Geometry)  # disabled

# ---- group: 3D CELLULATE
pt3dcell = Cellulate3DGrid(Grid1=ptsrfdomnum, Grid2=ptoffsetgrid)  # -> Wires, Cells, Boxes; disabled
