# Grasshopper definition Class 9 (Attractors) 2_4_16.gh (Grasshopper 0.9.76)
# plug-ins: PTComponentLibrary, LunchBox

# ---- group: Super Random Panels
paraboloid = HyperbolicParaboloid(U=100, V=100, a=2, b=2, S=5, D1=Domain(-4, 4), D2=Domain(-4, 4))
helicoid = HelicoidSurface(
    UDivisions=100,
    VDivisions=100,
    RParameter=2,
    TParameter=1,
    Scale=5,
    Domain1=Domain(-6.283185307, 6.283185307),
    Domain2=Domain(-3.141592654, 3.141592654))
conoid = ConoidSurface(
    UDivisions=100,
    VDivisions=100,
    RParameter=7,
    TParameter=1,
    Scale=5,
    Domain1=Domain(-4.838052687, 4.838052687),
    Domain2=Domain(-1.570796327, 1.570796327))
_3dsupershape = _3DSupershape(
    UDivisions=80,
    VDivisions=80,
    MParameter=14.074,
    AParameter=-0.06,
    BParameter=2.75,
    N1Parameter=3.75,
    N2Parameter=-0.48,
    N3Parameter=1.46,
    ScaleParameter=10,
    D1Interval=Domain(-3.141592654, 3.141592654),
    D2Interval=Domain(-1.570796327, 1.570796327))
enneper = EnneperSurface(UDivisions=100, VDivisions=100, RParameter=3, Scale=15, Domain1=Domain(0, 1), Domain2=Domain(-3.141592654, 3.141592654))
klein = KleinSurface(
    UDivisions=96,
    VDivisions=91,
    RParameter=3,
    TParameter=0.5,
    Scale=5,
    Domain1=Domain(0, 12.56637061),
    Domain2=Domain(0, 3.141592654))
mobius = MobiusSurface(
    UDivisions=100,
    VDivisions=100,
    RParameter=4,
    TParameter=0.5,
    Scale=5,
    Domain1=Domain(-3.141592654, 3.141592654),
    Domain2=Domain(-1, 1))
torus = TorusSurface(
    UDivisions=90,
    VDivisions=96,
    CParameter=4,
    RParameter=2,
    TParameter=1,
    Scale=5,
    Domain1=Domain(0, 6.283185307),
    Domain2=Domain(-3.141592654, 3.141592654))
mesh = Mesh(paraboloid)
mesh_2 = Mesh(helicoid)
mesh_3 = Mesh(conoid)
mesh_4 = Mesh(_3dsupershape)
mesh_5 = Mesh(enneper)
mesh_6 = Mesh(klein)
mesh_7 = Mesh(mobius)
mesh_8 = Mesh(torus)

# ---- group: Base Grid
srf = Surface(<surface referenced from the Rhino model>)
ptsrfdomnum = SurfaceDomainNumber(Surface=srf, UNumber=Slider(15, range=1..50), VNumber=Slider(15, range=1..50))

# ---- group: Attractor Points
md_slider = MDSlider(
    slider_value=Point(0.9074053764, 0.1840600967, 0.5),
    SliderMode=0,
    x_domain=Domain(0, 1),
    y_domain=Domain(0, 1),
    z_domain=Domain(0, 1))
evalsrf = EvaluateSurface(Surface=reparameterize(srf), Point=md_slider)  # -> Point, Normal, Frame

# ---- group: Grid Offset
ptoffsetgrid = OffsetGrid(Grid=ptsrfdomnum, BRep=srf, Dis=Slider(11.27, range=0.25..25))

# ---- group: Curve Attraction
attractor_curves = CrvAtts([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])
ptcrvatts = CurveAttraction(Grid=ptoffsetgrid, CrvAtts=attractor_curves, Magnitude=Slider(3, range=1..10))  # -> Grid, Weights

# ---- group: Point Attraction
ptpointatts = PointAttraction(Grid=ptoffsetgrid, PtAtts=evalsrf.Point, Magnitude=Slider(4, range=1..10))  # -> Grid, Weights

# ---- group: Curve Attraction
bo = BoundingObjects(<mesh referenced from the Rhino model>)
ptcell = Cellulate(Grid=ptcrvatts.Grid)  # -> Wires, Cells, Meshes; disabled
pt3dcell = Cellulate3DGrid(Grid1=ptsrfdomnum, Grid2=ptcrvatts.Grid)  # -> Wires, Cells, Boxes; disabled
ptmorph3d = Morph3D(Grid1=ptsrfdomnum, Grid2=ptcrvatts.Grid, PatternObjects=bo, BoundingObjects=bo, Shift_i=1, Shift_j=1, Pull=False)  # disabled

# ---- group: Weighted Attraction
bo_2 = BoundingObjects([mesh, mesh_2, mesh_3, mesh_4, mesh_5, mesh_6, mesh_7, mesh_8])
ptmorph3dlist = Morph3DList(
    Grid1=ptsrfdomnum,
    Grid2=ptoffsetgrid,
    Weights=ptpointatts.Weights,
    PatternObjects=graft(bo_2),
    Shift_i=1,
    Shift_j=1,
    Pull=False)

# ---- group: Point Attraction
bo_3 = BoundingObjects(<mesh referenced from the Rhino model>)
pt3dcell_2 = Cellulate3DGrid(Grid1=ptsrfdomnum, Grid2=ptpointatts.Grid)  # -> Wires, Cells, Boxes; disabled
ptmorph3d_2 = Morph3D(Grid1=ptsrfdomnum, Grid2=ptpointatts.Grid, PatternObjects=bo_3, BoundingObjects=bo_3, Shift_i=1, Shift_j=1, Pull=False)  # disabled
ptcell_2 = Cellulate(Grid=ptpointatts.Grid)  # -> Wires, Cells, Meshes; disabled
