# Grasshopper definition Class2_(1-12-15)(Points, Lists, Lines, Extrusions, Boxes, Baking).gh (Grasshopper 0.9.76)
# plug-ins: LunchBox

my_first_point = ConstructPoint(XCoordinate=Slider(2.109, range=0..25), YCoordinate=Slider(3, range=0..25), ZCoordinate=Slider(0, range=0..25))

my_second_point = ConstructPoint(XCoordinate=Slider(11.685, range=0..25), YCoordinate=Slider(3, range=0..25), ZCoordinate=Slider(5.078, range=0..25))

my_third_point = ConstructPoint(XCoordinate=Slider(9.609, range=0..25), YCoordinate=Slider(11.196, range=0..25), ZCoordinate=Slider(2.344, range=0..25))

my_fourth_point = ConstructPoint(XCoordinate=Slider(6.25, range=0..25), YCoordinate=Slider(15.157, range=0..25), ZCoordinate=Slider(0, range=0..25))

number_slider = Slider(3, range=0..25)  # disabled
number_slider_2 = Slider(3.5, range=0..25)  # disabled
number_slider_3 = Slider(0, range=0..25)  # disabled
merge = Merge(Data1=my_first_point, Data2=my_second_point, Data3=my_third_point, Data4=my_fourth_point)

points = PointList(Points=merge, Size=Slider(2, range=0..10))

vec = VectorXYZ(XComponent=number_slider_3, YComponent=number_slider, ZComponent=number_slider_2)  # -> Vector, Length; disabled

number_slider_4 = Slider(7.146, range=0..25)  # disabled
my_first_line = Line(StartPoint=my_first_point, EndPoint=my_second_point)  # disabled
Z = UnitZ(Factor=number_slider_4)  # disabled
my_first_plane = Extrude(Base=my_first_line, Direction=[Z, vec.Vector])  # disabled
number_slider_5 = Slider(3.674, range=0..25)  # disabled
Y = UnitY(Factor=number_slider_5)  # disabled
my_first_box = Extrude(Base=my_first_plane, Direction=Y)  # disabled

pline = PolyLine(Vertices=merge, Closed=Toggle(True))

intcrv = Interpolate(Vertices=merge, Degree=Slider(3, range=1..5), Periodic=Toggle(True), KnotStyle=1)  # -> Curve, Length, Domain

nurbs = NurbsCurve(Vertices=merge, Degree=Slider(3, range=1..5), Periodic=Toggle(True))  # -> Curve, Length, Domain

colour = ColourPicker(PickedColour=RGB(102, 102, 102))  # disabled

toggle = BooleanToggle(False)  # disabled
bake = ObjectBake(
    BakeToggle=toggle,
    GeometryObjects=my_first_box,
    Layer="GH_Bake",
    ObjectName="GH_Obj",
    ObjectColor=colour,
    LayerColor=RGB(255, 255, 255))  # disabled
