# Grasshopper definition Class3_(1-14-15)(Move, Rotate, Series, Boolean Union, Data Trees, Parameter Viewer).gh (Grasshopper 0.9.76)

pt = ConstructPoint(XCoordinate=Slider(10, range=0..10), YCoordinate=Slider(4.53, range=0..10), ZCoordinate=Slider(0, range=0..10))

cyl = Cylinder(Base=PlaneXY(0, 0, 0), Radius=0.5, Length=1)
scale_nu = ScaleNU(
    Geometry=cyl,
    Plane=PlaneXY(0, 0, 0),
    ScaleX=Slider(2.5, range=0.25..2.5),
    ScaleY=Slider(0.55, range=0.25..2.5),
    ScaleZ=Slider(0.67, range=0.25..2.5))  # -> Geometry, Transform

Y = UnitY(Factor=Slider(1, range=0..10))
move = Move(Geometry=pt, Motion=Y)  # -> Geometry, Transform

ln = Line(StartPoint=pt, EndPoint=move.Geometry)

rotate = Rotate(Geometry=ln, Angle=degrees(Slider(90, range=-180..180)), Plane=pt)  # -> Geometry, Transform

viewer = ParamViewer(rotate.Geometry)
panel = Panel(rotate.Geometry)

scale = Scale(Geometry=rotate.Geometry, Center=pt, Factor=Slider(0.77, range=0.25..2.5))  # -> Geometry, Transform

pi = Pi(Factor=Slider(0.5, range=-2..2))
rotax = RotateAxis(Geometry=scale.Geometry, Angle=pi, Axis=ln)  # -> Geometry, Transform

merge = Merge(Data1=ln, Data2=scale.Geometry, Data3=rotax.Geometry)

scale_nu_2 = ScaleNU(
    Geometry=merge,
    Plane=pt,
    ScaleX=Slider(1.29, range=0.25..2.5),
    ScaleY=Slider(0.9, range=0.25..2.5),
    ScaleZ=Slider(1.65, range=0.25..2.5))  # -> Geometry, Transform

viewer_2 = ParamViewer(scale_nu_2.Geometry)
panel_2 = Panel(scale_nu_2.Geometry)

pipe = Pipe(Curve=scale_nu_2.Geometry, Radius=Slider(0.019, range=0..3), Caps=Slider(2, range=1..3))

viewer_3 = ParamViewer(pipe)
panel_3 = Panel(pipe)
flatten = FlattenTree(Tree=pipe, Path="{0}")
sunion = SolidUnion(Breps=flatten)

series = Series(Start=0, Step=Slider(1.77, range=1..10), Count=Slider(10, range=2..10))
Z = UnitZ(Factor=series)
move_2 = Move(Geometry=sunion, Motion=Z)  # -> Geometry, Transform

viewer_4 = ParamViewer(move_2.Geometry)
panel_4 = Panel(move_2.Geometry)
