# Grasshopper definition Diamond Apertures.gh (Grasshopper 0.9.76)
# plug-ins: LunchBox

crv = Curve([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])
crv_2 = Curve([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])
loft = Loft(Curves=crv, Options={Adjust=False, Closed=False, LoftEnds=0, LoftSimp=0, LoftType=0, Rebuild=10, Refit=0.01})
crv_3 = Curve([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])
loft_2 = Loft(Curves=crv_2, Options={Adjust=False, Closed=False, LoftEnds=0, LoftSimp=0, LoftType=0, Rebuild=10, Refit=0.01})
loft_3 = Loft(Curves=crv_3, Options={Adjust=False, Closed=False, LoftEnds=0, LoftSimp=0, LoftType=0, Rebuild=10, Refit=0.01})
srf = Surface(reparameterize(loft))
srf_2 = Surface(loft_2)
trib = TrianglePanelsB(Surface=srf, UDivisions=Slider(8, range=1..25), VDivisions=Slider(12, range=1..25))
number_slider = Slider(8, range=0..10)
srf_3 = Surface(loft_3)
debrep = DeconstructBrep(Brep=trib)  # -> Faces, Edges, Vertices
area = Area(Geometry=trib)  # -> Area, Centroid
hex = HexagonCells(Surface=srf_3, UDivisions=number_slider, VDivisions=number_slider, TParameter=0.25)  # -> HexagonCells, Centers
trib_2 = TrianglePanelsB(Surface=srf_2, UDivisions=Slider(8, range=0..100), VDivisions=Slider(12, range=0..100))
srf_cp = SurfaceClosestPoint(Point=area.Centroid, Surface=srf)  # -> Point, UVPoint, Distance
evalsrf = EvaluateSurface(Surface=srf, Point=srf_cp.UVPoint)  # -> Point, Normal, Frame
curvepoint = PointOnCurve(debrep.Edges, parameter=0.5)
md_slider = MDSlider(slider_value=Point(0.5, 0.5, 0.5), SliderMode=0, x_domain=Domain(0, 1), y_domain=Domain(0, 1), z_domain=Domain(0, 1))
debrep_2 = DeconstructBrep(Brep=trib_2)  # -> Faces, Edges, Vertices
graft = GraftTree(Tree=hex.HexagonCells, IncludeEmptyLists=True, IncludeNullItems=True)
evalsrf_2 = EvaluateSurface(Surface=reparameterize(trib_2), Point=md_slider)  # -> Point, Normal, Frame
multiplication = Multiplication(A=evalsrf.Normal, B=Slider(1, range=1..5))
fpatch = FragmentPatch(Boundary=graft)
move = Move(Geometry=area.Centroid, Motion=multiplication)  # -> Geometry, Transform
amp = Amplitude(Vector=evalsrf_2.Normal, Amplitude=Slider(-3, range=-100..100))
debrep_3 = DeconstructBrep(Brep=fpatch)  # -> Faces, Edges, Vertices
ln = Line(StartPoint=graft(move.Geometry), EndPoint=curvepoint)
move_2 = Move(Geometry=evalsrf_2.Point, Motion=amp)  # -> Geometry, Transform
md_slider_2 = MDSlider(
    slider_value=Point(0.4757843018, 0.3321375847, 0.5),
    SliderMode=0,
    x_domain=Domain(0, 1),
    y_domain=Domain(0, 1),
    z_domain=Domain(0, 1))
pt = Point(move.Geometry)
item = ListItem(List=debrep_3.Faces, Index=0, Wrap=True)
explode = Explode(Curve=hex.HexagonCells, Recursive=True)  # -> Segments, Vertices
item_2 = ListItem(List=debrep_2.Vertices, Index=0, Wrap=True)  # -> Item, Item1, Item2, Item3
bnd = Bounds(Numbers=<missing>)
evalsrf_3 = EvaluateSurface(Surface=reparameterize(flatten(item)), Point=md_slider_2)  # -> Point, Normal, Frame
ln_2 = Line(StartPoint=graft(pt), EndPoint=debrep.Vertices)
explode_2 = Explode(Curve=hex.HexagonCells, Recursive=True)  # -> Segments, Vertices
amp_2 = Amplitude(Vector=evalsrf_3.Normal, Amplitude=Slider(-7, range=-50..100))
dom = ConstructDomain(DomainStart=".3", DomainEnd="1")
remap = RemapNumbers(Value=<missing>, Source=bnd, Target=dom)  # -> Mapped, Clipped
item_3 = ListItem(List=explode_2.Vertices, Index=0, Wrap=True)  # -> Item, Item1, Item2, Item3, Item4, Item5
curvepoint_2 = PointOnCurve(debrep_2.Edges, parameter=0.5)
ln_3 = Line(StartPoint=move_2.Geometry, EndPoint=flatten(item_2.Item1))
shift = ShiftList(List=ln_2, Shift=Slider(2, range=1..5), Wrap=True)
ln_4 = Line(StartPoint=move_2.Geometry, EndPoint=flatten(item_2.Item2))
ln_5 = Line(StartPoint=move_2.Geometry, EndPoint=flatten(item_2.Item3))
graft_2 = GraftTree(Tree=remap.Mapped, IncludeEmptyLists=True, IncludeNullItems=True)
eval = EvaluateCurve(Curve=ln, Parameter=graft_2)  # -> Point, Tangent, Angle
ln_6 = Line(StartPoint=graft(pt), EndPoint=eval.Point)
shift_2 = ShiftList(List=ln_6, Shift=1, Wrap=True)
move_3 = Move(Geometry=hex.Centers, Motion=amp_2)  # -> Geometry, Transform
ln_7 = Line(StartPoint=move_2.Geometry, EndPoint=flatten(item_2.Item))
eval_2 = EvaluateCurve()  # -> Point, Tangent, Angle
merge = Merge(Data1=graft(ln_6), Data2=graft(ln_2))
merge_2 = Merge(Data1=graft(shift_2), Data2=graft(shift))
ln_8 = Line(StartPoint=move_3.Geometry)
ln_9 = Line(StartPoint=move_3.Geometry, EndPoint=flatten(item_3.Item1))
ln_10 = Line(StartPoint=move_3.Geometry)
ln_11 = Line(StartPoint=move_3.Geometry, EndPoint=flatten(item_3.Item4))
ln_12 = Line(StartPoint=move_3.Geometry, EndPoint=flatten(item_3.Item))
ln_13 = Line(StartPoint=move_3.Geometry, EndPoint=flatten(item_3.Item5))
ln_14 = Line(StartPoint=move_3.Geometry, EndPoint=flatten(item_3.Item2))
ln_15 = Line(StartPoint=move_3.Geometry, EndPoint=flatten(item_3.Item3))
loft_4 = Loft(Curves=merge, Options={Adjust=False, Closed=False, LoftEnds=0, LoftSimp=0, LoftType=0, Rebuild=10, Refit=0.01})
loft_5 = Loft(Curves=merge_2, Options={Adjust=False, Closed=False, LoftEnds=0, LoftSimp=0, LoftType=0, Rebuild=10, Refit=0.01})
ln_16 = Line(StartPoint=curvepoint_2, EndPoint=item_2.Item3)
ln_17 = Line(StartPoint=curvepoint_2, EndPoint=item_2.Item2)
ln_18 = Line(StartPoint=curvepoint_2, EndPoint=item_2.Item1)
curvepoint_3 = PointOnCurve(ln_18, parameter=0.333)
geo = Geometry([loft_4, loft_5])
