# Grasshopper definition ResideCompScript.gh (Grasshopper 0.9.76)
# plug-ins: LunchBox

large_fing = Curve(<curve referenced from the Rhino model>)
small_fings = Curve([<curve referenced from the Rhino model> x64])
srf = Surface(<surface referenced from the Rhino model>)

Z = UnitZ(Factor=1)
Z_2 = UnitZ(Factor=1)
project = Project(Curve=large_fing, Brep=srf, Direction=Vector(0, 0, 1))
project_2 = Project(Curve=small_fings, Brep=srf, Direction=Vector(0, 0, 1))  # disabled
amp = Amplitude(Vector=Z, Amplitude=Slider(-731, range=-1500..1500))
move = Move(Geometry=large_fing, Motion=amp)  # -> Geometry, Transform
amp_2 = Amplitude(Vector=Z_2, Amplitude=Slider(500, range=1..25000))
move_2 = Move(Motion=Vector(0, 0, 10))  # -> Geometry, Transform
patch = Patch(Curves=project, Spans=20, Flexibility=1, Trim=True)
move_3 = Move(Geometry=small_fings, Motion=amp)  # -> simplify(flatten(Geometry)), Transform
amp_3 = Amplitude(Vector=Z, Amplitude=Slider(500, range=-1500..1500))
patch_2 = Patch(Curves=project_2, Spans=20, Flexibility=1, Trim=True)  # disabled
extr = Extrude(Base=patch_2, Direction=amp_2)  # disabled
Z_3 = UnitZ(Factor=1)
move_4 = Move(Geometry=move_3.Geometry, Motion=amp_3)  # -> Geometry, Transform
fillet = FilletDistance(Curve=move.Geometry, Distance=Slider(1, range=1..10))
Z_4 = UnitZ(Factor=1)
lng = ListLength(List=move_4.Geometry)
R = Range(Domain(300, 500))
boundary = BoundarySurfaces(Edges=move_3.Geometry)

# ---- group: Direct Manipulation Curve
crv = Curve(fillet)

# ----
random = Random(Range=R, Number=lng, Seed=Slider(100, range=1..100))
neg = Negative(Value=random)
amp_4 = Amplitude(Vector=Z_4, Amplitude=random)

# ---- group: Array Curve Z Direction
number_slider = Slider(150, range=2..500)
series = Series(Start=0, Step=Slider(12, range=0.5..30), Count=number_slider)
Z_5 = UnitZ(Factor=series)
move_5 = Move(Geometry=crv, Motion=Z_5)  # -> Geometry, Transform

# ----
extr_2 = Extrude(Base=boundary, Direction=amp_4)

# ---- group: Scale & Manipulation of Array
range = Range(Domain=Domain(0, 1), Steps=expr("x-1", number_slider))
graph = GraphMapper(
    range,
    x0=0,
    x1=1,
    y0=0,
    y1=1,
    amplitude=0.2434259057,
    container_name="Perlin",
    decay=0.1564021707,
    frequency=0.3343505859,
    x_offset=0.5,
    y_offset=0.5)
graph_2 = GraphMapper(
    range,
    x0=0,
    x1=1,
    y0=0,
    y1=1,
    container_name="Sinc",
    Equation_X0=0,
    Equation_X1=0.6435953975,
    Equation_Y0=1,
    Equation_Y1=1)
curvepoint = PointOnCurve(move_5.Geometry, parameter=0.5)
remap = RemapNumbers(Value=graph, Source=Domain(0, 1), Target=Slider(1.06, range=0.25..3))  # -> Mapped, Clipped
panel = Panel(remap.Mapped)
scale_nu = ScaleNU(Geometry=move_5.Geometry, Plane=curvepoint, ScaleX=graph, ScaleY=remap.Mapped, ScaleZ=1)  # -> Geometry, Transform

# ----
rev = Reverse(Vector=amp_4)
debrep = DeconstructBrep(Brep=extr_2)  # -> Faces, Edges, Vertices
panel_2 = Panel(debrep.Faces)
item = ListItem(List=debrep.Faces, Index=Slider(5, range=0..5), Wrap=True)
area = Area(Geometry=move_4.Geometry)  # -> Area, Centroid
volume = Volume(Geometry=extr_2)  # -> Volume, Centroid
pt = Point(volume.Centroid)
panel_3 = Panel(move_5.Geometry)
panel_4 = Panel(pt)
viewer = ParamViewer(pt)
md_slider = MDSlider(slider_value=Point(0.5, 0.5, 0.5), SliderMode=0, x_domain=Domain(0, 1), y_domain=Domain(0, 1), z_domain=Domain(0, 1))
short = ShortestList(TrimMode=2)  # -> ListA, ListB
Y = UnitY(Factor=1)
floor_plates = BoundarySurfaces(Edges=scale_nu.Geometry)
number_slider_2 = Slider(100, range=1..100)  # disabled
dispatch = Dispatch(DispatchPattern=[True, False])  # -> ListA, ListB
item_2 = ListItem(List=move_5.Geometry, Index=0, Wrap=True)  # disabled
evalsrf = EvaluateSurface(Surface=floor_plates, Point=md_slider)  # -> Point, Normal, Frame

# ---- group: Surface Position Normal Rotation
graph_3 = GraphMapper(
    range,
    x0=0,
    x1=1,
    y0=0,
    y1=1,
    A=1,
    B=0,
    container_name="Linear",
    Graph_x0=0.25,
    Graph_x1=0.75,
    Graph_y0=0.25,
    Graph_y1=0.75)
md_slider_2 = MDSlider(
    slider_value=Point(0.5198326111, 0.4842844009, 0.5),
    SliderMode=0,
    x_domain=Domain(0, 1),
    y_domain=Domain(0, 1),
    z_domain=Domain(0, 1))
extr_3 = Extrude(Base=scale_nu.Geometry, Direction=Y)
remap_2 = RemapNumbers(Value=graph_3, Source=Domain(0, 1), Target=Slider(1, range=-1..1))  # -> Mapped, Clipped
panel_5 = Panel(remap_2.Mapped)
floor_plates_2 = Rotate(Geometry=scale_nu.Geometry, Angle=remap_2.Mapped, Plane=evalsrf.Point)  # -> Geometry, Transform

# ----
area_2 = Area(Geometry=item_2)  # -> Area, Centroid; disabled
line = LineSDL(Start=area_2.Centroid, Direction=Vector(0, 0, 1), Length=number_slider_2)  # disabled

# ---- group: Final Geometry
loft = Loft(
    Curves=floor_plates_2.Geometry,
    Options={Adjust=False, Closed=False, LoftEnds=0, LoftSimp=0, LoftType=0, Rebuild=10, Refit=0.01})

# ----
number_slider_3 = Slider(9, range=1..75)
number_slider_4 = Slider(24, range=1..75)
number_slider_5 = Slider(82, range=1..100)  # disabled
quadrand = RandomQuadPanels(Surface=loft, UDivisions=number_slider_3, VDivisions=number_slider_4, RandomSeed=number_slider_5)  # disabled
diamond = DiamondPanels(Surface=loft, UDivisions=number_slider_3, VDivisions=number_slider_4)  # -> DiamondPanels, TriPanels; disabled
hex = HexagonCells(Surface=loft, UDivisions=number_slider_3, VDivisions=number_slider_4, TParameter=0.25)  # -> graft(HexagonCells), Centers
pt_2 = Point(hex.Centers)
panel_6 = Panel(pt_2)
viewer_2 = ParamViewer(pt_2)
short_2 = ShortestList(ListA=pt, ListB=pt_2, TrimMode=2)  # -> ListA, ListB
long = LongestList(ListA=pt, ListB=pt_2, PaddingMode=4)  # -> ListA, ListB
patch_3 = Patch(Curves=hex.HexagonCells, Spans=20, Flexibility=1, Trim=True)
ln = Line(StartPoint=long.ListA, EndPoint=long.ListB)
pipe = Pipe(Curve=ln, Radius=1, Caps=2)
Z_6 = UnitZ(Factor=1)
boundary_2 = BoundarySurfaces(Edges=floor_plates_2.Geometry)
amp_5 = Amplitude(Vector=Z_6, Amplitude=Slider(1, range=0..1))
preview = CustomPreview(Geometry=extr_2, Shader=ColourSwatch(SwatchColor=RGB(156, 156, 156)))
preview_2 = CustomPreview(Geometry=pipe, Shader=ColourSwatch(SwatchColor=RGB(0, 18, 54)))
preview_3 = CustomPreview(Geometry=patch_3, Shader=ColourSwatch(SwatchColor=RGB(255, 255, 255)))
extr_4 = Extrude(Base=boundary_2, Direction=amp_5)
