# Grasshopper definition adaptive_components.gh (Grasshopper 1.0.7)
# plug-ins: Rhino.Inside for Autodesk Revit

# ---- group: PROJECTING A CURVE ONTO A MESH
curve_projection = Curve(<curve referenced from the Rhino model>)
Z = UnitZ(Factor=1)
topo_mesh = Mesh(<mesh referenced from the Rhino model>)
crv = Curve(curve_projection)
mesh = Mesh(topo_mesh)
projecttomesh = CSharpScript(curve=crv, mesh=mesh, dir=Z)  # -> out, A; inputs curve: Curve, mesh: Mesh, dir: Vector3d
# ---------- projecttomesh: C# usings ----------
using System.IO;
using System.Linq;
using System.Data;
using System.Drawing;
using System.Reflection;
using System.Windows.Forms;
using System.Xml;
using System.Xml.Linq;
using System.Runtime.InteropServices;

using Rhino.DocObjects;
using Rhino.Collections;
using GH_IO;
using GH_IO.Serialization;
# ---------- projecttomesh: C# ----------
    if (null != curve && null != mesh && dir.IsValid)
    {
      var tol = RhinoDoc.ActiveDoc.ModelAbsoluteTolerance;
      A = Curve.ProjectToMesh(curve, mesh, dir, tol);
    }
# ---------- end projecttomesh ----------
pulltomesh = CSharpScript(curve=crv, mesh=mesh)  # -> out, A; inputs curve: Curve, mesh: Mesh; disabled
# ---------- pulltomesh: C# ----------
    if (null != curve && null != mesh)
    {
      var tol = RhinoDoc.ActiveDoc.ModelAbsoluteTolerance;
      A = curve.PullToMesh(mesh, tol);
    }
# ---------- end pulltomesh ----------
panel = Panel(pulltomesh.A)  # disabled
projected_curve = Curve(projecttomesh.A)
panel_2 = Panel(projecttomesh.A)

# ---- group: Diving Curve into
distance_between_points = Slider(8, range=0..10)
len = Length(Curve=projected_curve)
division = Division(A=len, B=distance_between_points)
divide = DivideCurve(Curve=projected_curve, Count=division, Kinks=False)  # -> Points, Tangents, Parameters

# ---- group: CREATING POINT PAIRS FOR ADAPTIVE COMPONENTS
shift = ShiftList(List=divide.Points, Shift=1, Wrap=False)
pt = Point(divide.Points)
lng = ListLength(List=pt)  # -> expr("x-1", Length)
cull_i = CullIndex(List=pt, Indices=lng, Wrap=True)
panel_3 = Panel(cull_i)
panel_4 = Panel(shift)
merge = Merge(Data1=graft(panel_3), Data2=graft(panel_4))

# ---- group: CHOOSING THE ADAPTIVE FAMILY COMPONENT TYPE FROM MODEL
categories = BuiltInCategories("autodesk.revit.category.family:railingSupport-1.0.0", LayoutLevel=2, SearchPattern="support")
types = QueryTypes(Kind=3, Category=categories)
value_picker = ValuePicker(types)
item = ListItem(List=types, Index=value_picker, Wrap=True)

# ----
point_pairs = Geometry(merge)

# ---- group: PLACING ADAPTIVE COMPONENTS + UNPINNING THEM
compadap = AddComponentAdaptive(Points=point_pairs, Type=item, TrackingMode=2)
pinelem = PinElement(Element=compadap, Pinned=Toggle(False))  # -> Element, Pinned
