# Grasshopper definition Aqua2.gh (Grasshopper 1.0.7)
# plug-ins: Bifocals, LunchBox, Pufferfish, Rhino.Inside for Autodesk Revit

division = Division(A=Slider(3.5, range=0..10), B=Slider(12, range=0..100))
curve = Curve(<curve referenced from the Rhino model>)
curve_2 = Curve(<curve referenced from the Rhino model>)
negative = Negative(Value=division)
unit_z = UnitZ(Factor=negative)
kicker_curve = Curve(<curve referenced from the Rhino model>)
curve_3 = Curve(<curve referenced from the Rhino model>)
curve_4 = Curve(<curve referenced from the Rhino model>)
curve_5 = Curve(<curve referenced from the Rhino model>)
xy_plane = XYPlane(Origin=Point(0, 0, 0))
number_slider = Slider(100, range=1..250)
curve_6 = Curve(<curve referenced from the Rhino model>)
number_slider_2 = Slider(29, range=1..250)
end_points = EndPoints(Curve=curve_5)  # -> Start, End
end_points_2 = EndPoints(Curve=curve_4)  # -> Start, End
fillet = Fillet(Curve=curve, Radius=Slider(0.0125, range=0..0.1))
move = Move(Geometry=fillet, Motion=unit_z)  # -> Geometry, Transform
loft = Loft(
    Curves=[fillet, move.Geometry],
    Options={Adjust=False, Closed=False, LoftEnds=0, LoftSimp=0, LoftType=0, Rebuild=10, Refit=0.01})
division_2 = Division(A=Slider(3.5, range=0..10), B=Slider(12, range=0..100))
surface = Surface(curve_6)
curve_7 = Curve(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)
curve_8 = Curve(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)
point = Point(end_points_2.Start)
point_2 = Point(end_points.Start)
unit_z_2 = UnitZ(Factor=division_2)
curve_9 = Curve(<curve referenced from the Rhino model>)  # disabled
line = Line(StartPoint=point, EndPoint=point_2)
_2d_truss = _2DTruss(CurveA=curve, CurveB=curve_2, Divisions=Slider(20, range=1..30), TrussToggle=0)  # -> PrimaryLines, BraceLines, VerticalLines, StructureNodes
fillet_2 = Fillet(Curve=curve_8, Radius=Slider(0.0125, range=0..0.1))
division_3 = Division(A=number_slider_2, B=Slider(3, range=0..10))
fillet_3 = Fillet(Curve=curve_7, Radius=Slider(0.0125, range=0..0.1))
division_4 = Division(A=Slider(3.5, range=0..5), B=Slider(12, range=0..100))
srf = Surface(curve_9)  # disabled
move_2 = Move(Geometry=curve_2, Motion=unit_z_2)  # -> Geometry, Transform
xy_plane_2 = XYPlane(Origin=Point(0, 0, 0))
braced_grid_1_d_structure = BracedGrid1DStructure(Surface=surface, UDivisions=number_slider_2, VDivisions=division_3)  # -> PrimaryLines, BraceLines, StructureNodes
ghpython_script = GhPythonScript(x=srf)  # -> out, a; disabled
# ---------- ghpython_script: Python ----------
__author__ = "nplac"
__version__ = "2022.10.31"

import rhinoscriptsyntax as rs
import Rhino

input_srf = rs.coercesurface(x)

flipped_srf = Rhino.Geometry.Surface.Transpose(input_srf)

a = flipped_srf
# ---------- end ghpython_script ----------
number_slider_3 = Slider(400, range=1..1100)  # disabled
number_slider_4 = Slider(100, range=1..1100)  # disabled
divide_length = DivideLength(Curve=curve_3, Length=Slider(3, range=0..10))  # -> Points, Tangents, Parameters
divide_length_2 = DivideLength(Curve=line, Length=Slider(3, range=0..10))  # -> Points, Tangents, Parameters
divide_length_3 = DivideLength(Curve=kicker_curve, Length=Slider(3, range=0..10))  # -> Points, Tangents, Parameters
join_curves = JoinCurves(Curves=braced_grid_1_d_structure.BraceLines, Preserve=False)
number_slider_5 = Slider(0, range=0..1)
curve_10 = Curve(_2d_truss.BraceLines)
division_5 = Division(A=Slider(1.5, range=0..10), B=Slider(12, range=0..100))
division_6 = Division(A=division_4, B=Slider(2, range=0..10))
loft_2 = Loft(
    Geometry=[curve_2, move_2.Geometry],
    Options={Adjust=False, Closed=False, LoftEnds=0, LoftSimp=0, LoftType=0, Rebuild=10, Refit=0.01})
srf_2 = Surface(ghpython_script.a)  # disabled
guide = Guide(<guide referenced from the Rhino model>)
rectangle = Rectangle(Plane=xy_plane_2, XSize=division_4, YSize=division_5, Radius=0)  # -> Rectangle, Length
loft_3 = Loft(
    Curves=[fillet_3, fillet_2],
    Options={Adjust=False, Closed=False, LoftEnds=0, LoftSimp=0, LoftType=0, Rebuild=10, Refit=0.01})
negative_2 = Negative(Value=division_6)
flip_curve = FlipCurve(Curve=join_curves, Guide=guide)  # -> Curve, Flag
curve_11 = Curve(flip_curve.Curve)
line_2 = Line(StartPoint=divide_length_2.Points, EndPoint=divide_length.Points)
divide = DivideDomain²(Domain=srf_2, UCount=number_slider_3, VCount=number_slider_3)  # disabled
unit_x = UnitX(Factor=negative_2)
perp_frame = PerpFrame(Curve=line_2, Parameter=number_slider_5)
point_on_curve = PointOnCurve(line_2, parameter=0.75)
division_7 = Division(A=Slider(0.75, range=0..1), B=Slider(12, range=0..100))
divide_surface = DivideSurface(Surface=loft_3, UCount=Slider(15, range=1..100), VCount=Slider(50, range=1..100))  # -> Points, Normals, Parameters
subsrf = Isotrim(Surface=srf_2, Domain=divide)  # disabled
move_3 = Move(Geometry=rectangle.Rectangle, Motion=unit_x)  # -> Geometry, Transform
srf_3 = Surface(reparameterize(srf_2))  # disabled
md_slider = MDSlider(SliderMode=0, slider_value=Point(0.5, 0.5, 0.5), x_domain=Domain(0, 1), y_domain=Domain(0, 1), z_domain=Domain(0, 1))  # disabled
end_points_3 = EndPoints(Curve=curve_11)  # -> Start, End
xy_plane_3 = XYPlane(Origin=Point(0, 0, 0))
flip_matrix = FlipMatrix(Data=divide_surface.Points)
negative_3 = Negative(Value=division_7)
evalsrf = EvaluateSurface(Surface=reparameterize(subsrf), Point=md_slider)  # -> Point, Normal, UDirection, VDirection, Frame; disabled
line_3 = Line(StartPoint=point_on_curve, EndPoint=divide_length_3.Points)
point_3 = Point(point_on_curve)
division_8 = Division(A=Slider(4, range=0..10), B=Slider(12, range=0..100))
offset_curve = OffsetCurve(Curve=curve_6, Distance=division_8, Plane=xy_plane, Corners=1)
merge = Merge(Data1=curve_6, Data2=offset_curve)
join_curves_2 = JoinCurves(Curves=merge, Preserve=False)
loft_4 = Loft(Curves=join_curves_2, Options={Adjust=False, Closed=False, LoftEnds=0, LoftSimp=0, LoftType=0, Rebuild=10, Refit=0.01})
offset_curve_2 = OffsetCurve(Curve=curve_11, Distance=division_8, Plane=xy_plane_3, Corners=1)
end_points_4 = EndPoints(Curve=flatten(offset_curve_2))  # -> Start, End
orient = Orient(Geometry=move_3.Geometry, Source=xy_plane_2, Target=perp_frame)  # -> Geometry, Transform
division_9 = Division(A=Slider(0.5, range=0..1), B=Slider(12, range=0..100))
negative_4 = Negative(Value=division_9)
offset_surface = OffsetSurface(Surface=loft_2, Distance=negative_4, Retrim=True)
offset_surface_2 = OffsetSurface(Surface=loft_2, Distance=division_9, Retrim=True)
list_item = ListItem(List=point_3, Index=0, Wrap=True)
list_item_2 = ListItem(List=point_3, Index=Slider(-1, range=-1..0), Wrap=True)
panel = Panel(divide_surface.Points)
srf_cp = SurfaceClosestPoint(Point=evalsrf.Point, Surface=srf_3)  # -> Point, UVPoint, Distance; disabled
vector_2pt = Vector2Pt(PointA=end_points_3.Start, PointB=end_points_4.Start, Unitize=False)  # -> Vector, Length
polyline = PolyLine(Vertices=flip_matrix, Closed=False)
offset_surface_3 = OffsetSurface(Surface=offset_surface_2, Distance=division_7, BothSides=0, CreateSolid=True)
perp_frame_2 = PerpFrame(Curve=line_3, Parameter=number_slider_5)
offset_surface_4 = OffsetSurface(Surface=offset_surface, Distance=negative_3, BothSides=0, CreateSolid=True)
xy_plane_4 = XYPlane(Origin=Point(0, 0, 0))
image = ImageSampler(
    srf_cp.UVPoint,
    FilePath="G:\.shortcut-targets-by-id\1q3dJHP04dW5xGu4Sv5U0Gvs1DIdPSYGs\hoist\01_Projects\2218_Aqua\Design\aqua_logo.png",
    Filter="Value",
    Interpolate=True,
    Umax=1,
    Umin=0,
    Vmax=1,
    Vmin=0,
    Wrap=1)  # disabled
division_10 = Division(A=Slider(0.75, range=0..10), B=Slider(12, range=0..100))
line_4 = Line(StartPoint=list_item, EndPoint=list_item_2)
number_slider_6 = Slider(0.25, range=0..1)  # disabled
division_11 = Division(A=Slider(2.5, range=0..10), B=Slider(12, range=0..100))
evalsrf_2 = EvaluateSurface(Surface=reparameterize(srf_3), Point=srf_cp.UVPoint)  # -> Point, Normal, UDirection, VDirection, Frame; disabled
line_sdl = LineSDL(Start=end_points_3.Start, Direction=vector_2pt.Vector, Length=division_8)
pipe = Pipe(Curve=curve_10, Radius=division_9, Caps=0)
orient_2 = Orient(Geometry=move_3.Geometry, Source=xy_plane_2, Target=perp_frame_2)  # -> Geometry, Transform
rectangle_2 = Rectangle(Plane=xy_plane_4, XSize=division_10, YSize=division_11, Radius=0)  # -> Rectangle, Length
panel_2 = Panel(image)  # disabled
perp_frame_3 = PerpFrame(Curve=polyline, Parameter=Slider(0, range=0..1))
perp_frame_4 = PerpFrame(Curve=line_4, Parameter=number_slider_5)
_1 = A(1)  # disabled
circle = CircleCNR(Center=evalsrf_2.Point, Normal=evalsrf_2.Normal, Radius=number_slider_6)  # disabled
curve_12 = Curve(line_sdl)
sweep1 = Sweep1(Rail=graft(curve_11), Sections=graft(curve_12), Miter=1)
negative_5 = Negative(Value=division_9)
subtraction = Subtraction(A=_1, B=panel_2)  # disabled
division_12 = Division(A=Slider(0.75, range=0..1), B=Slider(12, range=0..100))
merge_2 = Merge(Data1=offset_surface_3, Data2=offset_surface_4)  # -> graft(BOTTOMCHORDS)
sweep1_2 = Sweep1(Rail=graft(line_3), Sections=graft(orient_2.Geometry), Miter=1)
sweep1_3 = Sweep1(Rail=graft(line_2), Sections=graft(orient.Geometry), Miter=1)
polygon = Polygon(Plane=PlaneXY(0, 0, 0), Radius=division_10, Segments=Slider(4, range=0..10), FilletRadius=0)  # -> Polygon, Length
number_slider_7 = Slider(0.2522, range=0.0001..1)  # disabled
offset_surface_5 = OffsetSurface(Surface=loft, Distance=negative_5, Retrim=True)
panel_3 = Panel(subtraction)  # disabled
offset_surface_6 = OffsetSurface(Surface=loft, Distance=division_9, Retrim=True)
negative_6 = Negative(Value=division_12)
division_13 = Division(A=Slider(0.125, range=0..1), B=Slider(12, range=0..100))
cap_holes = CapHoles(Brep=sweep1_3)
cap_holes_2 = CapHoles(Brep=sweep1_2)
orient_3 = Orient(Geometry=polygon.Polygon, Source=xy_plane_4, Target=perp_frame_3)  # -> graft(Geometry), Transform
unit_z_3 = UnitZ(Factor=division_13)
list_item_3 = ListItem(List=line_2, Index=0, Wrap=True)
number_slider_8 = Slider(12, range=0..100)  # disabled
max = Maximum(A=panel_3, B=number_slider_7)  # disabled
extrude = Extrude(Base=[sweep1, loft_4], Direction=unit_z_3)
panel_4 = Panel(max)  # disabled
offset_surface_7 = OffsetSurface(Surface=offset_surface_6, Distance=division_12, BothSides=0, CreateSolid=True)
webs = Geometry(pipe)
number_slider_9 = Slider(0.866, range=0..1)  # disabled
number_slider_10 = Slider(0.148, range=0..1)  # disabled
offset_surface_8 = OffsetSurface(Surface=offset_surface_5, Distance=negative_6, BothSides=0, CreateSolid=True)
end_points_5 = EndPoints(Curve=list_item_3)  # -> Start, End
sweep1_4 = Sweep1(Rail=graft(polyline), Sections=orient_3.Geometry, Miter=1)
division_14 = Division(A=panel_4, B=number_slider_8)  # disabled
brep_join = BrepJoin(Breps=extrude)  # -> Breps, Closed
vector_2pt_2 = Vector2Pt(PointA=end_points_5.Start, PointB=end_points_5.End, Unitize=False)  # -> Vector, Length
scale = Scale(Geometry=circle, Center=evalsrf_2.Point, Factor=division_14)  # -> Geometry, Transform; disabled
cap_holes_3 = CapHoles(Brep=sweep1_4)
larger = LargerThan(FirstNumber=subtraction, SecondNumber=number_slider_10)  # -> LargerThan, OrEqualTo; disabled
smaller = SmallerThan(FirstNumber=subtraction, SecondNumber=number_slider_9)  # -> SmallerThan, OrEqualTo; disabled
merge_3 = Merge(Data1=offset_surface_7, Data2=offset_surface_8)  # -> graft(TOPCHORDS)
align_plane = AlignPlane(Plane=perp_frame_4, Direction=vector_2pt_2.Vector)  # -> Plane, Angle
curve_13 = Curve(<curve referenced from the Rhino model>)
end_points_6 = EndPoints(Curve=curve_13)  # -> Start, End
panel_5 = Panel(smaller.OrEqualTo)  # disabled
panel_6 = Panel(larger.OrEqualTo)  # disabled
cull = CullPattern(List=flatten(scale.Geometry), CullPattern=flatten(larger.OrEqualTo))  # disabled
panel_7 = Panel(merge_3)
orient_4 = Orient(Geometry=move_3.Geometry, Source=xy_plane_2, Target=align_plane.Plane)  # -> Geometry, Transform
number_slider_11 = Slider(12, range=0..100)  # disabled
vector_2pt_3 = Vector2Pt(PointA=end_points_6.Start, PointB=end_points_6.End, Unitize=False)  # -> Vector, Length
number_slider_12 = Slider(0.125, range=0..1)  # disabled
series = Series(Start=0, Step=Slider(2, range=0..10), Count=Slider(126, range=1..250))
built_in_categories = BuiltInCategories("autodesk.revit.category.family:parking-1.0.0", LayoutLevel=2, SearchPattern="parking")
amplitude = Amplitude(Vector=vector_2pt_3.Vector, Amplitude=series)
built_in_categories_2 = BuiltInCategories("autodesk.revit.category.family:genericModel-1.0.0", LayoutLevel=2, SearchPattern="generic mode")  # disabled
query_materials = QueryMaterials(Name="hoist. - White")
built_in_categories_3 = BuiltInCategories("autodesk.revit.category.family:structuralFraming-1.0.0", LayoutLevel=2, SearchPattern="STRUCTURAL FRAMING")
sweep1_5 = Sweep1(Rail=graft(line_4), Sections=graft(orient_4.Geometry), Miter=1)
division_15 = Division(A=number_slider_12, B=number_slider_11)  # disabled
surface_2 = Surface(cull)  # disabled
query_materials_2 = QueryMaterials(Name="Steel 01, Stainless_1")
unit_y = UnitY(Factor=division_15)  # disabled
add_geometry_directshape = AddGeometryDirectShape(Name="LOADING STRIPES", Category=built_in_categories, Geometry=brep_join.Breps, Material=query_materials, TrackingMode=2)  # disabled
panel_8 = Panel("Signage")  # disabled
extrude_2 = Extrude(Base=surface_2, Direction=unit_y)  # disabled
merge_4 = Merge(Data1=cap_holes_2, Data2=cap_holes, Data3=sweep1_5)
panel_9 = Panel("Dark Bronze")  # disabled
add_geometry_directshape_2 = AddGeometryDirectShape(
    Name="EXTERIOR STIFFENERS",
    Category=built_in_categories_3,
    Geometry=cap_holes_3,
    Material=query_materials_2,
    TrackingMode=2)  # disabled
query_materials_3 = QueryMaterials(Name=panel_9)  # disabled
built_in_categories_4 = BuiltInCategories("autodesk.revit.category.family:structuralFraming-1.0.0", LayoutLevel=2, SearchPattern="STRUCTURAL FRAMING")
add_geometry_directshape_3 = AddGeometryDirectShape(Name=panel_8, Category=built_in_categories_2, Material=query_materials_3, TrackingMode=2)  # disabled
query_materials_4 = QueryMaterials(Name="Wood 36_1")
add_geometry_directshape_4 = AddGeometryDirectShape(Name="Awning Struts", Category=built_in_categories_4, Geometry=merge_4, Material=query_materials_4, TrackingMode=2)  # disabled
move_4 = Move(Geometry=merge_2, Motion=amplitude)  # -> Geometry, Transform
move_5 = Move(Geometry=merge_3, Motion=amplitude)  # -> Geometry, Transform
move_6 = Move(Geometry=webs, Motion=amplitude)  # -> graft(Geometry), Transform
flip_matrix_2 = FlipMatrix(Data=move_4.Geometry)
flip_matrix_3 = FlipMatrix(Data=move_5.Geometry)
list_item_4 = ListItem(List=flip_matrix_3, Index=0, Wrap=True)  # -> Item, Item1
flip_matrix_4 = FlipMatrix(Data=move_4.Geometry)
list_item_5 = ListItem(List=flip_matrix_2, Index=0, Wrap=True)  # -> Item, Item1
built_in_categories_5 = BuiltInCategories("autodesk.revit.category.family:structuralFraming-1.0.0", LayoutLevel=2, SearchPattern="STRUCTURAL FRAMING")
built_in_categories_6 = BuiltInCategories("autodesk.revit.category.family:structuralFraming-1.0.0", LayoutLevel=2, SearchPattern="STRUCTURAL FRAMING")
built_in_categories_7 = BuiltInCategories("autodesk.revit.category.family:structuralFraming-1.0.0", LayoutLevel=2, SearchPattern="STRUCTURAL FRAMING")
query_materials_5 = QueryMaterials(Name="Steel 01, Stainless_1")
query_materials_6 = QueryMaterials(Name="Wood 36_1")
query_materials_7 = QueryMaterials(Name="Wood 36_1")
add_geometry_directshape_5 = AddGeometryDirectShape(
    Name="Redbuilt Top Chords",
    Category=built_in_categories_6,
    Geometry=move_5.Geometry,
    Material=query_materials_6,
    TrackingMode=2)  # disabled
add_geometry_directshape_6 = AddGeometryDirectShape(
    Name="Redbuilt Bottom Chords",
    Category=built_in_categories_7,
    Geometry=move_4.Geometry,
    Material=query_materials_7,
    TrackingMode=2)  # disabled
add_geometry_directshape_7 = AddGeometryDirectShape(
    Name="Redbuilt Webs",
    Category=built_in_categories_5,
    Geometry=move_6.Geometry,
    Material=query_materials_5,
    TrackingMode=2)  # disabled
merge_5 = Merge(
    Data1="Redbuilt Top Chords",
    Data2="Redbuilt Top Chords",
    Data3="Redbuilt Webs",
    Data4="Redbuilt Bottom Chords",
    Data5="Redbuilt Bottom Chords")  # disabled
merge_6 = Merge(
    Data1=query_materials_6,
    Data2=query_materials_6,
    Data3=query_materials_5,
    Data4=query_materials_7,
    Data5=query_materials_7)  # disabled
merge_7 = Merge(Data1=list_item_4.Item, Data2=list_item_4.Item1, Data3=move_6.Geometry, Data4=list_item_5.Item, Data5=list_item_5.Item1)  # disabled
add_geometry_directshape_8 = AddGeometryDirectShape(Name=merge_5, Category=built_in_categories_5, Material=merge_6, TrackingMode=2)  # disabled
panel_10 = Panel(merge_7)
