# Grasshopper definition christmas_tree.gh (Grasshopper 1.0.7)
# plug-ins: Bifocals, PTComponentLibrary, LunchBox, Pufferfish, Rhino.Inside for Autodesk Revit

xy_plane = XYPlane(Origin=Point(0, 0, 0))
division = Division(A=Slider(84, range=0..100), B=Slider(12, range=0..100))
point = Point(<point referenced from the Rhino model>)
division_2 = Division(A=Slider(2, range=0..100), B=Slider(12, range=0..100))
division_3 = Division(A=Slider(2, range=0..100), B=Slider(12, range=0..100))
division_4 = Division(A=division, B=Slider(2, range=0..10))
move = Move(Geometry=point, Motion=Vector(0, 0, 10))  # -> Geometry, Transform
line = Line(StartPoint=point, EndPoint=move.Geometry)
construct_domain = ConstructDomain(DomainStart=division_4, DomainEnd=division_2)
divide_length = DivideLength(Curve=line, Distance=division_3, RoundUp=False, RoundDn=False)
pipe = Pipe(Curve=line, Radius=division_2, Caps=0)
split_list = SplitList(List=divide_length, Index=Slider(10, range=0..10))  # -> ListA, ListB
list_length = ListLength(List=split_list.ListB)
range = Range(Domain=construct_domain, Steps=list_length)
construct_domain_2 = ConstructDomain(DomainStart=Slider(43, range=10..100), DomainEnd=Slider(92, range=10..100))
number_slider = Slider(2, range=0..10)
point_on_curve = PointOnCurve(line, parameter=0.082)
polygon = Polygon(Plane=point, Radius=Slider(1.081, range=0.125..3), Segments=Slider(3, range=0..10), FilletRadius=0)  # -> Polygon, Length
circle = Circle(Plane=graft(split_list.ListB), Radius=graft(range))
list_length_2 = ListLength(List=flatten(circle))
dispatch = Dispatch(List=flatten(circle), DispatchPattern=[True, False])  # -> ListA, ListB
explode = Explode(Curve=polygon.Polygon, Recursive=True)  # -> Segments, Vertices
polygon_2 = Polygon(Plane=point_on_curve, Radius=division_2, Segments=Slider(3, range=0..10), FilletRadius=0)  # -> Polygon, Length
explode_2 = Explode(Curve=polygon_2.Polygon, Recursive=True)  # -> Segments, Vertices
random = Random(Range=construct_domain_2, Number=flatten(list_length_2), Seed=2)  # -> graft(Random)
add_curve_directshape = AddCurveDirectShape(Curve=dispatch.ListA, TrackingMode=2)
cull_index = CullIndex(List=explode_2.Vertices, Indices="-1", Wrap=True)
cull_index_2 = CullIndex(List=explode.Vertices, Indices="-1", Wrap=True)
divide_curve = DivideCurve(Curve=circle, Count=random, Kinks=False)  # -> Points, Tangents, Parameters
line_2 = Line(StartPoint=cull_index, EndPoint=cull_index_2)  # -> graft(Line)
point_on_curve_2 = PointOnCurve(line_2, parameter=0.798)
line_3 = Line(StartPoint=graft(split_list.ListB), EndPoint=divide_curve.Points)
division_5 = Division(A=Slider(0.25, range=0..100), B=Slider(12, range=0..100))
point_2 = Point(flatten(divide_curve.Points))
division_6 = Division(A=Slider(1.5, range=0..10), B=Slider(12, range=0..100))
circle_2 = Circle(Plane=point_on_curve, Radius=division_2)
random_split_list = RandomSplitList(MasterList=point_2, Seed=Slider(35, range=1..100), Split=Slider(0.1, range=0..1))  # -> ListA, ListB
perp_frames = PerpFrames(Curve=line_2, Count=Slider(1, range=0..10), Align=True)  # -> Frames, Parameters
number_slider_2 = Slider(0.2, range=0..1)
offset_curve = OffsetCurve(Curve=circle_2, Distance=Slider(0.041, range=0..1), Corners=1)
pipe_2 = Pipe(Curve=line_3, Radius=division_5, Caps=0)
point_3 = Point(random_split_list.ListB)
polygon_3 = Polygon(Plane=perp_frames.Frames, Radius=Slider(0.1, range=0..1), Segments=Slider(4, range=0..10), FilletRadius=0)  # -> Polygon, Length
curve = Curve(offset_curve)
curve_2 = Curve(circle_2)
negative = Negative(Value=number_slider_2)
unit_z = UnitZ(NumberSlider=[negative, number_slider_2])
panel = Panel(offset_curve)
loft = Loft(
    Curves=flatten([curve_2, curve]),
    Options={Adjust=False, Closed=False, LoftEnds=0, LoftSimp=0, LoftType=0, Rebuild=10, Refit=0.01})
rotate = Rotate(Geometry=polygon_3.Polygon, Angle=degrees(Slider(45, range=0..100)), Plane=perp_frames.Frames)  # -> Geometry, Transform
extrude = Extrude(Base=loft, Direction=unit_z)
random_split_list_2 = RandomSplitList(MasterList=point_3, Seed=2, Split=0.5)  # -> ListA, ListB
loft_2 = Loft(Curves=rotate.Geometry, Options={Adjust=False, Closed=False, LoftEnds=0, LoftSimp=0, LoftType=0, Rebuild=10, Refit=0.01})
geometry = Geometry(random_split_list_2.ListA)
geometry_2 = Geometry(random_split_list_2.ListB)
md_slider = MDSlider(SliderMode=0, slider_value=Point(0.5, 0.5, 0.5), x_domain=Domain(0, 1), y_domain=Domain(0, 1), z_domain=Domain(0, 1))
cap_holes = CapHoles(Brep=loft_2)
solid_union = SolidUnion(Breps=flatten([extrude, cap_holes]))
sphere = Sphere(Base=geometry, Radius=division_6)
sphere_2 = Sphere(Base=geometry_2, Radius=division_6)
evaluate_surface = EvaluateSurface(Surface=sphere, Point=md_slider)  # -> Point, Normal, UDirection, VDirection, Frame
division_7 = Division(A=Slider(7.805, range=0..10), B=Slider(12, range=0..100))
iso_curve = IsoCurve(Surface=sphere, UVPoint=evaluate_surface.Point)  # -> UIsocurve, VIsocurve
md_slider_2 = MDSlider(SliderMode=0, slider_value=Point(0.5, 0.5, 0.5), x_domain=Domain(0, 1), y_domain=Domain(0, 1), z_domain=Domain(0, 1))
evaluate_surface_2 = EvaluateSurface(Surface=sphere_2, Point=md_slider_2)  # -> Point, Normal, UDirection, VDirection, Frame
polygon_4 = Polygon(Plane=move.Geometry, Radius=division_7, Segments=Slider(3, range=0..10), FilletRadius=0)  # -> Polygon, Length
iso_curve_2 = IsoCurve(Surface=sphere_2, UVPoint=evaluate_surface_2.Point)  # -> UIsocurve, VIsocurve
curve_3 = Curve(flatten(iso_curve.UIsocurve))
panel_2 = Panel(curve_3)
curve_4 = Curve(flatten(iso_curve_2.UIsocurve))
construct_plane = ConstructPlane(Origin=move.Geometry, XAxis=Vector(1, 0, 0), YAxis=Vector(0, 0, 1))
orient = Orient(Geometry=polygon_4.Polygon, Source=move.Geometry, Target=construct_plane)  # -> Geometry, Transform
query_materials = QueryMaterials(Name="Dark Bronze")
rotate_2 = Rotate(Geometry=orient.Geometry, Angle=degrees(Slider(90, range=0..1000)), Plane=construct_plane)  # -> Geometry, Transform
material_graphics = MaterialGraphics(Material=query_materials)  # -> Material, UseRenderAppearance, Color, Transparency, SurfaceForegroundPattern, SurfaceForegroundColor, SurfaceBackgroundPattern, SurfaceBackgroundColor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
rotate_3 = Rotate(Geometry=rotate_2.Geometry, Angle=degrees(Slider(180, range=0..1000)), Plane=construct_plane)  # -> Geometry, Transform
unit_z_2 = UnitZ(Factor=Slider(0.364, range=0..1))
merge = Merge(Data1=rotate_2.Geometry, Data2=rotate_3.Geometry)
panel_3 = Panel(material_graphics.SurfaceForegroundPattern)
move_2 = Move(Geometry=merge, Motion=unit_z_2)  # -> Geometry, Transform
surface = Surface(move_2.Geometry)
offset_surface = OffsetSurface(Surface=surface, Distance=Slider(0.125, range=0..1), BothSides=0, CreateSolid=True)
solid_union_2 = SolidUnion(Breps=flatten(offset_surface))
colour_swatch = ColourSwatch(SwatchColor=RGB(255, 225, 0))
colour_swatch_2 = ColourSwatch(SwatchColor=RGB(112, 81, 30))
colour_swatch_3 = ColourSwatch(SwatchColor=RGB(2, 186, 5))
colour_swatch_4 = ColourSwatch(SwatchColor=RGB(34, 255, 0))
colour_swatch_5 = ColourSwatch(SwatchColor=RGB(255, 0, 0))
directshape_categories = DirectShapeCategories("autodesk.revit.category.family:site-1.0.0", SearchPattern="site")
colour_swatch_6 = ColourSwatch(SwatchColor=RGB(36, 0, 0))
directshape_categories_2 = DirectShapeCategories("autodesk.revit.category.family:site-1.0.0", SearchPattern="site")
convert_material = ConvertMaterial(Shader=colour_swatch, TrackingMode=2)
directshape_categories_3 = DirectShapeCategories("autodesk.revit.category.family:site-1.0.0", SearchPattern="site")
convert_material_2 = ConvertMaterial(Shader=colour_swatch_2, TrackingMode=2)
directshape_categories_4 = DirectShapeCategories("autodesk.revit.category.family:site-1.0.0", SearchPattern="site")
directshape_categories_5 = DirectShapeCategories("autodesk.revit.category.family:site-1.0.0", SearchPattern="site")
convert_material_3 = ConvertMaterial(Shader=colour_swatch_3, TrackingMode=2)
directshape_categories_6 = DirectShapeCategories("autodesk.revit.category.family:site-1.0.0", SearchPattern="site")
convert_material_4 = ConvertMaterial(Shader=colour_swatch_5, TrackingMode=2)
convert_material_5 = ConvertMaterial(Shader=colour_swatch_4, TrackingMode=2)
convert_material_6 = ConvertMaterial(Shader=colour_swatch_6, TrackingMode=2)
add_geometry_directshape = AddGeometryDirectShape(Name="Star", Category=directshape_categories, Geometry=solid_union_2, Material=convert_material, TrackingMode=2)  # disabled
add_geometry_directshape_2 = AddGeometryDirectShape(
    Name="Branches",
    Category=directshape_categories_3,
    Geometry=flatten(pipe_2),
    Material=convert_material_3,
    TrackingMode=2)  # disabled
add_geometry_directshape_3 = AddGeometryDirectShape(
    Name="Green Ornaments",
    Category=directshape_categories_4,
    Geometry=[sphere_2, curve_4],
    Material=convert_material_5,
    TrackingMode=2)
add_geometry_directshape_4 = AddGeometryDirectShape(Name="Trunk", Category=directshape_categories_2, Geometry=pipe, Material=convert_material_2, TrackingMode=2)  # disabled
add_geometry_directshape_5 = AddGeometryDirectShape(
    Name="Red Ornaments",
    Category=directshape_categories_5,
    Geometry=flatten([sphere, curve_3]),
    Material=convert_material_4,
    TrackingMode=2)
add_geometry_directshape_6 = AddGeometryDirectShape(Name="Tree Stand", Category=directshape_categories_6, Geometry=solid_union, Material=convert_material_6, TrackingMode=2)  # disabled
material_graphics_2 = MaterialGraphics(
    Material=convert_material_6,
    SurfaceForegroundPattern=material_graphics.SurfaceForegroundPattern,
    SurfaceForegroundColor=colour_swatch_6)  # -> Material, UseRenderAppearance, Color, Transparency, SurfaceForegroundPattern, SurfaceForegroundColor, SurfaceBackgroundPattern, SurfaceBackgroundColor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
material_graphics_3 = MaterialGraphics(
    Material=convert_material,
    SurfaceForegroundPattern=material_graphics.SurfaceForegroundPattern,
    SurfaceForegroundColor=colour_swatch)  # -> Material, UseRenderAppearance, Color, Transparency, SurfaceForegroundPattern, SurfaceForegroundColor, SurfaceBackgroundPattern, SurfaceBackgroundColor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
material_graphics_4 = MaterialGraphics(
    Material=convert_material_5,
    SurfaceForegroundPattern=material_graphics.SurfaceForegroundPattern,
    SurfaceForegroundColor=colour_swatch_4)  # -> Material, UseRenderAppearance, Color, Transparency, SurfaceForegroundPattern, SurfaceForegroundColor, SurfaceBackgroundPattern, SurfaceBackgroundColor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
material_graphics_5 = MaterialGraphics(
    Material=convert_material_3,
    SurfaceForegroundPattern=material_graphics.SurfaceForegroundPattern,
    SurfaceForegroundColor=colour_swatch_3)  # -> Material, UseRenderAppearance, Color, Transparency, SurfaceForegroundPattern, SurfaceForegroundColor, SurfaceBackgroundPattern, SurfaceBackgroundColor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
material_graphics_6 = MaterialGraphics(
    Material=convert_material_2,
    SurfaceForegroundPattern=material_graphics.SurfaceForegroundPattern,
    SurfaceForegroundColor=colour_swatch_2)  # -> Material, UseRenderAppearance, Color, Transparency, SurfaceForegroundPattern, SurfaceForegroundColor, SurfaceBackgroundPattern, SurfaceBackgroundColor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
material_graphics_7 = MaterialGraphics(
    Material=convert_material_4,
    SurfaceForegroundPattern=material_graphics.SurfaceForegroundPattern,
    SurfaceForegroundColor=colour_swatch_5)  # -> Material, UseRenderAppearance, Color, Transparency, SurfaceForegroundPattern, SurfaceForegroundColor, SurfaceBackgroundPattern, SurfaceBackgroundColor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
