# Grasshopper definition curb_planters.gh (Grasshopper 1.0.7)
# plug-ins: Bifocals

mesh = Mesh(<mesh referenced from the Rhino model>)
mesh_2 = Mesh(<mesh referenced from the Rhino model>)
curve = Curve([<curve referenced from the Rhino model> x38])
mesh_join = MeshJoin(Meshes=[mesh_2, mesh])
unit_z = UnitZ(Factor=1)
projecttomesh = CSharpScript(curve=curve, mesh=mesh_join, dir=unit_z)  # -> out, A; inputs curve: Curve, mesh: Mesh, dir: Vector3d
# ---------- projecttomesh: C# usings ----------
using System.IO;
using System.Linq;
using System.Data;
using System.Drawing;
using System.Reflection;
using System.Windows.Forms;
using System.Xml;
using System.Xml.Linq;
using System.Runtime.InteropServices;

using Rhino.DocObjects;
using Rhino.Collections;
using GH_IO;
using GH_IO.Serialization;
# ---------- projecttomesh: C# ----------
    if (null != curve && null != mesh && dir.IsValid)
    {
      var tol = RhinoDoc.ActiveDoc.ModelAbsoluteTolerance;
      A = Curve.ProjectToMesh(curve, mesh, dir, tol);
    }
# ---------- end projecttomesh ----------
join_curves = JoinCurves(Curves=projecttomesh.A, Preserve=False)
curve_2 = Curve(join_curves)
perp_frames = PerpFrames(Curve=curve_2, Count=10, Align=True)  # -> Frames, Parameters
division = Division(A=Slider(4, range=0..10), B=Slider(12, range=0..100))
division_2 = Division(A=division, B=Slider(4, range=0..10))
polygon = Polygon(Plane=perp_frames.Frames, Radius=division, Segments=Slider(4, range=0..10), FilletRadius=division_2)  # -> Polygon, Length
rotate = Rotate(Geometry=polygon.Polygon, Angle=degrees(Slider(45, range=0..100)), Plane=perp_frames.Frames)  # -> Geometry, Transform
panel = Panel(polygon.Polygon)
sweep1 = Sweep1(Rail=curve_2, Sections=rotate.Geometry, Miter=1)
cap_holes = CapHoles(Brep=sweep1)
