# Grasshopper definition radial_slats.gh (Grasshopper 1.0.7)
# plug-ins: Bifocals, LunchBox, Human

number_slider = Slider(1, range=1..100)
number_slider_2 = Slider(1, range=0..1)
number_slider_3 = Slider(1, range=1..100)
construct_domain = ConstructDomain(DomainStart=number_slider, DomainEnd=Slider(150, range=1..150))
xy_plane = XYPlane(Origin=Point(0, 0, 0))
remap_numbers = RemapNumbers(Value=number_slider_2, Source=Domain(0, 1), Target=construct_domain)  # -> Mapped, Clipped
circle = Circle(Plane=xy_plane, Radius=Slider(9, range=1..100))
circle_2 = Circle(Plane=xy_plane, Radius=Slider(57, range=1..100))
panel = Panel(remap_numbers.Mapped)
construct_domain_2 = ConstructDomain(DomainStart=Slider(-10, range=-10..10), DomainEnd=Slider(1, range=-10..10))
divide_curve = DivideCurve(Curve=circle, Count=remap_numbers.Mapped, Kinks=False)  # -> Points, Tangents, Parameters
divide_curve_2 = DivideCurve(Curve=circle_2, Count=remap_numbers.Mapped, Kinks=False)  # -> Points, Tangents, Parameters
line = Line(StartPoint=divide_curve.Points, EndPoint=divide_curve_2.Points)
list_length = ListLength(List=line)
construct_domain_3 = ConstructDomain(DomainStart=number_slider, DomainEnd=list_length)
random = Random(Range=construct_domain_2, Number=list_length, Seed=Slider(86, range=1..100))
random_2 = Random(Range=construct_domain_2, Number=list_length, Seed=Slider(99, range=1..100))
remap_numbers_2 = RemapNumbers(Value=number_slider_2, Source=Domain(0, 1), Target=construct_domain_3)  # -> Mapped, Clipped
extend_curve = ExtendCurve(Curve=line, Type=0, Start=random, End=random_2)
panel_2 = Panel(remap_numbers_2.Mapped)
perp_frames = PerpFrames(Curve=extend_curve, Count=Slider(1, range=0..1), Align=True)  # -> Frames, Parameters
polygon = Polygon(Plane=perp_frames.Frames, Radius=Slider(0.302, range=0.125..1), Segments=Slider(4, range=0..10), FilletRadius=0)  # -> Polygon, Length
panel_3 = Panel(extend_curve)
panel_4 = Panel(polygon.Polygon)
sweep1 = Sweep1(Rail=graft(extend_curve), Sections=polygon.Polygon, Miter=1)
random_split_list = RandomSplitList(MasterList=flatten(sweep1), Seed=Slider(31, range=1..100), Split=Slider(0.74, range=0..1))  # -> ListA, ListB
create_material = CreateMaterial(
    Diffuse=ColourSwatch(SwatchColor=RGB(0, 0, 0)),
    Specular=RGB(255, 255, 255),
    Emission=ColourSwatch(SwatchColor=RGB(148, 247, 67)),
    Transparency=0,
    Shine=0)
geometry = Geometry(random_split_list.ListB)
colour_swatch = ColourSwatch(SwatchColor=RGB(0, 0, 0))
custom_preview = CustomPreview(Geometry=geometry, Material=create_material)
custom_preview_lineweights = CustomPreviewLineweights(Geometry=geometry, Shader=create_material, Absolute=False)
