# Grasshopper definition site_design.gh (Grasshopper 1.0.7)
# plug-ins: Bifocals

geometry = Geometry([<brep referenced from the Rhino model> x2739])
deconstruct_brep = DeconstructBrep(Brep=geometry)  # -> Faces, Edges, Vertices
mesh = Mesh(<mesh referenced from the Rhino model>)
mesh_2 = Mesh(<mesh referenced from the Rhino model>)
mesh_join = MeshJoin(Meshes=[mesh, mesh_2])
surface = Surface(deconstruct_brep.Faces)
panel = Panel(surface)
list_item = ListItem(List=surface, Index=Slider(5, range=0..5), Wrap=True)
surface_2 = Surface(list_item)
curve = Curve(surface_2)
panel_2 = Panel(curve)
explode = Explode(Curve=curve, Recursive=True)  # -> Segments, Vertices
list_item_2 = ListItem(List=explode.Segments, Index=0, Wrap=True)
length = Length(Curve=explode.Segments)
smaller_than = SmallerThan(FirstNumber=length, SecondNumber=Slider(1, range=0..1))  # -> SmallerThan, OrEqualTo
dispatch = Dispatch(List=explode.Segments, DispatchPattern=smaller_than.SmallerThan)  # -> ListA, ListB
small_curves = Curve(dispatch.ListA)
long_curves = Curve(dispatch.ListB)
panel_3 = Panel(long_curves)
unit_z = UnitZ(Factor=1)
list_item_3 = ListItem(List=long_curves, Index=0, Wrap=True)
panel_4 = Panel(small_curves)
projecttomesh = CSharpScript(curve=list_item_3, mesh=mesh_join, dir=unit_z)  # -> out, A; inputs curve: Curve, mesh: Mesh, dir: Vector3d
# ---------- projecttomesh: C# usings ----------
using System.IO;
using System.Linq;
using System.Data;
using System.Drawing;
using System.Reflection;
using System.Windows.Forms;
using System.Xml;
using System.Xml.Linq;
using System.Runtime.InteropServices;

using Rhino.DocObjects;
using Rhino.Collections;
using GH_IO;
using GH_IO.Serialization;
# ---------- projecttomesh: C# ----------
    if (null != curve && null != mesh && dir.IsValid)
    {
      var tol = RhinoDoc.ActiveDoc.ModelAbsoluteTolerance;
      A = Curve.ProjectToMesh(curve, mesh, dir, tol);
    }
# ---------- end projecttomesh ----------
curve_2 = Curve(projecttomesh.A)
projecttomesh_2 = CSharpScript(curve=small_curves, mesh=mesh_join, dir=unit_z)  # -> out, A; inputs curve: Curve, mesh: Mesh, dir: Vector3d; same code as projecttomesh
shift_paths = ShiftPaths(Data=projecttomesh_2.A, Offset=-1)
list_item_4 = ListItem(List=flatten(curve_2), Index=0, Wrap=True)
list_item_5 = ListItem(List=shift_paths, Index=0, Wrap=True)
panel_5 = Panel(shift_paths)
sweep1 = Sweep1(Rail=curve_2, Sections=shift_paths, Miter=1)
division = Division(A=Slider(0.25, range=0..1), B=Slider(12, range=0..100))
unit_z_2 = UnitZ(Factor=division)
flip = Flip()  # -> Surface, Result
extrude = Extrude(Base=sweep1, Direction=unit_z_2)
panel_7 = Panel(curve_2)
