# Grasshopper definition slat fence.gh (Grasshopper 1.0.7)
# plug-ins: LunchBox

polygon = Polygon(Plane=PlaneXY(0, 0, 0), Radius=Slider(1.5, range=0..10), Segments=Slider(4, range=0..10), FilletRadius=0)  # -> Polygon, Length
number_slider = Slider(10, range=0..10)
area = Area(Geometry=polygon.Polygon)  # -> Area, Centroid
multiplication = Multiplication(A=Slider(0.25, range=0..6), B="12")
multiplication_2 = Multiplication(A=Slider(6, range=1..6), B="12")
Z = UnitZ(Factor=multiplication_2)
crv = Curve(<curve referenced from the Rhino model>)
move = Move(Geometry=crv, Motion=Z)  # -> Geometry, Transform
rotate = Rotate(Geometry=polygon.Polygon, Angle=degrees(Slider(45, range=0..100)), Plane=area.Centroid)  # -> Geometry, Transform
area_2 = Area(Geometry=rotate.Geometry)  # -> Area, Centroid
loft = Loft(
    Curves=[move.Geometry, crv],
    Options={Adjust=False, Closed=False, LoftEnds=0, LoftSimp=0, LoftType=0, Rebuild=10, Refit=0.01})
Z_2 = UnitZ(Factor=multiplication)
move_2 = Move(Geometry=move.Geometry, Motion=Z_2)  # -> Geometry, Transform
divide = DivideCurve(Curve=graft([crv, move_2.Geometry]), Count=Slider(2, range=0..10), Kinks=False)  # -> Points, Tangents, Parameters
quads = QuadPanels(Surface=loft, UDivisions=Slider(61, range=1..300), VDivisions=Slider(1, range=1..300))
flip = FlipMatrix(Data=divide.Points)
area_3 = Area(Geometry=quads)  # -> Area, Centroid
item = ListItem(List=flip, Index=Slider(1, range=0..1), Wrap=True)
scale_nu = ScaleNU(Geometry=quads, Plane=area_3.Centroid, ScaleX=1, ScaleY=1, ScaleZ=Slider(0.9124, range=0..1))  # -> Geometry, Transform
md_slider = MDSlider(SliderMode=0, slider_value=Point(0.5, 0.5, 0.5), x_domain=Domain(0, 1), y_domain=Domain(0, 1), z_domain=Domain(0, 1))
ln = Line(StartPoint=flip, EndPoint=item)
pframes = PerpFrames(Curve=ln, Count=10, Align=True)  # -> Frames, Parameters
vec2pt = Vector2Pt(PointA=area_2.Centroid, PointB=pframes.Frames, Unitize=False)  # -> Vector, Length
move_3 = Move(Geometry=rotate.Geometry, Motion=vec2pt.Vector)  # -> Geometry, Transform
loft_2 = Loft(Curves=move_3.Geometry, Options={Adjust=False, Closed=False, LoftEnds=0, LoftSimp=0, LoftType=0, Rebuild=10, Refit=0.01})
evalsrf = EvaluateSurface(Surface=scale_nu.Geometry, Point=md_slider)  # -> Point, Normal, UDirection, VDirection, Frame
amp = Amplitude(Vector=evalsrf.Normal, Amplitude=Slider(0.125, range=0..1))
pipe = Pipe(Radius=Slider(0.2, range=0..1), Caps=0)
pipe_2 = Pipe(Curve=move.Geometry, Radius=Slider(0.5, range=0..1), Caps=0)
cap = CapHoles(Brep=loft_2)
extr = Extrude(Base=scale_nu.Geometry, Direction=amp)
geo = Geometry([pipe_2, pipe])
