# Grasshopper definition striping.gh (Grasshopper 1.0.7)
# plug-ins: Bifocals, LunchBox

mesh = Mesh(<mesh referenced from the Rhino model>)
mesh_2 = Mesh(<mesh referenced from the Rhino model>)
curve = Curve(<curve referenced from the Rhino model>)
xy_plane = XYPlane(Origin=Point(0, 0, 0))
unit_z = UnitZ(Factor=1)
mesh_join = MeshJoin(Meshes=[mesh, mesh_2])
surface = Surface(curve)
number_slider = Slider(11, range=1..100)
division = Division(A=number_slider, B=Slider(2, range=0..10))
curve_2 = Curve([<curve referenced from the Rhino model> x2])
braced_grid_1_d_structure = BracedGrid1DStructure(Surface=surface, UDivisions=division, VDivisions=number_slider)  # -> PrimaryLines, BraceLines, StructureNodes
projecttomesh = CSharpScript(curve=braced_grid_1_d_structure.BraceLines, mesh=mesh_join, dir=unit_z)  # -> out, flatten(A); inputs curve: Curve, mesh: Mesh, dir: Vector3d
# ---------- projecttomesh: C# usings ----------
using System.IO;
using System.Linq;
using System.Data;
using System.Drawing;
using System.Reflection;
using System.Windows.Forms;
using System.Xml;
using System.Xml.Linq;
using System.Runtime.InteropServices;

using Rhino.DocObjects;
using Rhino.Collections;
using GH_IO;
using GH_IO.Serialization;
# ---------- projecttomesh: C# ----------
    if (null != curve && null != mesh && dir.IsValid)
    {
      var tol = RhinoDoc.ActiveDoc.ModelAbsoluteTolerance;
      A = Curve.ProjectToMesh(curve, mesh, dir, tol);
    }
# ---------- end projecttomesh ----------
loft = Loft(Curves=curve_2, Options={Adjust=False, Closed=False, LoftEnds=0, LoftSimp=0, LoftType=0, Rebuild=10, Refit=0.01})
join_curves = JoinCurves(Curves=projecttomesh.A, Preserve=False)
guide = Guide(<guide referenced from the Rhino model>)
divide_curve = DivideCurve(Curve=curve_2, Count=Slider(7, range=1..100), Kinks=False)  # -> Points, Tangents, Parameters
flip_curve = FlipCurve(Curve=join_curves, Guide=guide)  # -> Curve, Flag
curve_3 = Curve(flip_curve.Curve)
panel = Panel(divide_curve.Points)
end_points = EndPoints(Curve=curve_3)  # -> Start, End
flip_matrix = FlipMatrix(Data=divide_curve.Points)
xy_plane_2 = XYPlane(Origin=Point(0, 0, 0))
division_2 = Division(A=Slider(4, range=0..10), B=Slider(12, range=0..100))
offset_curve = OffsetCurve(Curve=curve, Distance=division_2, Plane=xy_plane, Corners=1)
merge = Merge(Data1=curve, Data2=offset_curve)
projecttomesh_2 = CSharpScript(curve=merge, mesh=mesh_join, dir=unit_z)  # -> out, flatten(A); inputs curve: Curve, mesh: Mesh, dir: Vector3d; same code as projecttomesh
join_curves_2 = JoinCurves(Curves=projecttomesh_2.A, Preserve=False)
loft_2 = Loft(Curves=join_curves_2, Options={Adjust=False, Closed=False, LoftEnds=0, LoftSimp=0, LoftType=0, Rebuild=10, Refit=0.01})
offset_curve_2 = OffsetCurve(Curve=curve_3, Distance=division_2, Plane=xy_plane_2, Corners=1)
end_points_2 = EndPoints(Curve=flatten(offset_curve_2))  # -> Start, End
list_item = ListItem(List=flip_matrix, Index=0, Wrap=True)  # -> Item, Item1
vector_2pt = Vector2Pt(PointA=end_points.Start, PointB=end_points_2.Start, Unitize=False)  # -> Vector, Length
line = Line(StartPoint=list_item.Item, EndPoint=list_item.Item1)
xy_plane_3 = XYPlane(Origin=Point(0, 0, 0))
curve_4 = Curve(line)
line_sdl = LineSDL(Start=end_points.Start, Direction=vector_2pt.Vector, Length=division_2)
curve_5 = Curve(line_sdl)
sweep1 = Sweep1(Rail=graft(curve_3), Sections=graft(curve_5), Miter=1)
offset_curve_3 = OffsetCurve(Curve=curve_4, Distance=Slider(1, range=0..1), Plane=xy_plane_3, Corners=1)
weave = Weave(Pattern=[0, 1], Stream0=curve_4, Stream1=offset_curve_3, NullGaps=False)
division_3 = Division(A=Slider(0.125, range=0..1), B=Slider(12, range=0..100))
unit_z_2 = UnitZ(Factor=division_3)
extrude = Extrude(Base=[sweep1, loft_2], Direction=unit_z_2)
projecttomesh_3 = CSharpScript(curve=weave, mesh=mesh_join, dir=unit_z)  # -> out, A; inputs curve: Curve, mesh: Mesh, dir: Vector3d; same code as projecttomesh
brep_join = BrepJoin(Breps=extrude)  # -> Breps, Closed
flip_curve_2 = FlipCurve(Curve=projecttomesh_3.A, Guide=guide)  # -> Curve, Flag
shift_paths = ShiftPaths(Data=flip_curve_2.Curve, Offset=-1)
loft_3 = Loft(Curves=shift_paths, Options={Adjust=False, Closed=False, LoftEnds=0, LoftSimp=0, LoftType=0, Rebuild=10, Refit=0.01})
panel_2 = Panel(shift_paths)
unit_z_3 = UnitZ(Factor=division_3)
extrude_2 = Extrude(Base=loft_3, Direction=unit_z_3)
