# Grasshopper definition pylon.gh (Grasshopper 1.0.7)
# plug-ins: LunchBox, Kangaroo2 Components

md_slider = MDSlider(SliderMode=0, slider_value=Point(0.5, 0.5, 0.5), x_domain=Domain(0, 1), y_domain=Domain(0, 1), z_domain=Domain(0, 1))
srf = Surface()
brep = Brep([<brep referenced from the Rhino model> x26])
debrep = DeconstructBrep(Brep=brep)  # -> Faces, Edges, Vertices
panel = Panel(debrep.Faces)
debrep_2 = DeconstructBrep(Brep=debrep.Faces)  # -> Faces, Edges, Vertices
number_slider = Slider(2, range=0..15)
number_slider_2 = Slider(2, range=0..15)
panel_2 = Panel(debrep_2.Edges)
evalsrf = EvaluateSurface(Surface=debrep.Faces, Point=md_slider)  # -> Point, Normal, UDirection, VDirection, Frame
gridbraced2d = BracedGrid2DStructure(Surface=debrep.Faces, UDivisions=number_slider, VDivisions=number_slider_2)  # -> PrimaryLines, BraceLines, StructureNodes; disabled
diagrid = DiagridStructure(Surface=debrep.Faces, UDivisions=number_slider, VDivisions=number_slider_2, Type=True)  # -> StructureLines, StructureNodes
join = JoinCurves(Curves=debrep_2.Edges, Preserve=False)
panel_3 = Panel(join)
crv = Curve([<curve referenced from the Rhino model> x19])
trim = TrimWithRegions(Curve=diagrid.StructureLines, Regions=join, Plane=evalsrf.Frame)  # -> Inside, Outside
trim_2 = TrimWithRegions(Curve=trim.Inside, Regions=crv, Plane=evalsrf.Frame)  # -> Inside, Outside
geo = Geometry([trim.Inside, join])
geo_2 = Geometry(trim_2.Outside)
mp = MultiPipe(Curves=geo, NodeSize=".25", EndOffset=1, StrutSize=1, Segment=0, KinkAngle=0.6, CubeFit=1, Caps=2)
brep_2 = Brep(mp)
geo_3 = Geometry()
