# Grasshopper definition slatDome.gh (Grasshopper 1.0.7)
# plug-ins: LunchBox

number_slider = Slider(4.25, range=0..10)
number_slider_2 = Slider(6, range=0..10)
number_slider_3 = Slider(4, range=0..10)
addition = Addition(A=number_slider_2, B=Slider(0.5, range=0..1))
Z = UnitZ(Factor=number_slider_3)
sph = Sphere(Base=PlaneXY(0, 0, 0), Radius=number_slider_2)
number_slider_4 = Slider(70, range=0..100)
move = Move(Geometry=sph, Motion=Z)  # -> Geometry, Transform
area = Area(Geometry=move.Geometry)  # -> Area, Centroid
contour = Contour(Shape=move.Geometry, Point=Point(0, 0, 0), Direction=Vector(0, 0, 1), Distance=".5")
contour_2 = Contour(Shape=move.Geometry, Point=Point(0, 0, 0), Direction=Vector(0, 0, 1), Distance="3")
rectangle = Rectangle(Plane=PlaneXY(0, 0, 0), XSize=number_slider_4, YSize=number_slider_4, Radius=0)  # -> Rectangle, Length
division = Division(A=number_slider_4, B="-2")
lng = ListLength(List=contour)
split = SplitList(List=flatten(contour), Index=Slider(2, range=0..10))  # -> ListA, ListB
split_2 = SplitList(List=flatten(contour_2), Index=Slider(1, range=0..10))  # -> ListA, ListB
item = ListItem(List=flatten(contour), Index="-1", Wrap=True)
subtraction = Subtraction(A=lng, B="1")
vec = VectorXYZ(XComponent=division, YComponent=division, ZComponent=0)  # -> Vector, Length
geo = Geometry(split.ListB)
Z_2 = UnitZ(Factor=Slider(12, range=0..100))
geo_2 = Geometry(split_2.ListB)
move_2 = Move(Geometry=rectangle.Rectangle, Motion=vec.Vector)  # -> Geometry, Transform
srf = Surface(item)
neg = Negative(Value=number_slider_4)
srf_2 = Surface(move_2.Geometry)
panel = Panel("1")
Z_3 = UnitZ(Factor=neg)
extr = Extrude(Base=srf_2, Direction=Z_3)
number_slider_5 = Slider(0.088, range=0..1)
number_slider_6 = Slider(0.125, range=0..1)
sdiff = SolidDifference(BrepsA=move.Geometry, BrepsB=extr)
number_slider_7 = Slider(6, range=0..10)
neg_2 = Negative(Value=number_slider)
neg_3 = Negative(Value=number_slider_5)
debrep = DeconstructBrep(Brep=sdiff)  # -> Faces, Edges, Vertices
item_2 = ListItem(List=debrep.Edges, Index=0, Wrap=True)
extr_2 = Extrude(Base=srf, Direction=Z_2)
pt = ConstructPoint(XCoordinate=0, YCoordinate=number_slider, ZCoordinate=0)
pt_2 = ConstructPoint(XCoordinate=0, YCoordinate=neg_2, ZCoordinate=0)
offset = OffsetCurve(Curve=item_2, Distance=Slider(1, range=0..1), Corners=1)
sph_2 = Sphere(Base=PlaneXY(0, 0, 0), Radius=addition)
Z_4 = UnitZ(Factor=number_slider_3)
Z_5 = UnitZ(Factor=Slider(0.125, range=0..1))
item_3 = ListItem(List=debrep.Faces, Index=0, Wrap=True)
loft = Loft(
    Curves=flatten([item_2, offset]),
    Options={Adjust=False, Closed=False, LoftEnds=0, LoftSimp=0, LoftType=0, Rebuild=10, Refit=0.01})
move_3 = Move(Geometry=sph_2, Motion=Z_4)  # -> Geometry, Transform
squads = SkewedQuads(Surface=move_3.Geometry, UDivisions=number_slider_4, VDivisions=number_slider_4, TParameter=0)  # -> FullPanels, EdgePanels
project = Project(Curve=item, Brep=move.Geometry, Direction=Vector(0, 0, 1))
project_2 = Project(Curve=item, Brep=move_3.Geometry, Direction=Vector(0, 0, 1))
extr_3 = Extrude(Base=loft, Direction=Z_5)
ln = Line(StartPoint=pt, EndPoint=pt_2)
squads_2 = SkewedQuads(Surface=item_3, UDivisions=number_slider_4, VDivisions=number_slider_4, TParameter=0)  # -> FullPanels, EdgePanels
debrep_2 = DeconstructBrep(Brep=squads.FullPanels)  # -> Faces, Edges, Vertices
curvepoint = PointOnCurve(ln, parameter=0.25)
item_4 = ListItem(List=project, Index=Slider(1, range=0..1), Wrap=True)
item_5 = ListItem(List=project_2, Index=Slider(1, range=0..1), Wrap=True)
item_6 = ListItem(List=debrep_2.Edges, Index=0, Wrap=True)
debrep_3 = DeconstructBrep(Brep=squads_2.FullPanels)  # -> Faces, Edges, Vertices
Z_6 = UnitZ(Factor=Slider(9, range=0..20))
neg_4 = Negative(Value=Slider(0.125, range=0..1))
move_4 = Move(Geometry=curvepoint, Motion=Z_6)  # -> Geometry, Transform
item_7 = ListItem(List=debrep_3.Edges, Index=0, Wrap=True)
offset_2 = OffsetCurve(Curve=item_4, Distance=neg_4, Corners=1)
X = UnitX(Factor=Slider(20, range=0..100))
pline = PolyLine(Vertices=[pt, pt_2, move_4.Geometry], Closed=True)
loft_2 = Loft(
    Curves=flatten([item_4, offset_2]),
    Options={Adjust=False, Closed=False, LoftEnds=0, LoftSimp=0, LoftType=0, Rebuild=10, Refit=0.01})
crv = Curve(flatten(item_6))
crv_2 = Curve(flatten(item_7))
Z_7 = UnitZ(Factor=Slider(0.5, range=0..1))
trim = TrimWithBrep(Curve=crv_2, Brep=extr)  # -> Inside, Outside
trim_2 = TrimWithBrep(Curve=crv, Brep=extr)  # -> Inside, Outside
explode = Explode(Curve=pline, Recursive=False)  # -> Segments, Vertices
panel_2 = Panel(crv_2)
cull_i = CullIndex(List=explode.Segments, Indices=Slider(0, range=0..10), Wrap=True)
crv_3 = Curve(trim.Outside)
crv_4 = Curve(trim_2.Outside)
Y = UnitY(Factor=Slider(1, range=-10..10))
item_8 = ListItem(List=cull_i, Index=Slider(1, range=0..1), Wrap=True)
item_9 = ListItem(List=cull_i, Index=0, Wrap=True)
Y_2 = UnitY(Factor=Slider(-1, range=-10..10))
curvepoint_2 = PointOnCurve(item_8, parameter=0.5)
curvepoint_3 = PointOnCurve(item_9, parameter=0.5)
move_5 = Move(Geometry=curvepoint_2, Motion=Y)  # -> Geometry, Transform
move_6 = Move(Geometry=curvepoint_3, Motion=Y_2)  # -> Geometry, Transform
item_10 = ListItem(List=cull_i, Index=0, Wrap=True)
item_11 = ListItem(List=cull_i, Index="1", Wrap=True)
end = EndPoints(Curve=item_10)  # -> Start, End
scale = Scale(Center=Point(0, 0, 0), Factor=0.5)  # -> Geometry, Transform
end_2 = EndPoints(Curve=item_11)  # -> Start, End
number_slider_8 = Slider(1.075, range=1..2)
intcrv = Interpolate(Vertices=[end_2.Start, move_5.Geometry, end_2.End], Degree=3, Periodic=False, KnotStyle=1)  # -> Curve, Length, Domain
intcrv_2 = Interpolate(Vertices=[end.Start, move_6.Geometry, end.End], Degree=3, Periodic=False, KnotStyle=1)  # -> Curve, Length, Domain
join = JoinCurves(Curves=[intcrv_2.Curve, intcrv.Curve], Preserve=False)
md_slider = MDSlider(SliderMode=0, slider_value=Point(0.5, 0.5, 0.5), x_domain=Domain(0, 1), y_domain=Domain(0, 1), z_domain=Domain(0, 1))  # disabled
end_3 = EndPoints(Curve=join)  # -> Start, End
ln_2 = Line(StartPoint=end_3.Start, EndPoint=end_3.End)
number_slider_9 = Slider(0.125, range=0..1)  # disabled
md_slider_2 = MDSlider(SliderMode=0, slider_value=Point(0.5, 0.5, 0.5), x_domain=Domain(0, 1), y_domain=Domain(0, 1), z_domain=Domain(0, 1))
join_2 = JoinCurves(Curves=[join, ln_2], Preserve=False)
project_3 = Project(Curve=join_2, Brep=move.Geometry, Direction=X)
project_4 = Project(Curve=join_2, Brep=move_3.Geometry, Direction=X)
srf_3 = Surface(join_2)
item_12 = ListItem(List=project_3, Index=0, Wrap=True)
item_13 = ListItem(List=project_4, Index=0, Wrap=True)
extr_4 = Extrude(Base=srf_3, Direction=X)
trim_3 = TrimWithBrep(Curve=geo_2, Brep=extr_4)  # -> Inside, Outside
crv_5 = Curve(graft(trim_3.Outside))
offset_3 = OffsetCurve(Curve=crv_5, Distance=neg_3, Corners=1)
pipe = Pipe(Curve=offset_3, Radius=number_slider_5, Caps=0)
pframes = PerpFrames(Curve=crv_5, Count=Slider(3, range=0..10), Align=True)  # -> flatten(Frames), Parameters
trim_4 = TrimWithBrep(Curve=item_2, Brep=extr_4)  # -> Inside, Outside
item_14 = ListItem(List=pframes.Frames, Index=0, Wrap=True)
trim_5 = TrimWithBreps(Curve=crv_3, Brep=extr_4)  # -> Inside, Outside
trim_6 = TrimWithBreps(Curve=crv_4, Brep=extr_4)  # -> Inside, Outside
crv_6 = Curve(trim_6.Outside)
crv_7 = Curve(trim_5.Outside)
explode_2 = Explode(Curve=item_12, Recursive=False)  # -> Segments, Vertices
trim_7 = TrimWithBreps(Curve=crv_7, Brep=extr_2)  # -> Inside, Outside
trim_8 = TrimWithBreps(Curve=crv_6, Brep=extr_2)  # -> Inside, Outside
crv_8 = Curve(trim_8.Outside)  # disabled
crv_9 = Curve(trim_7.Outside)
join_3 = JoinCurves(Curves=flatten(crv_9), Preserve=False)
item_15 = ListItem(List=explode_2.Segments, Index=[Slider(1, range=0..1), Slider(2, range=0..10), Slider(3, range=0..10)], Wrap=True)
reb = RebuildCurve(Curve=join_3, Degree=Slider(3, range=0..10), Count=10, Tangents=False)
scale_2 = Scale(Geometry=reb, Center=area.Centroid, Factor=number_slider_8)  # -> Geometry, Transform
merge = Merge(Data1=graft(crv_9), Data2=graft(crv_8))
join_4 = JoinCurves(Curves=item_15, Preserve=False)
scale_3 = Scale(Geometry=join_4, Center=area.Centroid, Factor=number_slider_8)  # -> Geometry, Transform
merge_2 = Merge(Data1=graft(reb), Data2=graft(scale_2.Geometry))
merge_3 = Merge(Data1=graft(join_4), Data2=graft(scale_3.Geometry))
loft_3 = Loft(Curves=merge, Options={Adjust=False, Closed=False, LoftEnds=0, LoftSimp=0, LoftType=0, Rebuild=10, Refit=0.01})  # disabled
panel_3 = Panel(merge)  # disabled
scale_4 = Scale(Geometry=join_4, Center=area.Centroid, Factor=Slider(2, range=0..10))  # -> Geometry, Transform
panel_4 = Panel(merge_2)
loft_4 = Loft(Curves=merge_2, Options={Adjust=False, Closed=False, LoftEnds=0, LoftSimp=0, LoftType=0, Rebuild=10, Refit=0.01})
loft_5 = Loft(Curves=merge_3, Options={Adjust=False, Closed=False, LoftEnds=0, LoftSimp=0, LoftType=0, Rebuild=10, Refit=0.01})
evalsrf = EvaluateSurface(Surface=reparameterize(loft_3), Point=md_slider)  # -> Point, Normal, UDirection, VDirection, Frame; disabled
debrep_4 = DeconstructBrep(Brep=loft_5)  # -> Faces, Edges, Vertices
md_slider_3 = MDSlider(SliderMode=0, slider_value=Point(0.5, 0.5, 0.5), x_domain=Domain(0, 1), y_domain=Domain(0, 1), z_domain=Domain(0, 1))
evalsrf_2 = EvaluateSurface(Surface=reparameterize(loft_4), Point=md_slider_2)  # -> Point, Normal, UDirection, VDirection, Frame
amp = Amplitude(Vector=evalsrf.Normal, Amplitude=number_slider_9)  # disabled
evalsrf_3 = EvaluateSurface(Surface=reparameterize(debrep_4.Faces), Point=md_slider_3)  # -> Point, Normal, UDirection, VDirection, Frame
extr_5 = Extrude(Base=loft_3, Direction=amp)  # disabled
extr_6 = Extrude(Base=loft_2, Direction=Z_7)
pt_3 = Point(evalsrf_2.Point)
amp_2 = Amplitude(Vector=evalsrf_2.Normal, Amplitude=Slider(0.075, range=0..1))
extr_7 = Extrude(Base=loft_4, Direction=amp_2)
amp_3 = Amplitude(Vector=evalsrf_3.Normal, Amplitude=Slider(0.075, range=0..1))
extr_8 = Extrude(Base=debrep_4.Faces, Direction=amp_3)
sdiff_2 = SolidDifference(BrepsA=[extr_7, extr_8], BrepsB=extr)
geo_3 = Geometry(sdiff_2)
crv_10 = Curve(scale_4.Geometry)
crv_11 = Curve(join_4)
end_4 = EndPoints(Curve=crv_10)  # -> Start, End
end_5 = EndPoints(Curve=crv_11)  # -> Start, End
ln_3 = Line(StartPoint=end_4.Start, EndPoint=end_4.End)
ln_4 = Line(StartPoint=end_5.Start, EndPoint=end_5.End)
join_5 = JoinCurves(Curves=[crv_11, ln_4], Preserve=False)
join_6 = JoinCurves(Curves=[crv_10, ln_3], Preserve=False)
scale_5 = Scale(Geometry=join_5, Center=Point(0, 0, 0), Factor=0.5)  # -> Geometry, Transform
loft_6 = Loft(
    Curves=[scale_5.Geometry, join_6],
    Options={Adjust=False, Closed=False, LoftEnds=0, LoftSimp=0, LoftType=0, Rebuild=10, Refit=0.01})
scale_6 = Scale(Geometry=loft_6, Center=area.Centroid, Factor=Slider(0.57, range=0..10))  # -> Geometry, Transform
facen = FaceNormals()  # -> Centers, Normals
debrep_5 = DeconstructBrep(Brep=scale_6.Geometry)  # -> Faces, Edges, Vertices
md_slider_4 = MDSlider(SliderMode=0, slider_value=Point(0.5, 0.5, 0.5), x_domain=Domain(0, 1), y_domain=Domain(0, 1), z_domain=Domain(0, 1))
evalsrf_4 = EvaluateSurface(Surface=reparameterize(debrep_5.Faces), Point=md_slider_4)  # -> Point, Normal, UDirection, VDirection, Frame
amp_4 = Amplitude(Vector=evalsrf_4.Normal, Amplitude=Slider(1, range=0..10))
extr_9 = Extrude(Base=debrep_5.Faces, Direction=amp_4)
sdiff_3 = SolidDifference(BrepsA=extr_3, BrepsB=extr_9)
item_16 = ListItem(List=sdiff_3, Index=Slider(1, range=0..1), Wrap=True)
cap = CapHoles(Brep=item_16)
geo_4 = Geometry([pipe, extr_6, cap])
